# Dynamo custom node ShapelyContains.dyf (Dynamo 2.10.1.3976)
# category: Shapely.Analyse

shpolygon = Input(_shpolygon: var[]..[])
dynpoint = Input(_dynpoint: var[]..[])
code_block = CodeBlock(p=dynpoint) { p.X; p.Y; }
list_create = List.Create(item0=code_block.out0, item1=code_block.out1)
transpose = List.Transpose(lists=list_create)
count = List.Count(list=list_create@L2)
chop = List.Chop(list=transpose, lengths=count)
python_script = Python(IN[0]=chop)  # CPython3
# ---------- python_script.python (30 lines) ----------
import sys
import os
import clr

localapp = os.getenv(r'LOCALAPPDATA')
sys.path.append(os.path.join(localapp, r'python-3.8.3-embed-amd64\Lib\site-packages'))
import shapely.geometry as sg
import Autodesk.DesignScript.Geometry as adg
from shapely import normalize, Polygon , BufferJoinStyle
from shapely.geometry import Polygon, Point


dynamo_point = IN[0]
shapely_poly = []

def spolygon (dynamo_polygons ):
    
    exterior_points = [coord for coord in dynamo_polygons]
    shapely_poly = Point(exterior_points)
    return shapely_poly


if isinstance(IN[0], list):
    dynamo_point = IN[0]
else:
    dynamo_point = [IN[0]]

dynamo_geometries = [spolygon(geometry) for geometry in dynamo_point]

OUT = dynamo_geometries
# ----------------------------------------
python_script_2 = Python(IN[0]=shpolygon, IN[1]=python_script)  # CPython3
# ---------- python_script_2.python (30 lines) ----------
import sys
import os
import clr

localapp = os.getenv(r'LOCALAPPDATA')
sys.path.append(os.path.join(localapp, r'python-3.8.3-embed-amd64\Lib\site-packages'))

import shapely.geometry as sg
from shapely import normalize, Polygon , contains

def spolygon(sp1, sp2):

    cont = contains(sp1,sp2)
    return cont


if isinstance(IN[0], list):
    shapely_polygons1 = IN[0]
else:
    shapely_polygons1 = [IN[0]]

if isinstance(IN[1], list):
    shapely_polygons2 = IN[1]
else:
    shapely_polygons2 = [IN[1]]
    

contain = [spolygon(shp1,shp2) for (shp1,shp2) in zip(shapely_polygons1,shapely_polygons2)]

OUT = contain
# ----------------------------------------
OUT = Output(python_script_2)
