# Dynamo custom node ShapelyPointoDynamo.dyf (Dynamo 2.17.0.3472)
# category: Shapely.Conversion

dynpoints = Input(_dynpoints: var[]..[])
code_block = CodeBlock(p=dynpoints) { p.X; p.Y; }
list_create = List.Create(item0=code_block.out0, item1=code_block.out1)
transpose = List.Transpose(lists=list_create)
python_script = Python(IN[0]=transpose)  # CPython3
# ---------- python_script.python (36 lines) ----------
#Copyright(c) 2023, Durmus Bayryam
# Gıthub : https://github.com/DurmusCesur/Shapely.git
import clr
import sys
import re
import System

clr.AddReference('Python.Included')
import Python.Included as pyInc
path_py3_lib = pyInc.Installer.EmbeddedPythonHome
sys.path.append(path_py3_lib + r'\Lib\site-packages')

import shapely.geometry as sg
import Autodesk.DesignScript.Geometry as adg
from shapely import normalize, Polygon , BufferJoinStyle
from shapely.geometry import Polygon, Point


dynamo_point = IN[0]
shapely_poly = []

def spolygon (dynamo_polygons ):
    
    exterior_points = [coord for coord in dynamo_polygons]
    shapely_poly = Point(exterior_points)
    return shapely_poly


if isinstance(IN[0], list):
    dynamo_point = IN[0]
else:
    dynamo_point = [IN[0]]

dynamo_geometries = [spolygon(geometry) for geometry in dynamo_point]

OUT = dynamo_geometries
# ----------------------------------------
shpoints = Output(python_script)  # "_shpoints"
