# Dynamo custom node ShapelytoNumpy.dyf (Dynamo 2.10.1.3976)
# category: Shapely.Conversion

shgeometry = Input(_shgeometry: var[]..[])
python_script = Python(IN[0]=shgeometry)  # CPython3
# ---------- python_script.python (56 lines) ----------
import sys
import os
import clr

localapp = os.getenv(r'LOCALAPPDATA')
sys.path.append(os.path.join(localapp, r'python-3.8.3-embed-amd64\Lib\site-packages'))
import shapely.geometry as sg
import Autodesk.DesignScript.Geometry as adg
from shapely import normalize, Polygon , BufferJoinStyle
from shapely.geometry import Polygon, MultiPolygon ,MultiLineString ,Point
import numpy as np

shapely_poly = []

def shapely_to_dynamo(shapely_geometry):
    dynamo_geometry = None
    if isinstance(shapely_geometry, sg.Point):
        points = shapely_geometry.coords
        dynamo_geometry = points
        
    elif isinstance(shapely_geometry, sg.LineString):
        points = list(shapely_geometry.coords)
        dynamo_geometry = points
        
    elif isinstance(shapely_geometry, sg.Polygon):
        exterior_points = list(shapely_geometry.exterior.coords)
        dynamo_geometry = exterior_points
        
    elif isinstance(shapely_geometry, sg.MultiPoint):
        points = shapely_geometry.coords
        dynamo_geometry = points
        
    return dynamo_geometry

if isinstance(IN[0], list):
    dynamo_point = IN[0]
else:
    dynamo_point = [IN[0]]

dynamo_geometries = [shapely_to_dynamo(geometry) for geometry in dynamo_point]

b = shapely_to_dynamo(dynamo_point)
x_cord = []
y_cord = []

for pon in dynamo_geometries[0]:
	
	x_cord.append(pon[0])
	y_cord.append(pon[1])

point = [Point(x,y) for x,y in zip(x_cord,y_cord)]

arr = np.empty(len(point), dtype="object")
arr[:] = point

OUT = arr[:]
# ----------------------------------------
OUT = Output(python_script)
