# Dynamo custom node DynamotoShapely.dyf (Dynamo 2.18.1.5096)
# category: Shapely.Geometry.Conversion

shpolygon = Input(_shpolygon: var[]..[])
python_script = Python(IN[0]=shpolygon)  # CPython3
# ---------- python_script.python (57 lines) ----------
#Copyright(c) 2023, Durmus Bayryam
# Gıthub : https://github.com/DurmusCesur/Shapely.git
import clr
import sys
import re
import System

clr.AddReference('Python.Included')
import Python.Included as pyInc
path_py3_lib = pyInc.Installer.EmbeddedPythonHome
sys.path.append(path_py3_lib + r'\Lib\site-packages')

import shapely.geometry as sg
import Autodesk.DesignScript.Geometry as adg
from shapely.testing import assert_geometries_equal
from shapely import normalize, Polygon , BufferCapStyle, BufferJoinStyle

def shapely_to_dynamo(shapely_geometry):
    dynamo_geometry = None
    if isinstance(shapely_geometry, sg.Point):
        points = shapely_geometry.coords
        dynamo_geometry = points
        
    elif isinstance(shapely_geometry, sg.LineString):
        points = list(shapely_geometry.coords)
        dynamo_geometry = points
        
    elif isinstance(shapely_geometry, sg.Polygon):
        exterior_points = list(shapely_geometry.exterior.coords)
        dynamo_geometry = exterior_points
        
    elif isinstance(shapely_geometry, sg.MultiPoint):
        points = [point.coords for point in shapely_geometry.geoms]
        dynamo_geometry = [points]
        
    return dynamo_geometry

if isinstance(IN[0], list):
    shapely_geometries = IN[0]
else:
    shapely_geometries = [IN[0]]

dynamo_geometries = [shapely_to_dynamo(geometry) for geometry in shapely_geometries]

x_cord = []
y_cord = []
z_cord = []

for pon in dynamo_geometries[0]:
    x_cord.append(pon[0])
    y_cord.append(pon[1])
    if len(pon) > 2:
        z_cord.append(pon[2])
    else:
        z_cord.append(0)

OUT = x_cord,y_cord,z_cord
# ----------------------------------------
code_block = CodeBlock(x=python_script) { x[0]; x[1]; x[2]; }
byCoordinates = Point.ByCoordinates(x=code_block.out0, y=code_block.out1, z=code_block.out2)
byPoints = Polygon.ByPoints(points=byCoordinates)
Polygon = Output(byPoints)  # "_Polygon"
Point = Output(byCoordinates)  # "_Point"
pruneDuplicates = Point.PruneDuplicates(points=byCoordinates)
boolean = BoolSelector(true)
byPoints_2 = PolyCurve.ByPoints(points=pruneDuplicates, connectLastToFirst=boolean)
PolyCurve = Output(byPoints_2)  # "_PolyCurve"
