# Dynamo custom node ExportCSV.dyf (Dynamo 2.17.0.3472)
# category: Shapely.ML.Traning

data = Input(_data: var[]..[])
colums = Input(_colums: var[]..[])  # Variables must be completely within the "label" column. Ex : [x,y,z,"label"..]
filepath = Input(_filepath: var[]..[])
python_script = Python(IN[0]=data, IN[1]=colums, IN[2]=filepath)  # CPython3
# ---------- python_script.python (21 lines) ----------
#Durmus Bayryam
import clr
import sys
import re
import System

clr.AddReference('Python.Included')
import Python.Included as pyInc
path_py3_lib = pyInc.Installer.EmbeddedPythonHome
sys.path.append(path_py3_lib + r'\Lib\site-packages')

import pandas as pd
import numpy as np


inp = [ i for i in IN[0]]
colm = IN[1]

data = pd.DataFrame(data=np.column_stack(inp), columns=colm)
data.to_csv(IN[2],index = False)
OUT = "Success!"
# ----------------------------------------
OUT = Output(python_script)
