# Dynamo custom node ML_RandomForest.dyf (Dynamo 2.18.1.5096)
# category: Shapely.ML.Model

csv = Input(_csv: var[]..[])
Colums = Input(_Colums: var[]..[])
Testdata = Input(_Testdata: var[]..[])
python_script = Python(IN[0]=csv, IN[1]=Colums, IN[2]=Testdata)  # CPython3
# ---------- python_script.python (43 lines) ----------
#Copyright(c) 2023, Durmus Bayryam
# Gıthub : https://github.com/DurmusCesur/Shapely.git
import clr
import sys
import re
import System

clr.AddReference('Python.Included')
import Python.Included as pyInc
path_py3_lib = pyInc.Installer.EmbeddedPythonHome
sys.path.append(path_py3_lib + r'\Lib\site-packages')

import tensorflow as tf
from tensorflow.python.client import device_lib
from sklearn.ensemble import RandomForestClassifier
import numpy as np
import pandas as pd
from io import StringIO    

# Input
column = IN[1]
data = pd.read_csv(IN[0],usecols=column)
X_train = data.drop(columns=["label"])
y_train = data["label"]
X_test = IN[2]

# Training
model = RandomForestClassifier(n_estimators=100, random_state=42)
model.fit(X_train, y_train)

# Result
y_test = model.predict(X_test)

# Score
sys.stdout = StringIO()
accuracy = round(model.score(X_test, y_test)*100,2)

# Print
print("Model Accuracy: %", accuracy)
sys.stdout.seek(0)
readerstdout =  sys.stdout.read()

OUT = readerstdout, y_test
# ----------------------------------------
code_block = CodeBlock(x=python_script) { x[0]; x[1]; }
Score = Output(code_block.out0)  # "_Score"
Data = Output(code_block.out1)  # "_Data"
