# Dynamo custom node ML_SpectralClustering.dyf (Dynamo 2.18.1.5096)
# category: Shapely.ML.Model

csv = Input(_csv: var[]..[])
Colums = Input(_Colums: var[]..[])
nClusters = Input(_nClusters: var[]..[])
affinity = Input(_affinity: string = "laplacian")  # rbf,laplacian,sigmoid,poly,nearest_neighbors,linear
python_script = Python(IN[0]=csv, IN[1]=Colums, IN[2]=nClusters, IN[3]=affinity)  # CPython3
# ---------- python_script.python (36 lines) ----------
#Copyright(c) 2023, Durmus Bayryam
# Gıthub : https://github.com/DurmusCesur/Shapely.git
import clr
import sys
import re
import System

clr.AddReference('Python.Included')
import Python.Included as pyInc
path_py3_lib = pyInc.Installer.EmbeddedPythonHome
sys.path.append(path_py3_lib + r'\Lib\site-packages')

import numpy as np
import pandas as pd
from io import StringIO  
import tensorflow as tf
from tensorflow.python.client import device_lib
from sklearn.cluster import SpectralClustering

# Input
column = IN[1]
data = pd.read_csv(IN[0],usecols=column)
X_train = data
clusters = IN[2]
affinity = IN[3]


# Modeli eğitme

model = SpectralClustering(n_clusters=clusters, affinity=affinity)
model.fit(X_train)

# Result
y_test = model.fit(X_train).labels_

OUT = y_test
# ----------------------------------------
OUT = Output(python_script)
