# Dynamo custom node ShapelyArea.dyf (Dynamo 2.17.0.3472)
# category: Shapely.Geometry.Analyse

shpolygon = Input(_shpolygon: var[]..[])
python_script = Python(IN[0]=shpolygon)  # CPython3
# ---------- python_script.python (36 lines) ----------
#Copyright(c) 2023, Durmus Bayryam
# Gıthub : https://github.com/DurmusCesur/Shapely.git
import clr
import sys
import re
import System

clr.AddReference('Python.Included')
import Python.Included as pyInc
path_py3_lib = pyInc.Installer.EmbeddedPythonHome
sys.path.append(path_py3_lib + r'\Lib\site-packages')

import shapely.geometry as sg
import Autodesk.DesignScript.Geometry as adg
from shapely import normalize, Polygon , BufferJoinStyle
from shapely.geometry import Polygon, MultiPolygon


dynamo_polygons = IN[0]
shapely_polygons = []

def spolygon (dynamo_polygons ):
    shapely_poly = dynamo_polygons
    area = shapely_poly.area
    
    return area

if isinstance(IN[0], list):
    dynamo_polygons = IN[0]
else:
    dynamo_polygons = [IN[0]]

dynamo_geometries = [spolygon(geometry) for geometry in dynamo_polygons]


OUT = dynamo_geometries
# ----------------------------------------
OUT = Output(python_script)
