# Dynamo custom node ShapelyBoundary.dyf (Dynamo 2.17.0.3472)
# category: Shapely.Geometry.Analyse

shpolygon = Input(_shpolygon: var[]..[])
python_script = Python(IN[0]=shpolygon)  # CPython3
# ---------- python_script.python (26 lines) ----------
#Copyright(c) 2023, Durmus Bayryam
# Gıthub : https://github.com/DurmusCesur/Shapely.git
import clr
import sys
import re
import System

clr.AddReference('Python.Included')
import Python.Included as pyInc
path_py3_lib = pyInc.Installer.EmbeddedPythonHome
sys.path.append(path_py3_lib + r'\Lib\site-packages')

import shapely.geometry as sg
import Autodesk.DesignScript.Geometry as adg
from shapely import normalize, Polygon , BufferJoinStyle

dynamo_geometry1 = IN[0]
    
if isinstance(IN[0], list):
    dynamo_geometry1 = IN[0]
else:
    dynamo_geometry1 = [IN[0]]
    
center = [geo.boundary for geo in dynamo_geometry1]

OUT = center
# ----------------------------------------
OUT = Output(python_script)
