# Dynamo custom node ShapelyBoundingBox.dyf (Dynamo 2.17.0.3472)
# category: Shapely.Geometry.Analyse

shgeometry = Input(_shgeometry: var[]..[])
python_script = Python(IN[0]=shgeometry)  # CPython3
# ---------- python_script.python (29 lines) ----------
#Copyright(c) 2023, Durmus Bayryam
# Gıthub : https://github.com/DurmusCesur/Shapely.git
import clr
import sys
import re
import System

clr.AddReference('Python.Included')
import Python.Included as pyInc
path_py3_lib = pyInc.Installer.EmbeddedPythonHome
sys.path.append(path_py3_lib + r'\Lib\site-packages')

import shapely.geometry as sg
from shapely import normalize, Polygon , oriented_envelope

def spolygon(sp1):

    orien = oriented_envelope(sp1)
    return orien


if isinstance(IN[0], list):
    shapely_polygons1 = IN[0]
else:
    shapely_polygons1 = [IN[0]]

oriented = [spolygon(shp1) for shp1 in shapely_polygons1]

OUT = oriented
# ----------------------------------------
OUT = Output(python_script)
