# Dynamo custom node ShapelyBuffer.dyf (Dynamo 2.17.0.3472)
# category: Shapely.Geometry.Creates

shpolygon = Input(_shpolygon: var[]..[])  # Polygon
offset = Input(_offset: var[]..[])
style = Input(_style: bool = true)
cap = Input(_cap: bool = true)
python_script = Python(IN[0]=shpolygon, IN[1]=offset, IN[2]=style, IN[3]=cap)  # CPython3
# ---------- python_script.python (44 lines) ----------
#Copyright(c) 2023, Durmus Bayryam
# Gıthub : https://github.com/DurmusCesur/Shapely.git
import clr
import sys
import re
import System

clr.AddReference('Python.Included')
import Python.Included as pyInc
path_py3_lib = pyInc.Installer.EmbeddedPythonHome
sys.path.append(path_py3_lib + r'\Lib\site-packages')

import shapely.geometry as sg
import Autodesk.DesignScript.Geometry as adg
from shapely import normalize, Polygon , BufferJoinStyle

shapely_geometry1 = IN[0]
value = IN[1]
joins = IN[2]
capst = IN[3]

js = []
cp = []

##join style
if joins == True:
    js = 2
elif joins == False :
    js = 3
    
##join style
if capst == True:
    cp = 1
elif capst == False :
    cp = 2
else :
    cp = 3


buffer = shapely_geometry1[0].buffer(value,cp,js)



OUT = buffer
# ----------------------------------------
python_script_2 = Python(IN[0]=python_script)  # CPython3
# ---------- python_script_2.python (57 lines) ----------
#Copyright(c) 2023, Durmus Bayryam
# Gıthub : https://github.com/DurmusCesur/Shapely.git
import clr
import sys
import re
import System

clr.AddReference('Python.Included')
import Python.Included as pyInc
path_py3_lib = pyInc.Installer.EmbeddedPythonHome
sys.path.append(path_py3_lib + r'\Lib\site-packages')

import shapely.geometry as sg
import Autodesk.DesignScript.Geometry as adg
from shapely.testing import assert_geometries_equal
from shapely import normalize, Polygon , BufferCapStyle, BufferJoinStyle


import shapely.geometry as sg
import Autodesk.DesignScript.Geometry as adg

def shapely_to_dynamo(shapely_geometry):
    dynamo_geometry = None
    if isinstance(shapely_geometry, sg.Point):
        points = shapely_geometry.coords
        dynamo_geometry = points
        
    elif isinstance(shapely_geometry, sg.LineString):
        points = list(shapely_geometry.coords)
        dynamo_geometry = points
        
    elif isinstance(shapely_geometry, sg.Polygon):
        exterior_points = list(shapely_geometry.exterior.coords)
        dynamo_geometry = exterior_points
        
    elif isinstance(shapely_geometry, sg.MultiPoint):
        points = shapely_geometry.coords
        dynamo_geometry = points
        
    return dynamo_geometry

if isinstance(IN[0], list):
    shapely_geometries = IN[0]
else:
    shapely_geometries = [IN[0]]

dynamo_geometries = [shapely_to_dynamo(geometry) for geometry in shapely_geometries]

x_cord = []
y_cord = []

for pon in dynamo_geometries[0]:
	
	x_cord.append(pon[0])
	y_cord.append(pon[1])

OUT = x_cord,y_cord
# ----------------------------------------
code_block = CodeBlock(x=python_script_2) { x[0]; x[1]; }
byCoordinates = Point.ByCoordinates(x=code_block.out0, y=code_block.out1)
byPoints = Polygon.ByPoints(points=byCoordinates)
Polygon = Output(byPoints)  # "_Polygon"
