# Dynamo custom node ShapelyCentroid.dyf (Dynamo 2.17.0.3472)
# category: Shapely.Geometry.Analyse

shpolygon = Input(_shpolygon: var[]..[])
python_script = Python(IN[0]=shpolygon)  # CPython3
# ---------- python_script.python (29 lines) ----------
#Copyright(c) 2023, Durmus Bayryam
# Gıthub : https://github.com/DurmusCesur/Shapely.git
import clr
import sys
import re
import System

clr.AddReference('Python.Included')
import Python.Included as pyInc
path_py3_lib = pyInc.Installer.EmbeddedPythonHome
sys.path.append(path_py3_lib + r'\Lib\site-packages')

import shapely.geometry as sg
import Autodesk.DesignScript.Geometry as adg
from shapely import normalize, Polygon , BufferJoinStyle, MultiLineString, LinearRing 
from shapely.ops import polylabel


dynamo_geometry1 = IN[0]
shp = []
def sh1(dynamo_polygon):
    
    shapely_poly = [polylabel(dp,tolerance=1) for dp in dynamo_polygon ]
    return shapely_poly
    

sp1 = sh1(dynamo_geometry1)

OUT = sp1
# ----------------------------------------
OUT = Output(python_script)
