# Dynamo custom node ShapelyConcaveHull.dyf "ShapelyGeometrySettings" (Dynamo 2.17.0.3472)
# category: Shapely.Geometry

shgeometry = Input(_shgeometry: var[]..[])
ratio = Input(_ratio: var[]..[])  # 0..1
python_script = Python(IN[0]=shgeometry, IN[1]=ratio)  # CPython3
# ---------- python_script.python (35 lines) ----------
#Copyright(c) 2023, Durmus Bayryam
# Gıthub : https://github.com/DurmusCesur/Shapely.git
import clr
import sys
import re
import System

clr.AddReference('Python.Included')
import Python.Included as pyInc
path_py3_lib = pyInc.Installer.EmbeddedPythonHome
sys.path.append(path_py3_lib + r'\Lib\site-packages')

import shapely.geometry as sg
from shapely import normalize, Polygon , concave_hull ,MultiPoint ,Point , get_type_id

shapely_geo = IN[0]
tolerance = IN[1]

def spolygon(sp1,xm,ym):

    conva = concave_hull(sp1,xm,ym)
    return conva
shp = []

a = get_type_id(shapely_geo)
if a.all() == 0 :

    shapely_polygons1 = spolygon([MultiPoint(shapely_geo)],tolerance,False)
    concave = shapely_polygons1
else:
    concave = [spolygon(shp1,tolerance,False) for shp1 in shapely_geo]



OUT = concave
# ----------------------------------------
OUT = Output(python_script)
