# Dynamo custom node ShapelyContains.dyf (Dynamo 2.17.0.3472)
# category: Shapely.Geometry.Analyse

shpolygon = Input(_shpolygon: var[]..[])
dynpoint = Input(_dynpoint: var[]..[])
code_block = CodeBlock(p=dynpoint) { p.X; p.Y; }
list_create = List.Create(item0=code_block.out0, item1=code_block.out1)
transpose = List.Transpose(lists=list_create)
python_script = Python(IN[0]=transpose)  # CPython3
# ---------- python_script.python (36 lines) ----------
#Copyright(c) 2023, Durmus Bayryam
# Gıthub : https://github.com/DurmusCesur/Shapely.git
import clr
import sys
import re
import System

clr.AddReference('Python.Included')
import Python.Included as pyInc
path_py3_lib = pyInc.Installer.EmbeddedPythonHome
sys.path.append(path_py3_lib + r'\Lib\site-packages')

import shapely.geometry as sg
import Autodesk.DesignScript.Geometry as adg
from shapely import normalize, Polygon , BufferJoinStyle
from shapely.geometry import Polygon, Point


dynamo_point = IN[0]
shapely_poly = []

def spolygon (dynamo_polygons ):
    
    exterior_points = [coord for coord in dynamo_polygons]
    shapely_poly = Point(exterior_points)
    return shapely_poly


if isinstance(IN[0], list):
    dynamo_point = IN[0]
else:
    dynamo_point = [IN[0]]

dynamo_geometries = [spolygon(geometry) for geometry in dynamo_point]

OUT = dynamo_geometries
# ----------------------------------------
python_script_2 = Python(IN[0]=shpolygon, IN[1]=python_script)  # CPython3
# ---------- python_script_2.python (41 lines) ----------
#Copyright(c) 2023, Durmus Bayryam
# Gıthub : https://github.com/DurmusCesur/Shapely.git
import clr
import sys
import re
import System

clr.AddReference('Python.Included')
import Python.Included as pyInc
path_py3_lib = pyInc.Installer.EmbeddedPythonHome
sys.path.append(path_py3_lib + r'\Lib\site-packages')

import shapely.geometry as sg
from shapely import normalize, Polygon , contains

def spolygon(sp1, sp2):

    cont = contains(sp1,sp2)
    return cont


if isinstance(IN[0], list):
    shapely_polygons1 = IN[0]
else:
    shapely_polygons1 = [IN[0]]

if isinstance(IN[1], list):
    shapely_polygons2 = IN[1]
else:
    shapely_polygons2 = [IN[1]]
    

contain = []

for poly in shapely_polygons1:
    poly_contains = []
    for point in shapely_polygons2:
        poly_contains.append(spolygon(poly,point))
    contain = poly_contains

OUT = contain
# ----------------------------------------
code_block_2 = CodeBlock(x=python_script_2) { DSCore.String.FromObject(x)== "False" ? false:true; }
OUT = Output(code_block_2)
