# Dynamo custom node ShapelyEnvelope.dyf (Dynamo 2.17.0.3472)
# category: Shapely.Geometry.Creates

dynpoints = Input(_dynpoints: var[]..[])
code_block = CodeBlock(p=dynpoints) { p.X; p.Y; }
list_create = List.Create(item0=code_block.out0, item1=code_block.out1)
transpose = List.Transpose(lists=list_create)
count = List.Count(list=list_create@L2)
chop = List.Chop(list=transpose, lengths=count)
python_script = Python(IN[0]=chop)  # CPython3
# ---------- python_script.python (34 lines) ----------
#Copyright(c) 2023, Durmus Bayryam
# Gıthub : https://github.com/DurmusCesur/Shapely.git
import clr
import sys
import re
import System

clr.AddReference('Python.Included')
import Python.Included as pyInc
path_py3_lib = pyInc.Installer.EmbeddedPythonHome
sys.path.append(path_py3_lib + r'\Lib\site-packages')
import shapely.geometry as sg
import Autodesk.DesignScript.Geometry as adg
from shapely import normalize, Polygon , BufferJoinStyle, convex_hull ,MultiLineString

shapely_polygons = []

def spolygon (dynamo_polygons ):
    polygon_parts = []
    
    shapely_geometry1 = sg.MultiPoint([coord for coord in dynamo_polygons])
    shapely_poly = shapely_geometry1
    return shapely_poly


if isinstance(IN[0], list):
    dynamo_polygons = IN[0]
else:
    dynamo_polygons = [IN[0]]

dynamo_geometries = [spolygon(geometry) for geometry in dynamo_polygons]

envelope = [dyn.envelope for dyn in dynamo_geometries]
OUT = envelope
# ----------------------------------------
OUT = Output(python_script)
