# Dynamo custom node ShapelyEqualsExact.dyf (Dynamo 2.17.0.3472)
# category: Shapely.Geometry.Analyse

shgeometry1 = Input(_shgeometry1: var[]..[])
shgeometry2 = Input(_shgeometry2: var[]..[])
tolerance = Input(tolerance: var[]..[])
python_script = Python(IN[0]=shgeometry1, IN[1]=shgeometry2, IN[2]=tolerance)  # CPython3
# ---------- python_script.python (35 lines) ----------
#Copyright(c) 2023, Durmus Bayryam
# Gıthub : https://github.com/DurmusCesur/Shapely.git
import clr
import sys
import re
import System

clr.AddReference('Python.Included')
import Python.Included as pyInc
path_py3_lib = pyInc.Installer.EmbeddedPythonHome
sys.path.append(path_py3_lib + r'\Lib\site-packages')

import shapely.geometry as sg
from shapely import normalize, Polygon , equals_exact

def spolygon(sp1, sp2,tlr):

    distane = equals_exact(sp1, sp2,tlr)
    return distane


if isinstance(IN[0], list):
    shapely_polygons1 = IN[0]
else:
    shapely_polygons1 = [IN[0]]

if isinstance(IN[1], list):
    shapely_polygons2 = IN[1]
else:
    shapely_polygons2 = [IN[1]]
    
tolerance = IN[2] 
distance = [spolygon(shp1,shp2,tolerance) for (shp1,shp2) in zip(shapely_polygons1,shapely_polygons2)]

OUT = distance
# ----------------------------------------
OUT = Output(python_script)
