# Dynamo custom node ShapelyExteriorBoundary.dyf (Dynamo 2.17.0.3472)
# category: Shapely.Geometry.Analyse

shpolygon = Input(_shpolygon: var[]..[])
python_script = Python(IN[0]=shpolygon)  # CPython3
# ---------- python_script.python (29 lines) ----------
#Copyright(c) 2023, Durmus Bayryam
# Gıthub : https://github.com/DurmusCesur/Shapely.git
import clr
import sys
import re
import System

clr.AddReference('Python.Included')
import Python.Included as pyInc
path_py3_lib = pyInc.Installer.EmbeddedPythonHome
sys.path.append(path_py3_lib + r'\Lib\site-packages')

import shapely.geometry as sg
from shapely import normalize, Polygon, get_exterior_ring
from shapely.geometry import Polygon, MultiPolygon ,MultiLineString ,Point


shapely_poly = IN[0]

def get_shell (geometry ) :
    
    shell = [get_exterior_ring(geo) for geo in geometry]
    
    return shell

sh = get_shell(shapely_poly)


OUT = sh
# ----------------------------------------
OUT = Output(python_script)
