# Dynamo custom node ShapelyGetPoint.dyf (Dynamo 2.17.0.3472)
# category: Shapely.Geometry.Analyse

shlinestring = Input(_shlinestring: var[]..[])
distance = Input(_distance: var[]..[])
python_script = Python(IN[0]=shlinestring, IN[1]=distance)  # CPython3
# ---------- python_script.python (30 lines) ----------
#Copyright(c) 2023, Durmus Bayryam
# Gıthub : https://github.com/DurmusCesur/Shapely.git
import clr
import sys
import re
import System

clr.AddReference('Python.Included')
import Python.Included as pyInc
path_py3_lib = pyInc.Installer.EmbeddedPythonHome
sys.path.append(path_py3_lib + r'\Lib\site-packages')

import shapely.geometry as sg
from shapely import normalize, Polygon , line_interpolate_point

def spolygon(sp1,dst):

    interpol = line_interpolate_point(sp1,dst)
    return interpol


if isinstance(IN[0], list):
    shapely_polygons1 = IN[0]
else:
    shapely_polygons1 = [IN[0]]

distance = IN[1]
interpolate = [spolygon(shp1,distance) for shp1 in shapely_polygons1]

OUT = interpolate
# ----------------------------------------
OUT = Output(python_script)
