# Dynamo custom node ShapelyLineMerge.dyf (Dynamo 2.17.0.3472)
# category: Shapely.Geometry.Modifiers

shlinestring = Input(_shlinestring: var[]..[])
python_script = Python(IN[0]=shlinestring)  # CPython3
# ---------- python_script.python (30 lines) ----------
#Copyright(c) 2023, Durmus Bayryam
# Gıthub : https://github.com/DurmusCesur/Shapely.git
import clr
import sys
import re
import System

clr.AddReference('Python.Included')
import Python.Included as pyInc
path_py3_lib = pyInc.Installer.EmbeddedPythonHome
sys.path.append(path_py3_lib + r'\Lib\site-packages')

import shapely.geometry as sg
from shapely import normalize, MultiLineString , line_merge , get_parts

def spolygon(sp1):

    interpol = line_merge(MultiLineString([sp for sp in sp1]))
    return interpol


if isinstance(IN[0], list):
    shapely_polygons1 = IN[0]
else:
    shapely_polygons1 = [IN[0]]


interpolate = spolygon(shapely_polygons1).geoms

OUT = interpolate
# ----------------------------------------
OUT = Output(python_script)
