# Dynamo custom node ShapelyMinRotateRectangle.dyf (Dynamo 2.17.0.3472)
# category: Shapely.Geometry.Analyse

dynpoints = Input(_dynpoints: var[]..[])
python_script = Python(IN[0]=dynpoints)  # CPython3
# ---------- python_script.python (36 lines) ----------
#Copyright(c) 2023, Durmus Bayryam
# Gıthub : https://github.com/DurmusCesur/Shapely.git
import clr
import sys
import re
import System

clr.AddReference('Python.Included')
import Python.Included as pyInc
path_py3_lib = pyInc.Installer.EmbeddedPythonHome
sys.path.append(path_py3_lib + r'\Lib\site-packages')

import shapely.geometry as sg
import Autodesk.DesignScript.Geometry as adg
from shapely import normalize, Polygon , BufferJoinStyle, convex_hull

shapely_polygons = []

def spolygon (dynamo_polygons ):
    polygon_parts = []
    
    shapely_geometry1 = sg.Point(dynamo_polygons.X, dynamo_polygons.Y)
    shapely_poly = shapely_geometry1
    return shapely_poly


if isinstance(IN[0], list):
    dynamo_polygons = IN[0]
else:
    dynamo_polygons = [IN[0]]

dynamo_geometries = [spolygon(geometry) for geometry in dynamo_polygons]

shapely_polygons = sg.MultiPoint(dynamo_geometries)

OUT = shapely_polygons.minimum_rotated_rectangle
# ----------------------------------------
OUT = Output(python_script)
