# Dynamo custom node ShapelyNearestPoint.dyf (Dynamo 2.17.0.3472)
# category: Shapely.Geometry.Modifiers

shpolygon = Input(_shpolygon: var[]..[])
shpolygon_2 = Input(_shpolygon: var[]..[])
python_script = Python(IN[0]=shpolygon, IN[1]=shpolygon_2)  # CPython3
# ---------- python_script.python (24 lines) ----------
#Copyright(c) 2023, Durmus Bayryam
# Gıthub : https://github.com/DurmusCesur/Shapely.git
import clr
import sys
import re
import System

clr.AddReference('Python.Included')
import Python.Included as pyInc
path_py3_lib = pyInc.Installer.EmbeddedPythonHome
sys.path.append(path_py3_lib + r'\Lib\site-packages')

import shapely.geometry as sg
import Autodesk.DesignScript.Geometry as adg
from shapely import normalize, Polygon , BufferJoinStyle
from shapely.ops import nearest_points


dynamo_geometry1 = IN[0]
dynamo_geometry2 = IN[1]

minpo = nearest_points(dynamo_geometry1, dynamo_geometry2)

OUT = minpo[0]
# ----------------------------------------
OUT = Output(python_script)
