# Dynamo custom node ShapelyPolgonize.dyf (Dynamo 2.18.1.5096)
# category: Shapely.Geometry.Creates

shpolygon = Input(_shpolygon: var[]..[])
quadratwidth = Input(_quadratwidth: var[]..[])
python_script = Python(IN[0]=shpolygon, IN[1]=quadratwidth)  # CPython3
# ---------- python_script.python (44 lines) ----------
#Copyright(c) 2023, Durmus Bayryam
# Gıthub : https://github.com/DurmusCesur/Shapely.git
import clr
import sys
import re
import System

clr.AddReference('Python.Included')
import Python.Included as pyInc
path_py3_lib = pyInc.Installer.EmbeddedPythonHome
sys.path.append(path_py3_lib + r'\Lib\site-packages')

import shapely.geometry as sg
import Autodesk.DesignScript.Geometry as adg
from shapely.ops import split
from shapely.geometry import GeometryCollection , LineString, MultiLineString
from shapely import Polygon
import numpy as np
import math

dynamo_polygons = IN[0]
min_num = 3
quadrat_width = IN[1]

def spolygon(sp1):
    sp = [] 
    st = []
    tt = [st.append(sh) or sh for sh in sp1]
    pt = sg.MultiPolygon(tt)
    west, south, east, north = pt.bounds
    x_num = math.ceil((east - west) / quadrat_width) + 1
    y_num = math.ceil((north - south) / quadrat_width) + 1
    x_points = np.linspace(west, east, num=max(x_num, min_num))
    y_points = np.linspace(south, north, num=max(y_num, min_num))
    vertical_lines = [LineString([(x, y_points[0]), (x, y_points[-1])]) for x in x_points]
    horizont_lines = [LineString([(x_points[0], y), (x_points[-1], y)]) for y in y_points]
    lines = vertical_lines + horizont_lines
    mull = sg.MultiLineString(lines)
    result = [split(pt,line) for line in lines]
    return result

spt = spolygon(dynamo_polygons) 

OUT = [sp.geoms for sp in spt]
# ----------------------------------------
OUT = Output(python_script)
