# Dynamo custom node ShapelyPruneDuplicated.dyf (Dynamo 2.17.0.3472)
# category: Shapely.Geometry.Modifiers

shgeometry = Input(_shgeometry: var[]..[])
tolerance = Input(_tolerance: var[]..[])
python_script = Python(IN[0]=shgeometry, IN[1]=tolerance)  # CPython3
# ---------- python_script.python (29 lines) ----------
#Copyright(c) 2023, Durmus Bayryam
# Gıthub : https://github.com/DurmusCesur/Shapely.git
import clr
import sys
import re
import System

clr.AddReference('Python.Included')
import Python.Included as pyInc
path_py3_lib = pyInc.Installer.EmbeddedPythonHome
sys.path.append(path_py3_lib + r'\Lib\site-packages')

import shapely.geometry as sg
from shapely import normalize, Polygon , remove_repeated_points

def spolygon(sp1,tlr):

    rmp = remove_repeated_points(sp1,tlr)
    return rmp


if isinstance(IN[0], list):
    shapely_polygons1 = IN[0]
else:
    shapely_polygons1 = [IN[0]]
tolerance = IN[1]
duplicated = [spolygon(shp1,tolerance) for shp1 in shapely_polygons1]

OUT = duplicated
# ----------------------------------------
OUT = Output(python_script)
