# Dynamo custom node ShapelyQuery.dyf (Dynamo 2.18.1.5096)
# category: Shapely.Geometry.Tree

shgeometrylist = Input(_shgeometrylist: var[]..[])
shgeometryquery = Input(_shgeometryquery: var[]..[])
query = Input(_query: var[]..[])  # ‘intersects’, ‘within’, ‘contains’, ‘overlaps’, ‘crosses’,’touches’, ‘covers’, ‘covered_by’, ‘contains_properly’
python_script = Python(IN[0]=shgeometrylist, IN[1]=shgeometryquery, IN[2]=query)  # CPython3
# ---------- python_script.python (32 lines) ----------
#Copyright(c) 2023, Durmus Bayryam
# Gıthub : https://github.com/DurmusCesur/Shapely.git
import clr
import sys
import re
import System

clr.AddReference('Python.Included')
import Python.Included as pyInc
path_py3_lib = pyInc.Installer.EmbeddedPythonHome
sys.path.append(path_py3_lib + r'\Lib\site-packages')

import shapely.geometry as sg
import Autodesk.DesignScript.Geometry as adg
from shapely import Point, Polygon , LineString , STRtree 

def tree (shapelys) :
    tre = STRtree(shapelys)
    return tre

def qury (shapelys, shapely, quer):
    
    return tree(shapelys).query(shapely, predicate=quer).tolist()

shapelys = IN[0]
shapely = IN[1]
predicate = IN[2]

indices = qury(shapelys, shapely, predicate)
geo = tree(shapelys).geometries.take(indices).tolist()

OUT = [geo,indices]
# ----------------------------------------
code_block = CodeBlock(x=python_script) { x[0]; x[1]; }
indices = Output(code_block.out1)  # "_indices"
shgeometry = Output(code_block.out0)  # "_shgeometry"
