# Dynamo custom node ShapelyRotateSkew.dyf (Dynamo 2.17.0.3472)
# category: Shapely.Geometry.Creates

shpolygon = Input(_shpolygon: var[]..[])
xangle = Input(_xangle: int[]..[])
yangle = Input(_yangle: int[]..[])
python_script = Python(IN[0]=shpolygon, IN[1]=xangle, IN[2]=yangle)  # CPython3
# ---------- python_script.python (37 lines) ----------
#Copyright(c) 2023, Durmus Bayryam
# Gıthub : https://github.com/DurmusCesur/Shapely.git
import clr
import sys
import re
import System

clr.AddReference('Python.Included')
import Python.Included as pyInc
path_py3_lib = pyInc.Installer.EmbeddedPythonHome
sys.path.append(path_py3_lib + r'\Lib\site-packages')

import shapely.geometry as sg
import Autodesk.DesignScript.Geometry as adg
from shapely import normalize, Polygon , BufferJoinStyle , affinity
from shapely.geometry import Polygon, MultiPolygon


dynamo_polygons = IN[0]
x = IN[1]
y = IN[2]


def spolygon (dynamo_polygons ):
    shapely_poly = dynamo_polygons
    rotate = affinity.skew(shapely_poly, x, y,'center')

    return rotate

if isinstance(IN[0], list):
    dynamo_polygons = IN[0]
else:
    dynamo_polygons = [IN[0]]

dynamo_geometries = [spolygon(geometry) for geometry in dynamo_polygons]

OUT = dynamo_geometries
# ----------------------------------------
OUT = Output(python_script)
