# Dynamo custom node ShapelyScale.dyf (Dynamo 2.18.1.5096)
# category: Shapely.Geometry.Modifiers

shpolygon = Input(_shpolygon: var[]..[])
xfactory = Input(_xfactory: int[]..[])
yfactory = Input(_yfactory: int[]..[])
python_script = Python(IN[0]=shpolygon, IN[1]=xfactory, IN[2]=yfactory)  # CPython3
# ---------- python_script.python (33 lines) ----------
#Copyright(c) 2023, Durmus Bayryam
# Gıthub : https://github.com/DurmusCesur/Shapely.git
import clr
import sys
import re
import System

clr.AddReference('Python.Included')
import Python.Included as pyInc
path_py3_lib = pyInc.Installer.EmbeddedPythonHome
sys.path.append(path_py3_lib + r'\Lib\site-packages')

import shapely.geometry as sg
import Autodesk.DesignScript.Geometry as adg
from shapely import normalize, Polygon , BufferJoinStyle , affinity
from shapely.geometry import Polygon, MultiPolygon

dynamo_polygons = IN[0]
xfac = IN[1]
yfac = IN[2]

def spolygon(dynamo_polygon,x,y):
    
    shapely_poly = dynamo_polygon
    sp = [] 
    tt = [sp.append(shp) or shp for shp in shapely_poly]
    scale = [affinity.scale(tm, x, y) for tm in tt]
    return list(scale)


dynamo_geometries = spolygon(dynamo_polygons,xfac,yfac)

OUT = dynamo_geometries
# ----------------------------------------
OUT = Output(python_script)
