# Dynamo custom node ShapelySegmentize.dyf (Dynamo 2.17.0.3472)
# category: Shapely.Geometry.Creates

shgeometry = Input(_shgeometry: var[]..[])
segment = Input(_segment: var[]..[])  # 0..~1000
python_script = Python(IN[0]=shgeometry, IN[1]=segment)  # CPython3
# ---------- python_script.python (27 lines) ----------
#Copyright(c) 2023, Durmus Bayryam
# Gıthub : https://github.com/DurmusCesur/Shapely.git
import clr
import sys
import re
import System

clr.AddReference('Python.Included')
import Python.Included as pyInc
path_py3_lib = pyInc.Installer.EmbeddedPythonHome
sys.path.append(path_py3_lib + r'\Lib\site-packages')

import shapely.geometry as sg
from shapely import normalize, Polygon , segmentize 

shapely_geo = IN[0]
tolerance = IN[1]

def spolygon(sp1,xm):

    seg = segmentize(sp1,xm)
    return seg


segmentize = [spolygon(shp1,tolerance) for shp1 in shapely_geo]

OUT = segmentize
# ----------------------------------------
OUT = Output(python_script)
