# Dynamo custom node ShapelySetPrecision.dyf (Dynamo 2.17.0.3472)
# category: Shapely.Geometry.Creates

shpolygon = Input(_shpolygon: var[]..[])
gridsize = Input(_gridsize: var[]..[])  # 0..200
mode = Input(_mode: bool = true)  # True : valid_output False : pointwise
python_script = Python(IN[0]=shpolygon, IN[1]=gridsize, IN[2]=mode)  # CPython3
# ---------- python_script.python (39 lines) ----------
#Copyright(c) 2023, Durmus Bayryam
# Gıthub : https://github.com/DurmusCesur/Shapely.git
import clr
import sys
import re
import System

clr.AddReference('Python.Included')
import Python.Included as pyInc
path_py3_lib = pyInc.Installer.EmbeddedPythonHome
sys.path.append(path_py3_lib + r'\Lib\site-packages')

import shapely.geometry as sg
from shapely import normalize, Polygon, set_precision
from shapely.geometry import Polygon, MultiPolygon ,MultiLineString ,Point


shapely_poly = IN[0]
grids = IN[1]
modes = IN[2]


def precision (geo,gr,mode) :
    
    if modes == True :
        md = "valid_output"
        
    else :
        md = "pointwise"
        
    sy = [g for g in geo]
    
    sg = set_precision(sy,gr,md)
    return sg
    
      
sh = precision(shapely_poly,grids,modes)

OUT = sh
# ----------------------------------------
OUT = Output(python_script)
