# Dynamo custom node ShapelyShortLine.dyf (Dynamo 2.18.1.5096)
# category: Shapely.Geometry.Analyse

shlinestring1 = Input(_shlinestring1: var[]..[])
shlinestring2 = Input(_shlinestring2: var[]..[])
python_script = Python(IN[0]=shlinestring1, IN[1]=shlinestring2)  # CPython3
# ---------- python_script.python (35 lines) ----------
#Copyright(c) 2023, Durmus Bayryam
# Gıthub : https://github.com/DurmusCesur/Shapely.git
import clr
import sys
import re
import System

clr.AddReference('Python.Included')
import Python.Included as pyInc
path_py3_lib = pyInc.Installer.EmbeddedPythonHome
sys.path.append(path_py3_lib + r'\Lib\site-packages')

import shapely.geometry as sg
from shapely import normalize, MultiLineString , shortest_line , get_parts

def spolygon(sp1,sp2):

    sth = shortest_line(sp1,sp2)
    return sth



if isinstance(IN[0], list):
    shapely_polygons1 = IN[0]
else:
    shapely_polygons1 = [IN[0]]

if isinstance(IN[1], list):
    shapely_polygons2 = IN[1]
else:
    shapely_polygons2 = [IN[1]]
    
sh1 = spolygon(shapely_polygons1,shapely_polygons2)
sh2 = spolygon(shapely_polygons2,shapely_polygons1)
OUT = sh1,sh2
# ----------------------------------------
code_block = CodeBlock(x=python_script) { x[0]; x[1]; }
shpoint1 = Output(code_block.out0)  # "_shpoint1"
shpoint2 = Output(code_block.out1)  # "_shpoint2"
