# Dynamo custom node ShapelySimplyGeo.dyf (Dynamo 2.17.0.3472)
# category: Shapely.Geometry.Modifiers

shpolygon = Input(_shpolygon: var[]..[])
tolerance = Input(_tolerance: var[]..[])
python_script = Python(IN[0]=shpolygon, IN[1]=tolerance)  # CPython3
# ---------- python_script.python (27 lines) ----------
#Copyright(c) 2023, Durmus Bayryam
# Gıthub : https://github.com/DurmusCesur/Shapely.git
import clr
import sys
import re
import System

clr.AddReference('Python.Included')
import Python.Included as pyInc
path_py3_lib = pyInc.Installer.EmbeddedPythonHome
sys.path.append(path_py3_lib + r'\Lib\site-packages')

import shapely.geometry as sg
import Autodesk.DesignScript.Geometry as adg
from shapely import normalize, Polygon , BufferJoinStyle ,simplify


def simpleply(shapely_geometry1,tlr):
    sp = [] 
    tt = [sp.append(shp) or shp for shp in shapely_geometry1]
    sm = [simplify(tm,tlr) for tm in tt]
    return list(sm)

tolerance = IN[1]
dynamo_geometry1 = simpleply(IN[0],tolerance)

OUT = dynamo_geometry1
# ----------------------------------------
OUT = Output(python_script)
