# Dynamo custom node ShapelySplit.dyf (Dynamo 2.18.1.5096)
# category: Shapely.Geometry.Modifiers

shpolygon = Input(_shpolygon: var[]..[])
shlinestring = Input(_shlinestring: var[]..[])  # Inputs must be either "LINESTRING"
python_script = Python(IN[0]=shpolygon, IN[1]=shlinestring)  # CPython3
# ---------- python_script.python (33 lines) ----------
#Copyright(c) 2023, Durmus Bayryam
# Gıthub : https://github.com/DurmusCesur/Shapely.git
import clr
import sys
import re
import System

clr.AddReference('Python.Included')
import Python.Included as pyInc
path_py3_lib = pyInc.Installer.EmbeddedPythonHome
sys.path.append(path_py3_lib + r'\Lib\site-packages')

import shapely.geometry as sg
import Autodesk.DesignScript.Geometry as adg
from shapely.ops import split
from shapely.geometry import GeometryCollection
from shapely import Polygon

dynamo_polygons = IN[0]
point = IN[1]
geometry = []

def spolygon(sp1, sp2):
    sp = [] 
    st = []
    tt = [st.append(sh) or sh for sh in sp1]
    tp = [sp.append(shp) or shp for shp in sp2]
    sm = [split(d, p) for d,p in zip (tt,tp)]
    return list(sm)

spt = spolygon(dynamo_polygons,point) 

OUT = [st.geoms for st in spt]
# ----------------------------------------
OUT = Output(python_script)
