# Dynamo custom node ShapelyUnion.dyf (Dynamo 2.17.0.3472)
# category: Shapely.Geometry.Modifiers

listshpolygon = Input(_listshpolygon: var[]..[])  # Polygon Shapely
python_script = Python(IN[0]=listshpolygon)  # CPython3
# ---------- python_script.python (40 lines) ----------
#Copyright(c) 2023, Durmus Bayryam
# Gıthub : https://github.com/DurmusCesur/Shapely.git
import clr
import sys
import re
import System

clr.AddReference('Python.Included')
import Python.Included as pyInc
path_py3_lib = pyInc.Installer.EmbeddedPythonHome
sys.path.append(path_py3_lib + r'\Lib\site-packages')

import shapely.geometry as sg
import Autodesk.DesignScript.Geometry as adg
from shapely import normalize, Polygon , BufferJoinStyle , get_type_id
from shapely.ops import unary_union 


def spolygon(shapely_polygons):

    sp = [] 
    tt = [sp.append(shp) or shp for shp in shapely_polygons]
    return list(tt)

shapely_polygons = spolygon(IN[0])
merged_polygon = unary_union(shapely_polygons)

type = get_type_id(merged_polygon)

if type == [5] :
    
    gm = merged_polygon.geoms
    
elif type == [6] :
    
    gm = merged_polygon.geoms

else :  
    gm = merged_polygon
OUT = gm
# ----------------------------------------
OUT = Output(python_script)
