# Dynamo custom node Shapelyintersection.dyf (Dynamo 2.17.0.3472)
# category: Shapely.Geometry.Modifiers

shgeometry1 = Input(_shgeometry1: var[]..[])
shgeometry2 = Input(_shgeometry2: var[]..[])
python_script = Python(IN[0]=shgeometry1, IN[1]=shgeometry2)  # CPython3
# ---------- python_script.python (35 lines) ----------
#Copyright(c) 2023, Durmus Bayryam
# Gıthub : https://github.com/DurmusCesur/Shapely.git
import clr
import sys
import re
import System

clr.AddReference('Python.Included')
import Python.Included as pyInc
path_py3_lib = pyInc.Installer.EmbeddedPythonHome
sys.path.append(path_py3_lib + r'\Lib\site-packages')

import shapely.geometry as sg
from shapely import normalize, Polygon , intersection

def spolygon(sp1, sp2):

    intersec = intersection(sp1, sp2)
    return intersec


if isinstance(IN[0], list):
    shapely_polygons1 = IN[0]
else:
    shapely_polygons1 = [IN[0]]

if isinstance(IN[1], list):
    shapely_polygons2 = IN[1]
else:
    shapely_polygons2 = [IN[1]]
    

intersection = [spolygon(shp1,shp2) for (shp1,shp2) in zip(shapely_polygons1,shapely_polygons2)]

OUT = intersection
# ----------------------------------------
OUT = Output(python_script)
