# Dynamo custom node ShapelytoDynamo.dyf (Dynamo 2.18.1.5096)
# category: Shapely.Geometry.Conversion

dyngeometry = Input(_dyngeometry: var[]..[])
python_script = Python(IN[0]=dyngeometry)  # IronPython2
# ---------- python_script.python (70 lines) ----------
import clr
clr.AddReference('RevitAPI')
clr.AddReference('RevitAPIUI')
from Autodesk.Revit.DB import *
from Autodesk.Revit.UI import *

clr.AddReference('DSCoreNodes')
import DSCore
from DSCore import *

clr.AddReference('ProtoGeometry')
from Autodesk.DesignScript.Geometry import *

clr.AddReference('RevitNodes')
import Revit
clr.ImportExtensions(Revit.Elements)

clr.AddReference('RevitAPIUI')
from Autodesk.Revit.UI.Selection import ObjectType

clr.AddReference('RevitServices')
import RevitServices
from RevitServices.Persistence import DocumentManager
from RevitServices.Transactions import TransactionManager
import Autodesk.DesignScript.Geometry as adg

doc = DocumentManager.Instance.CurrentDBDocument
uidoc = DocumentManager.Instance.CurrentUIApplication.ActiveUIDocument
app = DocumentManager.Instance.CurrentUIApplication.Application

dynamo_geometry1 = IN[0]
geo = []
y = []
if isinstance(dynamo_geometry1, adg.Point):
    shapely_geometry1 = dynamo_geometry1
    geo.append(shapely_geometry1)
    
elif isinstance(dynamo_geometry1, adg.Line):
    shapely_geometry1 = dynamo_geometry1.StartPoint,dynamo_geometry1.EndPoint
    geo.append(shapely_geometry1)
    
elif isinstance(dynamo_geometry1, adg.Polygon):
    points = adg.Polygon.Corners(dynamo_geometry1)
    shapely_geometry1 = points
    geo.append(shapely_geometry1)

elif isinstance(dynamo_geometry1, adg.PolyCurve):
    points = []
    b = PolyCurve.Curves(dynamo_geometry1)
    
    c = [r.StartPoint for r in b ]+[r.EndPoint for r in b ]
    geo.append(c)
    
if isinstance(dynamo_geometry1, adg.Point):

    t = [p.X for p in geo], [p.Y for p in geo], [p.Z for p in geo]
    a = zip(t[0],t[1],t[2])

else :

    po = [adg.Point.PruneDuplicates(geo[0], 0.001)]
    
    unique_points = []
    for p in po[0]:
        if p not in unique_points:
            unique_points.append(p)
    
    a = [p.X for p in unique_points], [p.Y for p in unique_points],[p.Z for p in unique_points]

OUT = a
# ----------------------------------------
transpose = List.Transpose(lists=python_script)
count = List.Count(list=python_script@L2)
chop = List.Chop(list=transpose, lengths=count)
python_script_2 = Python(IN[0]=chop, IN[1]=dyngeometry)  # CPython3
# ---------- python_script_2.python (50 lines) ----------
#Copyright(c) 2023, Durmus Bayryam
# Gıthub : https://github.com/DurmusCesur/Shapely.git
import clr
import sys
import re
import System

clr.AddReference('Python.Included')
import Python.Included as pyInc
path_py3_lib = pyInc.Installer.EmbeddedPythonHome
sys.path.append(path_py3_lib + r'\Lib\site-packages')

import shapely.geometry as sg
import Autodesk.DesignScript.Geometry as adg
from shapely import normalize, Polygon , BufferJoinStyle
from shapely.geometry import Polygon, MultiPolygon ,MultiLineString


dynamo_point = IN[0]
type = IN[1]

shapely_poly = []
shapely_polygons = []
def spolygon (dynamo_polygons ):
    
    
        
    if isinstance(type, adg.Line):
       shapely_poly = sg.LineString([coord for coord in dynamo_polygons])
       
    elif isinstance(type, adg.Point):
       shapely_poly = sg.Point([coord for coord in dynamo_polygons])

    elif isinstance(type, adg.Polygon):
        exterior_points = [coord for coord in dynamo_polygons]
        shapely_poly = Polygon(exterior_points)
        
    elif isinstance(type, adg.PolyCurve):
       shapely_poly = sg.LineString([coord for coord in dynamo_polygons])
       
    return shapely_poly

if isinstance(IN[0], list):
    dynamo_point = IN[0]
else:
    dynamo_point = [IN[0]]

dynamo_geometries = [spolygon(geometry) for geometry in dynamo_point]

OUT = dynamo_geometries
# ----------------------------------------
shgeometry = Output(python_script_2)  # "_shgeometry"
