# Dynamo custom node Dynamo → Shapely.dyf (Dynamo 3.4.1.7055)
# category: Shapely.Geometry.Conversion
# author: Durmus Bayryam
# Converts Dynamo geometry to Shapely geometry.

DynGeometry = Input(_DynGeometry: var[]..[])
python_script = Python(IN[0]=DynGeometry)  # CPython3
# ---------- python_script.python (298 lines) ----------
# Shapely 2.0.1
# Durmus Bayryam
import sys
import os

# PIP Instal Offlıne #
def load_embedded_packages():
    package_name = "Shapely"
    appdata = os.getenv("APPDATA")
    dynamo_root = os.path.join(appdata, "Dynamo", "Dynamo Revit")

    if not os.path.exists(dynamo_root):
        return False

    found_lib_path = None
    for version_dir in os.listdir(dynamo_root):
        bin_path = os.path.join(
            dynamo_root,
            version_dir,
            "packages",
            package_name,
            "bin"
        )

        shapely_path = os.path.join(bin_path, "shapely_lib")
        numpy_path = os.path.join(bin_path, "numpy_lib")
        geojson_path = os.path.join(bin_path, "geojson_lib")

        if all(os.path.exists(p) for p in [shapely_path, numpy_path, geojson_path]):
            found_lib_path = bin_path

            for p in [numpy_path, shapely_path, geojson_path]:
                if p not in sys.path:
                    sys.path.insert(0, p)

            # DLL 
            dll_path = os.path.join(shapely_path, "shapely.libs")
            if os.path.exists(dll_path):
                try:
                    os.add_dll_directory(dll_path)
                except AttributeError:
                    pass
                    
            return True
    return False


is_loaded = load_embedded_packages()

### -- -- -- -- -- - -- - -- - -- - - -- - - -- - - -- - - -##

import clr
clr.AddReference('ProtoGeometry')
from Autodesk.DesignScript.Geometry import *

try:
    import shapely
    from shapely.geometry import Point as ShpPoint
    from shapely.geometry import LineString as ShpLineString
    from shapely.geometry import Polygon as ShpPolygon , LinearRing
except ImportError:
    
    print("\n Please install Shapely package!")
    pass

def dynamo_point_to_shapely(dynamo_point):
    
    if isinstance(dynamo_point, Point):
        return ShpPoint(dynamo_point.X, dynamo_point.Y, dynamo_point.Z)
    return None

def dynamo_polygon_to_shapely(dynamo_polygon):
    
    if not isinstance(dynamo_polygon, Polygon):
        return None
    pts = dynamo_polygon.Points
    if not pts or len(pts) < 3:
        return None
    coords = [(p.X, p.Y, p.Z) for p in pts]
    if coords[0] != coords[-1]:
        coords.append(coords[0])
    return ShpPolygon(coords)

def dynamo_curve_to_shapely(dynamo_curve):
    
    if isinstance(dynamo_curve, Line):
        start = dynamo_curve.StartPoint
        end = dynamo_curve.EndPoint
        coords = [(start.X, start.Y, start.Z), (end.X, end.Y, end.Z)]
        
        return ShpLineString(coords)
        
    elif isinstance(dynamo_curve, Arc):
        
        num_segments = 1000 
        points = []
        for i in range(num_segments + 1):
            param = float(i) / num_segments
            pt = dynamo_curve.PointAtParameter(param)
            points.append((pt.X, pt.Y, pt.Z))
        return ShpLineString(points)
    return None

def dynamo_surface_to_shapely_with_holes(dynamo_surface):
    
    if dynamo_surface is None: return None
    
    if not isinstance(dynamo_surface, Surface): return None
    try:
        perimeter_curves = dynamo_surface.PerimeterCurves()
        if not perimeter_curves: return None
        
        TOLERANCE = 1e-3 
        def get_pt(curve, is_start=True):
            p = curve.StartPoint if is_start else curve.EndPoint
            return (p.X, p.Y, p.Z)
        def dist_sq(p1, p2):
            return (p1[0]-p2[0])**2 + (p1[1]-p2[1])**2 + (p1[2]-p2[2])**2
        curves_pool = list(perimeter_curves)
        loops = [] 
        
        while curves_pool:
            current_loop_pts = []
            
            first_crv = curves_pool.pop(0)
            
            p_start = get_pt(first_crv, True)
            p_end = get_pt(first_crv, False)
            
            current_loop_pts.append(p_start)
            current_tail = p_end 
            
            loop_closed = False
            
            while not loop_closed:
                best_idx = -1
                best_dist = TOLERANCE * TOLERANCE # Tolerans karesi
                connect_reverse = False 
                
                for i, crv in enumerate(curves_pool):
                    s_pt = get_pt(crv, True)
                    e_pt = get_pt(crv, False)
                    
                    d_s = dist_sq(current_tail, s_pt)
                    if d_s < best_dist:
                        best_dist = d_s
                        best_idx = i
                        connect_reverse = False
                    
                    d_e = dist_sq(current_tail, e_pt)
                    if d_e < best_dist:
                        best_dist = d_e
                        best_idx = i
                        connect_reverse = True
                
                if best_idx != -1:
                    next_crv = curves_pool.pop(best_idx)
                    
                    if connect_reverse:
                        current_loop_pts.append(get_pt(next_crv, False))
                        current_tail = get_pt(next_crv, True)
                    else:
                        current_loop_pts.append(get_pt(next_crv, True))
                        current_tail = get_pt(next_crv, False)
                else:
                    if len(current_loop_pts) > 2:
                        d_close = dist_sq(current_tail, current_loop_pts[0])
                        current_loop_pts.append(current_tail)
                            
                    loops.append(current_loop_pts)
                    loop_closed = True
        
        if not loops: return None
        candidate_polygons = []
        
        for loop_pts in loops:
            if loop_pts[0] != loop_pts[-1]:
                loop_pts.append(loop_pts[0])
                
            if len(loop_pts) >= 4:
                try:
                    poly = ShpPolygon(loop_pts)
                    
                    xy_area = poly.area 
                    
                    minx, miny, maxx, maxy = poly.bounds
                    coords = list(poly.exterior.coords)
                    zs = [c[2] for c in coords]
                    dz = max(zs) - min(zs)
                    dx = maxx - minx
                    dy = maxy - miny
                    approx_3d_dim = dx + dy + dz
                    
                    is_vertical_or_degenerate = (xy_area < 1e-5) and (approx_3d_dim > 0.1)
                    if not is_vertical_or_degenerate:
                        if not poly.is_valid:
                             try:
                                 fixed_poly = poly.buffer(0)
                                 if not fixed_poly.is_empty:
                                     poly = fixed_poly
                             except:
                                 pass 
                    
                    candidate_polygons.append(poly)
                except:
                    pass
        
        if not candidate_polygons: return None
        
        def approximate_3d_size(poly):
            coords = list(poly.exterior.coords)
            xs = [c[0] for c in coords]
            ys = [c[1] for c in coords]
            zs = [c[2] for c in coords]
            return (max(xs)-min(xs)) + (max(ys)-min(ys)) + (max(zs)-min(zs))
        
        candidate_polygons.sort(key=approximate_3d_size, reverse=True)
        
        outer_poly = candidate_polygons[0]
        inner_polys = candidate_polygons[1:] 
        
        outer_coords = list(outer_poly.exterior.coords)
        inner_rings_coords = [list(p.exterior.coords) for p in inner_polys]
        
        if inner_rings_coords:
            return ShpPolygon(outer_coords, inner_rings_coords)
        else:
            return ShpPolygon(outer_coords)
    except Exception:
        return None


def dynamo_polycurve_to_shapely(dynamo_polycurve):
    
    if not isinstance(dynamo_polycurve, PolyCurve):
        return None
    
    try:
        curves = dynamo_polycurve.Curves()
    except:
        try:
            curves = dynamo_polycurve.Curves
        except:
            return None
    
    if not curves:
        return None
    
    coords = []
    
    for curve in curves:
        try:
            sp = curve.StartPoint
            coords.append((sp.X, sp.Y, sp.Z))
        except:
            continue
    
    if curves:
        try:
            ep = curves[-1].EndPoint
            coords.append((ep.X, ep.Y, ep.Z))
        except:
            pass
    
    if len(coords) < 2:
        return None
    
    return ShpLineString(coords)

def convert_dynamo_to_shapely(dynamo_geometry):
    
    if isinstance(dynamo_geometry, list):
        return [convert_dynamo_to_shapely(item) for item in dynamo_geometry]

    if isinstance(dynamo_geometry, Point):
        return dynamo_point_to_shapely(dynamo_geometry)

    elif isinstance(dynamo_geometry, Surface):
        return dynamo_surface_to_shapely_with_holes(dynamo_geometry)

    elif isinstance(dynamo_geometry, Polygon):
        return dynamo_polygon_to_shapely(dynamo_geometry)

    elif isinstance(dynamo_geometry, PolyCurve):
        return dynamo_polycurve_to_shapely(dynamo_geometry)

    elif isinstance(dynamo_geometry, Line):
        return dynamo_curve_to_shapely(dynamo_geometry)

    else:
        return None 

if 'IN' in locals():
    dynamo_input = IN[0] 

    shapely_output = convert_dynamo_to_shapely(dynamo_input)

    OUT = shapely_output
# ----------------------------------------
ShpGeometry = Output(python_script)  # "_ShpGeometry"
python_script_2 = Python()  # CPython3; frozen; unwired: IN[0]
# ---------- python_script_2.python (212 lines) ----------
# Shapely 2.0.1
# Durmus Bayryam
import sys
import os

# PIP Instal Offlıne #
def load_embedded_packages():
    package_name = "Shapely"
    appdata = os.getenv("APPDATA")
    dynamo_root = os.path.join(appdata, "Dynamo", "Dynamo Revit")

    if not os.path.exists(dynamo_root):
        return False

    found_lib_path = None
    for version_dir in os.listdir(dynamo_root):
        bin_path = os.path.join(
            dynamo_root,
            version_dir,
            "packages",
            package_name,
            "bin"
        )

        shapely_path = os.path.join(bin_path, "shapely_lib")
        numpy_path = os.path.join(bin_path, "numpy_lib")
        geojson_path = os.path.join(bin_path, "geojson_lib")

        if all(os.path.exists(p) for p in [shapely_path, numpy_path, geojson_path]):
            found_lib_path = bin_path

            for p in [numpy_path, shapely_path, geojson_path]:
                if p not in sys.path:
                    sys.path.insert(0, p)

            # DLL 
            dll_path = os.path.join(shapely_path, "shapely.libs")
            if os.path.exists(dll_path):
                try:
                    os.add_dll_directory(dll_path)
                except AttributeError:
                    pass
                    
            return True
    return False


is_loaded = load_embedded_packages()

### -- -- -- -- -- - -- - -- - -- - - -- - - -- - - -- - - -##

import clr
clr.AddReference('ProtoGeometry')
from Autodesk.DesignScript.Geometry import *

try:
    import shapely
    from shapely.geometry import Point as ShpPoint
    from shapely.geometry import LineString as ShpLineString
    from shapely.geometry import Polygon as ShpPolygon , LinearRing
except ImportError:
    
    print("\n Please install Shapely package!")
    pass

def dynamo_point_to_shapely(dynamo_point):
    
    if isinstance(dynamo_point, Point):
        return ShpPoint(dynamo_point.X, dynamo_point.Y, dynamo_point.Z)
    return None

def dynamo_polygon_to_shapely(dynamo_polygon):
    
    if not isinstance(dynamo_polygon, Polygon):
        return None
    pts = dynamo_polygon.Points
    if not pts or len(pts) < 3:
        return None
    coords = [(p.X, p.Y, p.Z) for p in pts]
    if coords[0] != coords[-1]:
        coords.append(coords[0])
    return ShpPolygon(coords)

def dynamo_curve_to_shapely(dynamo_curve):
    
    if isinstance(dynamo_curve, Line):
        start = dynamo_curve.StartPoint
        end = dynamo_curve.EndPoint
        coords = [(start.X, start.Y, start.Z), (end.X, end.Y, end.Z)]
        
        return ShpLineString(coords)
        
    elif isinstance(dynamo_curve, Arc):
        
        num_segments = 1000 
        points = []
        for i in range(num_segments + 1):
            param = float(i) / num_segments
            pt = dynamo_curve.PointAtParameter(param)
            points.append((pt.X, pt.Y, pt.Z))
        return ShpLineString(points)
    return None

def dynamo_surface_to_shapely_with_holes(dynamo_surface):
    
    if not isinstance(dynamo_surface, Surface):
        return None
    
    outer_coords = []
    inner_rings = []
    
    try:
        perimeter_curves = dynamo_surface.PerimeterCurves()
        
        for curve in perimeter_curves:
            start_point = curve.StartPoint
            outer_coords.append((start_point.X, start_point.Y, start_point.Z))
        
        if perimeter_curves:
            last_end = perimeter_curves[-1].EndPoint
            if outer_coords and outer_coords[0] != (last_end.X, last_end.Y, last_end.Z):
                outer_coords.append((last_end.X, last_end.Y, last_end.Z))
        
        if outer_coords and outer_coords[0] != outer_coords[-1]:
            outer_coords.append(outer_coords[0])
            
    except Exception as e:
        return None
        
    try:
        if hasattr(dynamo_surface, 'Faces'):
            pass
    except:
        pass
        
    if len(outer_coords) < 4:
        return None
        
    try:
        if inner_rings:
            return ShpPolygon(outer_coords, inner_rings)
        else:
            return ShpPolygon(outer_coords)
    except Exception as e:
        return None

def dynamo_polycurve_to_shapely(dynamo_polycurve):
    
    if not isinstance(dynamo_polycurve, PolyCurve):
        return None
    
    try:
        curves = dynamo_polycurve.Curves()
    except:
        try:
            curves = dynamo_polycurve.Curves
        except:
            return None
    
    if not curves:
        return None
    
    coords = []
    
    for curve in curves:
        try:
            sp = curve.StartPoint
            coords.append((sp.X, sp.Y, sp.Z))
        except:
            continue
    
    if curves:
        try:
            ep = curves[-1].EndPoint
            coords.append((ep.X, ep.Y, ep.Z))
        except:
            pass
    
    if len(coords) < 2:
        return None
    
    return ShpLineString(coords)

def convert_dynamo_to_shapely(dynamo_geometry):
    
    if isinstance(dynamo_geometry, list):
        return [convert_dynamo_to_shapely(item) for item in dynamo_geometry]

    if isinstance(dynamo_geometry, Point):
        return dynamo_point_to_shapely(dynamo_geometry)

    elif isinstance(dynamo_geometry, Surface):
        return dynamo_surface_to_shapely_with_holes(dynamo_geometry)

    elif isinstance(dynamo_geometry, Polygon):
        return dynamo_polygon_to_shapely(dynamo_geometry)

    elif isinstance(dynamo_geometry, PolyCurve):
        return dynamo_polycurve_to_shapely(dynamo_geometry)

    elif isinstance(dynamo_geometry, Line):
        return dynamo_curve_to_shapely(dynamo_geometry)

    else:
        return None 

if 'IN' in locals():
    dynamo_input = IN[0] 

    shapely_output = convert_dynamo_to_shapely(dynamo_input)

    OUT = shapely_output
# ----------------------------------------
