# Dynamo custom node GeoJSON → Shapely.dyf (Dynamo 3.4.1.7055)
# category: Shapely.Geometry.Conversion
# author: Durmus Bayryam
# Converts GeoJSON standard data to Shapely geometry.

FilePath = Input(_FilePath: var[]..[])
file_from_path = FileObject(path=FilePath)
readText = FileSystem.ReadText(file=file_from_path)
python_script = Python(IN[0]=readText)  # CPython3
# ---------- python_script.python (137 lines) ----------
# Shapely 2.0.1
# Durmus Bayram
import sys
import os

# PIP Instal Offlıne #
def load_embedded_packages():
    package_name = "Shapely"
    appdata = os.getenv("APPDATA")
    dynamo_root = os.path.join(appdata, "Dynamo", "Dynamo Revit")

    if not os.path.exists(dynamo_root):
        return False

    found_lib_path = None
    for version_dir in os.listdir(dynamo_root):
        bin_path = os.path.join(
            dynamo_root,
            version_dir,
            "packages",
            package_name,
            "bin"
        )

        shapely_path = os.path.join(bin_path, "shapely_lib")
        numpy_path = os.path.join(bin_path, "numpy_lib")
        geojson_path = os.path.join(bin_path, "geojson_lib")

        if all(os.path.exists(p) for p in [shapely_path, numpy_path, geojson_path]):
            found_lib_path = bin_path

            for p in [numpy_path, shapely_path, geojson_path]:
                if p not in sys.path:
                    sys.path.insert(0, p)

            # DLL 
            dll_path = os.path.join(shapely_path, "shapely.libs")
            if os.path.exists(dll_path):
                try:
                    os.add_dll_directory(dll_path)
                except AttributeError:
                    pass
                    
            return True
    return False


is_loaded = load_embedded_packages()

### -- -- -- -- -- - -- - -- - -- - - -- - - -- - - -- - - -##


import clr
import json
import math

try:
    import shapely
    from shapely import from_geojson
    from shapely.ops import transform
except ImportError:
    print("\n Please install Shapely package!")
    pass

def latlon_to_meters(lon, lat):
    lat = max(min(lat, 89.9), -89.9)
    x = lon * 20037508.34 / 180
    y = math.log(math.tan((90 + lat) * math.pi / 360)) / (math.pi / 180)
    y = y * 20037508.34 / 180
    return x, y

def ensure_closed_rings(geom_dict):
    g_type = geom_dict.get("type")
    coords = geom_dict.get("coordinates")
    
    if g_type == "Polygon":
        for ring in coords:
            if ring and ring[0] != ring[-1]:
                ring.append(ring[0])
    elif g_type == "MultiPolygon":
        for polygon in coords:
            for ring in polygon:
                if ring and ring[0] != ring[-1]:
                    ring.append(ring[0])
    return geom_dict

def project_geometry(geom):
    if geom is None: return None
    try:
        return transform(lambda x, y, z=None: latlon_to_meters(x, y), geom)
    except:
        return geom

def process_geojson_metric(data, apply_projection=True):
    if isinstance(data, str):
        try:
            data = json.loads(data)
        except:
            return [], []

    geoms = []
    props = []

    if isinstance(data, dict) and data.get("type") == "FeatureCollection":
        for feature in data.get("features", []):
            g_dict = feature.get("geometry")
            p_dict = feature.get("properties", {})
            
            if g_dict:
                g_dict = ensure_closed_rings(g_dict)
                
                try:
                    geom_str = json.dumps(g_dict)
                    geom = from_geojson(geom_str)
                    
                    if apply_projection:
                        geom = project_geometry(geom)
                    
                    geoms.append(geom)
                    props.append(p_dict)
                except Exception as e:
                    #print("Geometri okuma hatası: {}".format(e))
                    continue
                    
        return geoms, props
    return [], []

if 'IN' in locals():
    geojson_input = IN[0]
    should_project = True 
    
    if geojson_input:
        geometries, properties = process_geojson_metric(geojson_input, should_project)
    else:
        geometries, properties = [], []

    OUT = [geometries, properties]
# ----------------------------------------
code_block = CodeBlock(x=python_script) { x[0]; x[1]; }
ShpGeometry = Output(code_block.out0)  # "_ShpGeometry"
Dictionary = Output(code_block.out1)  # "_Dictionary"
