# Dynamo custom node Numpy → Shapely.dyf (Dynamo 3.4.1.7055)
# category: Shapely.Geometry.Conversion
# author: Durmus Bayryam
# Converts Numpy standards to Shapely geometry.

Numpy = Input(_Numpy: var[]..[])
python_script = Python(IN[0]=Numpy)  # CPython3
# ---------- python_script.python (255 lines) ----------
# Shapely 2.0.1
# Durmus Bayryam
import numpy as np

try:
    from shapely.geometry import Point as ShpPoint
    from shapely.geometry import LineString as ShpLineString
    from shapely.geometry import Polygon as ShpPolygon
    from shapely.geometry import LinearRing as ShpLinearRing
    from shapely.geometry import MultiPoint as ShpMultiPoint
    from shapely.geometry import MultiLineString as ShpMultiLineString
    from shapely.geometry import MultiPolygon as ShpMultiPolygon
except ImportError:
    print("\n Please install Shapely package!")
    pass

TOLERANCE = 1e-6

def coords_equal(coord1, coord2, tolerance=TOLERANCE):
    
    if len(coord1) != len(coord2):
        return False
    for a, b in zip(coord1, coord2):
        if abs(a - b) > tolerance:
            return False
    return True

def is_closed_coords(coords, tolerance=TOLERANCE):
    
    if len(coords) < 3:
        return False
    return coords_equal(coords[0], coords[-1], tolerance)

def is_coordinate(data):
    
    if isinstance(data, list):
        if len(data) in [2, 3]:
            return all(isinstance(x, (int, float)) for x in data)
    return False

def is_coordinate_list(data):
    
    if isinstance(data, list) and len(data) > 0:
        return all(is_coordinate(item) for item in data)
    return False

def list_point_to_shapely(list_point):
    
    if not is_coordinate(list_point):
        return None
    
    if len(list_point) == 2:
        return ShpPoint(list_point[0], list_point[1])
    elif len(list_point) >= 3:
        return ShpPoint(list_point[0], list_point[1], list_point[2])
    
    return None

def list_to_shapely_linestring(list_coords):
    
    if not is_coordinate_list(list_coords):
        return None
    
    if len(list_coords) < 2:
        return None
    
    coords = [tuple(coord) for coord in list_coords]
    
    return ShpLineString(coords)

def list_to_shapely_linearring(list_coords):
    
    if not is_coordinate_list(list_coords):
        return None
    
    if len(list_coords) < 3:
        return None
    
    coords = [tuple(coord) for coord in list_coords]
    
    if not is_closed_coords(coords):
        coords.append(coords[0])
    
    return ShpLinearRing(coords)

def list_to_shapely_polygon(list_data):
    
    if isinstance(list_data, dict):
        if 'exterior' not in list_data:
            return None
        
        exterior = list_data['exterior']
        if not is_coordinate_list(exterior):
            return None
        
        exterior_coords = [tuple(coord) for coord in exterior]
        
        if not is_closed_coords(exterior_coords):
            exterior_coords.append(exterior_coords[0])
        
        interior_coords_list = []
        if 'interiors' in list_data and list_data['interiors']:
            for interior in list_data['interiors']:
                if is_coordinate_list(interior):
                    int_coords = [tuple(coord) for coord in interior]
                    if not is_closed_coords(int_coords):
                        int_coords.append(int_coords[0])
                    interior_coords_list.append(int_coords)
        
        if interior_coords_list:
            return ShpPolygon(exterior_coords, interior_coords_list)
        else:
            return ShpPolygon(exterior_coords)
    
    if is_coordinate_list(list_data):
        if len(list_data) < 3:
            return None
        
        coords = [tuple(coord) for coord in list_data]
        
        if not is_closed_coords(coords):
            coords.append(coords[0])
        
        return ShpPolygon(coords)
    
    return None

def list_to_shapely_multipoint(list_coords):
    
    if not is_coordinate_list(list_coords):
        return None
    
    if len(list_coords) < 1:
        return None
    
    points = [ShpPoint(tuple(coord)) for coord in list_coords]
    
    return ShpMultiPoint(points)

def list_to_shapely_multilinestring(list_of_lists):
    
    if not isinstance(list_of_lists, list):
        return None
    
    if len(list_of_lists) < 1:
        return None
    
    linestrings = []
    for list_coords in list_of_lists:
        if is_coordinate_list(list_coords) and len(list_coords) >= 2:
            coords = [tuple(coord) for coord in list_coords]
            linestrings.append(ShpLineString(coords))
    
    if not linestrings:
        return None
    
    return ShpMultiLineString(linestrings)

def list_to_shapely_multipolygon(list_of_lists):
    
    if not isinstance(list_of_lists, list):
        return None
    
    if len(list_of_lists) < 1:
        return None
    
    polygons = []
    for list_data in list_of_lists:
        poly = list_to_shapely_polygon(list_data)
        if poly is not None:
            polygons.append(poly)
    
    if not polygons:
        return None
    
    return ShpMultiPolygon(polygons)

def detect_geometry_type(list_data):
    if isinstance(list_data, dict):
        return 'polygon'
    
    if is_coordinate(list_data):
        return 'point'
    
    if is_coordinate_list(list_data):
        num_points = len(list_data)
        
        if num_points < 2:
            return None
        
        if num_points == 2:
            return 'linestring'
        
        if is_closed_coords(list_data):
            return 'polygon'
        else:
            return 'multipoint'
    
    if isinstance(list_data, list) and len(list_data) > 0:
        if all(is_coordinate_list(item) for item in list_data):
            all_closed = all(is_closed_coords(item) for item in list_data)
            if all_closed:
                return 'multipolygon'
            else:
                return 'multilinestring'
        
        if all(isinstance(item, dict) for item in list_data):
            return 'multipolygon'
    
    return None

def convert_list_to_shapely(list_data, geometry_type='auto'):
    
    if geometry_type == 'point':
        return list_point_to_shapely(list_data)
    
    elif geometry_type == 'linestring':
        return list_to_shapely_linestring(list_data)
    
    elif geometry_type == 'linearring':
        return list_to_shapely_linearring(list_data)
    
    elif geometry_type == 'polygon':
        return list_to_shapely_polygon(list_data)
    
    elif geometry_type == 'multipoint':
        return list_to_shapely_multipoint(list_data)
    
    elif geometry_type == 'multilinestring':
        return list_to_shapely_multilinestring(list_data)
    
    elif geometry_type == 'multipolygon':
        return list_to_shapely_multipolygon(list_data)
    
    # Auto mode
    elif geometry_type == 'auto':
        detected_type = detect_geometry_type(list_data)
        
        if detected_type:
            return convert_list_to_shapely(list_data, detected_type)
        
        if isinstance(list_data, list) and len(list_data) > 0:
            if not is_coordinate(list_data) and not is_coordinate_list(list_data):
                return [convert_list_to_shapely(item, 'auto') for item in list_data]
    
    return None

# Dynamo Node
if 'IN' in locals():
    list_input = IN[0]
    geo_type = IN[1] if len(IN) > 1 else 'auto'
    
    shapely_output = convert_list_to_shapely(list_input, geo_type)
    
    OUT = shapely_output
# ----------------------------------------
ShpGeometry = Output(python_script)  # "_ShpGeometry"
