# Dynamo custom node Shapely → Dynamo.dyf (Dynamo 3.4.1.7055)
# category: Shapely.Geometry.Conversion
# author: Durmus Bayryam
# Converts Shapely geometry to Dynamo geometry.

ShpGeometry = Input(_ShpGeometry: var[]..[])
python_script = Python(IN[0]=ShpGeometry)  # CPython3
# ---------- python_script.python (214 lines) ----------
# Shapely 2.0.1
# Durmus Bayram
import sys
import clr

clr.AddReference('ProtoGeometry')
from Autodesk.DesignScript.Geometry import *

try:
    from shapely.geometry import Point as ShpPoint
    from shapely.geometry import LineString as ShpLineString
    from shapely.geometry import Polygon as ShpPolygon
    from shapely.geometry import LinearRing as ShpLinearRing
    from shapely.geometry import MultiPoint as ShpMultiPoint
    from shapely.geometry import MultiLineString as ShpMultiLineString
    from shapely.geometry import MultiPolygon as ShpMultiPolygon
    from shapely.geometry import GeometryCollection as ShpGeometryCollection 
    from shapely.geometry.base import BaseGeometry
except ImportError:
    pass

def cleanup_points(coords, is_closed=False, tolerance=0.0001):
    if not coords or len(coords) < 1:
        return []
    
    cleaned = [coords[0]]
    for i in range(1, len(coords)):
        p1 = coords[i-1]
        p2 = coords[i]
        
        dist = sum((a - b)**2 for a, b in zip(p1, p2))**0.5
        
        if dist > tolerance:
            cleaned.append(p2)
            
    if is_closed and len(cleaned) > 1:
        p_first = cleaned[0]
        p_last = cleaned[-1]
        dist_end = sum((a - b)**2 for a, b in zip(p_first, p_last))**0.5
        if dist_end <= tolerance:
            cleaned.pop()
            
    return cleaned

def shapely_point_to_dynamo(shp_point, default_z=0):
    if not isinstance(shp_point, ShpPoint):
        return None
    coords = shp_point.coords[0]
    x, y = coords[0], coords[1]
    z = coords[2] if len(coords) > 2 else default_z
    return Point.ByCoordinates(x, y, z)

def shapely_linestring_to_dynamo(shp_linestring, default_z=0):
    if not isinstance(shp_linestring, ShpLineString):
        return None
    
    coords = cleanup_points(list(shp_linestring.coords), is_closed=False)
    
    if len(coords) < 2: 
        return None 
    
    points = []
    for coord in coords:
        x, y = coord[0], coord[1]
        z = coord[2] if len(coord) > 2 else default_z
        points.append(Point.ByCoordinates(x, y, z))
    
    try:
        if len(points) == 2:
            return Line.ByStartPointEndPoint(points[0], points[1])
        else:
            return PolyCurve.ByPoints(points)
    except:
        return None

def shapely_linearring_to_dynamo(shp_ring, default_z=0):
    if not isinstance(shp_ring, ShpLinearRing):
        return None
    
    coords = cleanup_points(list(shp_ring.coords), is_closed=True)
    
    if len(coords) < 3: 
        return None
    
    points = []
    for coord in coords:
        x, y = coord[0], coord[1]
        z = coord[2] if len(coord) > 2 else default_z
        points.append(Point.ByCoordinates(x, y, z))
    
    try:
        return PolyCurve.ByPoints(points, True)
    except:
        return None

def shapely_polygon_to_dynamo_polygon(shp_polygon, default_z=0):
    if not isinstance(shp_polygon, ShpPolygon):
        return None
    
    exterior_coords = cleanup_points(list(shp_polygon.exterior.coords), is_closed=True)
    
    if len(exterior_coords) < 3:
        return None
    
    points = [Point.ByCoordinates(c[0], c[1], c[2] if len(c)>2 else default_z) for c in exterior_coords]
    try:
        return Polygon.ByPoints(points)
    except:
        return None

def shapely_polygon_to_dynamo_surface(shp_polygon, default_z=0):
    if not isinstance(shp_polygon, ShpPolygon):
        return None
    
    ext_coords = cleanup_points(list(shp_polygon.exterior.coords), is_closed=True)
    if len(ext_coords) < 3: return None
    
    outer_points = [Point.ByCoordinates(c[0], c[1], c[2] if len(c)>2 else default_z) for c in ext_coords]
    
    try:
        outer_curve = PolyCurve.ByPoints(outer_points, True)
        
        if len(shp_polygon.interiors) == 0:
            return Surface.ByPatch(outer_curve)
        
        inner_curves = []
        for interior in shp_polygon.interiors:
            int_coords = cleanup_points(list(interior.coords), is_closed=True)
            if len(int_coords) >= 3:
                pts = [Point.ByCoordinates(c[0], c[1], c[2] if len(c)>2 else default_z) for c in int_coords]
                try:
                    inner_curves.append(PolyCurve.ByPoints(pts, True))
                except:
                    pass
        
        main_surface = Surface.ByPatch(outer_curve)
        for hole_curve in inner_curves:
            try:
                hole_surface = Surface.ByPatch(hole_curve)
                main_surface = main_surface.Difference(hole_surface)
            except:
                pass
        return main_surface
    
    except:
        return None

def shapely_multipoint_to_dynamo(shp_multipoint, default_z=0):
    if not isinstance(shp_multipoint, ShpMultiPoint):
        return None
    return [shapely_point_to_dynamo(pt, default_z) for pt in shp_multipoint.geoms]

def shapely_multilinestring_to_dynamo(shp_multilinestring, default_z=0):
    if not isinstance(shp_multilinestring, ShpMultiLineString):
        return None
    return [shapely_linestring_to_dynamo(ls, default_z) for ls in shp_multilinestring.geoms]

def shapely_multipolygon_to_dynamo(shp_multipolygon, default_z=0, as_surface=False):
    if not isinstance(shp_multipolygon, ShpMultiPolygon):
        return None
    
    if as_surface:
        return [shapely_polygon_to_dynamo_surface(poly, default_z) for poly in shp_multipolygon.geoms]
    else:
        return [shapely_polygon_to_dynamo_polygon(poly, default_z) for poly in shp_multipolygon.geoms]

def convert_shapely_to_dynamo(shapely_geometry, default_z=0, polygon_as_surface=False):
    
    if shapely_geometry is None:
        return None

    if isinstance(shapely_geometry, BaseGeometry):
        
        if isinstance(shapely_geometry, ShpGeometryCollection):
             return [convert_shapely_to_dynamo(g, default_z, polygon_as_surface) for g in shapely_geometry.geoms]
        
        elif isinstance(shapely_geometry, ShpPoint):
            return shapely_point_to_dynamo(shapely_geometry, default_z)
        
        elif isinstance(shapely_geometry, ShpLinearRing):
            return shapely_linearring_to_dynamo(shapely_geometry, default_z)
        
        elif isinstance(shapely_geometry, ShpLineString):
            return shapely_linestring_to_dynamo(shapely_geometry, default_z)
        
        elif isinstance(shapely_geometry, ShpPolygon):
            if polygon_as_surface:
                return shapely_polygon_to_dynamo_surface(shapely_geometry, default_z)
            else:
                return shapely_polygon_to_dynamo_polygon(shapely_geometry, default_z)
        
        elif isinstance(shapely_geometry, ShpMultiPoint):
            return shapely_multipoint_to_dynamo(shapely_geometry, default_z)
        
        elif isinstance(shapely_geometry, ShpMultiLineString):
            return shapely_multilinestring_to_dynamo(shapely_geometry, default_z)
        
        elif isinstance(shapely_geometry, ShpMultiPolygon):
            return shapely_multipolygon_to_dynamo(shapely_geometry, default_z, polygon_as_surface)
        
        return None

    elif hasattr(shapely_geometry, "__iter__") and not isinstance(shapely_geometry, str):
        return [convert_shapely_to_dynamo(item, default_z, polygon_as_surface) for item in shapely_geometry]

    else:
        return None

if 'IN' in locals():
    shapely_input = IN[0]
    default_z_value = IN[1] if len(IN) > 1 else 0
    as_surface = IN[2] if len(IN) > 2 else False
    
    OUT = convert_shapely_to_dynamo(shapely_input, default_z_value, as_surface)
# ----------------------------------------
DynGeometry = Output(python_script)  # "_DynGeometry"
python_script_2 = Python()  # CPython3; frozen; unwired: IN[0]
# ---------- python_script_2.python (202 lines) ----------
# Shapely 2.0.1
# Durmus Bayram
import sys
import clr

clr.AddReference('ProtoGeometry')
from Autodesk.DesignScript.Geometry import *

try:
    from shapely.geometry import Point as ShpPoint
    from shapely.geometry import LineString as ShpLineString
    from shapely.geometry import Polygon as ShpPolygon
    from shapely.geometry import LinearRing as ShpLinearRing
    from shapely.geometry import MultiPoint as ShpMultiPoint
    from shapely.geometry import MultiLineString as ShpMultiLineString
    from shapely.geometry import MultiPolygon as ShpMultiPolygon
    from shapely.geometry import GeometryCollection as ShpGeometryCollection 
    from shapely.geometry.base import BaseGeometry
except ImportError:
    print("\n Please install Shapely package!")
    pass


def cleanup_points(coords, is_closed=False, tolerance=0.0001):
    if not coords or len(coords) < 1:
        return []
    
    cleaned = [coords[0]]
    for i in range(1, len(coords)):
        p1 = coords[i-1]
        p2 = coords[i]
        
        dist = sum((a - b)**2 for a, b in zip(p1, p2))**0.5
        
        if dist > tolerance:
            cleaned.append(p2)
            
    if is_closed and len(cleaned) > 1:
        p_first = cleaned[0]
        p_last = cleaned[-1]
        dist_end = sum((a - b)**2 for a, b in zip(p_first, p_last))**0.5
        if dist_end <= tolerance:
            cleaned.pop()
            
    return cleaned

def shapely_point_to_dynamo(shp_point, default_z=0):
    if not isinstance(shp_point, ShpPoint):
        return None
    coords = shp_point.coords[0]
    x, y = coords[0], coords[1]
    z = coords[2] if len(coords) > 2 else default_z
    return Point.ByCoordinates(x, y, z)

def shapely_linestring_to_dynamo(shp_linestring, default_z=0):
    if not isinstance(shp_linestring, ShpLineString):
        return None
    
    coords = cleanup_points(list(shp_linestring.coords), is_closed=False)
    
    if len(coords) < 2:
        return None 
    
    points = []
    for coord in coords:
        x, y = coord[0], coord[1]
        z = coord[2] if len(coord) > 2 else default_z
        points.append(Point.ByCoordinates(x, y, z))
    
    if len(points) == 2:
        return Line.ByStartPointEndPoint(points[0], points[1])
    else:
        return PolyCurve.ByPoints(points)

def shapely_linearring_to_dynamo(shp_ring, default_z=0):
    if not isinstance(shp_ring, ShpLinearRing):
        return None
    
    coords = cleanup_points(list(shp_ring.coords), is_closed=True)
    
    if len(coords) < 3: 
        return None
    
    points = []
    for coord in coords:
        x, y = coord[0], coord[1]
        z = coord[2] if len(coord) > 2 else default_z
        points.append(Point.ByCoordinates(x, y, z))
    
    return PolyCurve.ByPoints(points, True)

def shapely_polygon_to_dynamo_polygon(shp_polygon, default_z=0):
    if not isinstance(shp_polygon, ShpPolygon):
        return None
    
    exterior_coords = cleanup_points(list(shp_polygon.exterior.coords), is_closed=True)
    
    if len(exterior_coords) < 3:
        return None
    
    points = [Point.ByCoordinates(c[0], c[1], c[2] if len(c)>2 else default_z) for c in exterior_coords]
    return Polygon.ByPoints(points)

def shapely_polygon_to_dynamo_surface(shp_polygon, default_z=0):
    if not isinstance(shp_polygon, ShpPolygon):
        return None
    
    ext_coords = cleanup_points(list(shp_polygon.exterior.coords), is_closed=True)
    if len(ext_coords) < 3: return None
    
    outer_points = [Point.ByCoordinates(c[0], c[1], c[2] if len(c)>2 else default_z) for c in ext_coords]
    outer_curve = PolyCurve.ByPoints(outer_points, True)
    
    if len(shp_polygon.interiors) == 0:
        return Surface.ByPatch(outer_curve)
    
    inner_curves = []
    for interior in shp_polygon.interiors:
        int_coords = cleanup_points(list(interior.coords), is_closed=True)
        if len(int_coords) >= 3:
            pts = [Point.ByCoordinates(c[0], c[1], c[2] if len(c)>2 else default_z) for c in int_coords]
            inner_curves.append(PolyCurve.ByPoints(pts, True))
    
    try:
        main_surface = Surface.ByPatch(outer_curve)
        for hole_curve in inner_curves:
            hole_surface = Surface.ByPatch(hole_curve)
            main_surface = main_surface.Difference(hole_surface)
        return main_surface
    except:
        return Surface.ByPatch(outer_curve)

def shapely_multipoint_to_dynamo(shp_multipoint, default_z=0):
    # ShpMultiPoint → List[Dynamo Point]
    
    if not isinstance(shp_multipoint, ShpMultiPoint):
        return None
    
    return [shapely_point_to_dynamo(pt, default_z) for pt in shp_multipoint.geoms]

def shapely_multilinestring_to_dynamo(shp_multilinestring, default_z=0):
    # ShpMultiLineString → List[Dynamo PolyCurve]
    
    if not isinstance(shp_multilinestring, ShpMultiLineString):
        return None
    
    return [shapely_linestring_to_dynamo(ls, default_z) for ls in shp_multilinestring.geoms]

def shapely_multipolygon_to_dynamo(shp_multipolygon, default_z=0, as_surface=False):
    # ShpMultiPolygon → List[Dynamo Polygon] 
    
    if not isinstance(shp_multipolygon, ShpMultiPolygon):
        return None
    
    if as_surface:
        return [shapely_polygon_to_dynamo_surface(poly, default_z) for poly in shp_multipolygon.geoms]
    else:
        return [shapely_polygon_to_dynamo_polygon(poly, default_z) for poly in shp_multipolygon.geoms]

def convert_shapely_to_dynamo(shapely_geometry, default_z=0, polygon_as_surface=False):
    
    if isinstance(shapely_geometry, list):
        return [convert_shapely_to_dynamo(item, default_z, polygon_as_surface) for item in shapely_geometry]
    
    if isinstance(shapely_geometry, ShpGeometryCollection):
        return [convert_shapely_to_dynamo(g, default_z, polygon_as_surface) for g in shapely_geometry.geoms]
        
    if isinstance(shapely_geometry, ShpPoint):
        return shapely_point_to_dynamo(shapely_geometry, default_z)
    
    elif isinstance(shapely_geometry, ShpLinearRing):
        return shapely_linearring_to_dynamo(shapely_geometry, default_z)
    
    elif isinstance(shapely_geometry, ShpLineString):
        return shapely_linestring_to_dynamo(shapely_geometry, default_z)
    
    elif isinstance(shapely_geometry, ShpPolygon):
        if polygon_as_surface:
            return shapely_polygon_to_dynamo_surface(shapely_geometry, default_z)
        else:
            return shapely_polygon_to_dynamo_polygon(shapely_geometry, default_z)
    
    elif isinstance(shapely_geometry, ShpMultiPoint):
        return shapely_multipoint_to_dynamo(shapely_geometry, default_z)
    
    elif isinstance(shapely_geometry, ShpMultiLineString):
        return shapely_multilinestring_to_dynamo(shapely_geometry, default_z)
    
    elif isinstance(shapely_geometry, ShpMultiPolygon):
        return shapely_multipolygon_to_dynamo(shapely_geometry, default_z, polygon_as_surface)
    
    else:
        return None

if 'IN' in locals():
    shapely_input = IN[0]
    default_z_value = IN[1] if len(IN) > 1 else 0
    as_surface = IN[2] if len(IN) > 2 else False
    
    dynamo_output = convert_shapely_to_dynamo(shapely_input, default_z_value, as_surface)
    
    OUT = dynamo_output
# ----------------------------------------
