# Dynamo custom node Shapely → Numpy.dyf (Dynamo 3.4.1.7055)
# category: Shapely.Geometry.Conversion
# author: Durmus Bayryam
# Converts Shapely geometry to Numpy standards.

ShpGeometry = Input(_ShpGeometry: var[]..[])
python_script = Python(IN[0]=ShpGeometry)  # CPython3
# ---------- python_script.python (141 lines) ----------
# Shapely 2.0.1 
# Durmus Bayryam
import numpy as np

try:
    from shapely.geometry import Point as ShpPoint
    from shapely.geometry import LineString as ShpLineString
    from shapely.geometry import Polygon as ShpPolygon
    from shapely.geometry import LinearRing as ShpLinearRing
    from shapely.geometry import MultiPoint as ShpMultiPoint
    from shapely.geometry import MultiLineString as ShpMultiLineString
    from shapely.geometry import MultiPolygon as ShpMultiPolygon
    from shapely.geometry.base import BaseGeometry
except ImportError:
    print("\n Please install Shapely and Numpy package!")
    pass

def shapely_point_to_numpy(shp_point):
    #ShpPoint → np.array([x, y, z])
    
    if not isinstance(shp_point, ShpPoint):
        return None
    
    coords = shp_point.coords[0]
    
    if len(coords) == 2:
        return np.array([coords[0], coords[1]])
    else:
        return np.array([coords[0], coords[1], coords[2]])

def shapely_linestring_to_numpy(shp_linestring):
    # ShpLineString → np.array([[x1,y1,z1], [x2,y2,z2], ...])
    
    if not isinstance(shp_linestring, ShpLineString):
        return None
    
    coords = list(shp_linestring.coords)
    
    if len(coords) < 2:
        return None
    
    return np.array(coords)

def shapely_linearring_to_numpy(shp_ring):
    # ShpLinearRing → np.array([[x1,y1,z1], ...])
    
    if not isinstance(shp_ring, ShpLinearRing):
        return None
    
    coords = list(shp_ring.coords)
    
    if len(coords) < 4:
        return None
    
    return np.array(coords)

def shapely_polygon_to_numpy(shp_polygon, include_holes=True):
    #ShpPolygon → dict{'exterior': np.array, 'interiors': [np.array, ...]}
    
    if not isinstance(shp_polygon, ShpPolygon):
        return None
    
    exterior_coords = np.array(list(shp_polygon.exterior.coords))
    
    if not include_holes or len(shp_polygon.interiors) == 0:
        return exterior_coords
    
    interior_arrays = []
    for interior in shp_polygon.interiors:
        interior_coords = np.array(list(interior.coords))
        interior_arrays.append(interior_coords)
    
    return {
        'exterior': exterior_coords,
        'interiors': interior_arrays
    }

def shapely_multipoint_to_numpy(shp_multipoint):
    # ShpMultiPoint → np.array([[x1,y1,z1], [x2,y2,z2], ...])
    
    if not isinstance(shp_multipoint, ShpMultiPoint):
        return None
    
    coords = []
    for pt in shp_multipoint.geoms:
        coords.append(pt.coords[0])
    
    return np.array(coords)

def shapely_multilinestring_to_numpy(shp_multilinestring):
    # ShpMultiLineString → List[np.array]
    
    if not isinstance(shp_multilinestring, ShpMultiLineString):
        return None
    
    return [np.array(list(ls.coords)) for ls in shp_multilinestring.geoms]

def shapely_multipolygon_to_numpy(shp_multipolygon, include_holes=True):
    # ShpMultiPolygon → List[dict] veya List[np.array]
    
    if not isinstance(shp_multipolygon, ShpMultiPolygon):
        return None
    
    return [shapely_polygon_to_numpy(poly, include_holes) for poly in shp_multipolygon.geoms]

def convert_shapely_to_numpy(shapely_geometry, include_holes=True):
    
    if isinstance(shapely_geometry, list):
        return [convert_shapely_to_numpy(item, include_holes) for item in shapely_geometry]
    
    if isinstance(shapely_geometry, ShpPoint):
        return shapely_point_to_numpy(shapely_geometry)
    
    elif isinstance(shapely_geometry, ShpLinearRing):
        return shapely_linearring_to_numpy(shapely_geometry)
    
    elif isinstance(shapely_geometry, ShpLineString):
        return shapely_linestring_to_numpy(shapely_geometry)
    
    elif isinstance(shapely_geometry, ShpPolygon):
        return shapely_polygon_to_numpy(shapely_geometry, include_holes)
    
    elif isinstance(shapely_geometry, ShpMultiPoint):
        return shapely_multipoint_to_numpy(shapely_geometry)
    
    elif isinstance(shapely_geometry, ShpMultiLineString):
        return shapely_multilinestring_to_numpy(shapely_geometry)
    
    elif isinstance(shapely_geometry, ShpMultiPolygon):
        return shapely_multipolygon_to_numpy(shapely_geometry, include_holes)
    
    else:
        return None
        

if 'IN' in locals():
    dynamo_input = IN[0] 

    shapely_output = convert_shapely_to_numpy(dynamo_input)

    OUT = shapely_output
# ----------------------------------------
Numpy = Output(python_script)  # "_Numpy"
