# Dynamo graph Shapely-Polygon.dyn (Dynamo 3.4.1.7055)

shp_Voronoi = Custom[Shp_Voronoi]()  # It generates a Voronoi diagram based on the given set of points. Each Voronoi cell represents the area belonging to the nearest point.; unwired: ShpPoint, Tolerance
select_model_element = DSModelElementSelection()  # 1 picked in the model
geometry = Element.Geometry(element=select_model_element)
position = ModelText.Position(modelText=select_model_element)
ZAxis = Vector.ZAxis()
byOriginNormal = Plane.ByOriginNormal(origin=position, normal=ZAxis)
intersect = Geometry.Intersect(geometry=geometry, other=byOriginNormal)
dynamo_shapely = Custom[Dynamo → Shapely](DynGeometry=intersect)  # Converts Dynamo geometry to Shapely geometry.
integer_slider = IntegerSlider(2, range=2..100 step 2)
shp_Polgonise = Custom[Shp_Polgonise](Shp_Geometry=dynamo_shapely, Ncount=integer_slider)  # It finds the boundaries of the geometry and divides it into the number of geometries specified by the user. Each divided piece is given as a “closed polygon”.
shapely_dynamo = Custom[Shapely → Dynamo](ShpGeometry=shp_Polgonise)  # Converts Shapely geometry to Dynamo geometry.
code_block = CodeBlock(x=shapely_dynamo)
# ---------- code_block.designscript (3 lines) ----------
a = DSCore.List.Flatten(x);
a1 = DSCore.List.GroupByKey(a,DSCore.Object.IsNull(a))["groups"][0];
b = 0..1..#DSCore.List.Count(a1);
# ----------------------------------------
byPatch = Surface.ByPatch(closedCurve=code_block.a1)
code_block_2 = CodeBlock { [0..1]; }
color_range = ColorRange(indices=code_block_2, value=code_block.b)  # unwired: colors
byGeometryColor = Modifiers.GeometryColor.ByGeometryColor(geometry=byPatch, color=color_range)
watch = Watch(dynamo_shapely)
