# Dynamo custom node Shp_BoundingBox.dyf (Dynamo 3.4.1.7055)
# category: Shapely.Geometry.Operation
# author: Durmus Bayryam
# Find the smallest rectangle surrounding a geometry. This rectangle encompasses the furthest points of the geometry and is commonly used to summarise the dimensions of the geometry.

ShpGeometry = Input(_ShpGeometry: var[]..[])
python_script = Python(IN[0]=ShpGeometry)  # CPython3
# ---------- python_script.python (119 lines) ----------
# Shapely 2.0.1
# Durmus Bayram
import clr

try:
    from shapely.geometry import Point as ShpPoint
    from shapely.geometry import LineString as ShpLineString
    from shapely.geometry import Polygon as ShpPolygon
    from shapely.geometry import LinearRing as ShpLinearRing
    from shapely.geometry import MultiPoint as ShpMultiPoint
    from shapely.geometry import MultiLineString as ShpMultiLineString
    from shapely.geometry import MultiPolygon as ShpMultiPolygon
    from shapely.geometry.base import BaseGeometry
    from shapely import GeometryCollection as ShpGeometryCollection
except ImportError:
    print("\n Please install Shapely package!")
    pass

def shapely_point_boundingbox(shp_point):
    # ShpPoint -> BoundingBox
    
    if not isinstance(shp_point, ShpPoint):
        return None
    return shp_point.oriented_envelope

def shapely_linestring_boundingbox(shp_linestring):
    # ShpLineString -> BoundingBox
    
    if not isinstance(shp_linestring, ShpLineString):
        return None
    return shp_linestring.oriented_envelope

def shapely_linearring_boundingbox(shp_ring):
    # ShpLinearRing -> BoundingBox
    
    if not isinstance(shp_ring, ShpLinearRing):
        return None
    return shp_ring.oriented_envelope

def shapely_polygon_boundingbox(shp_polygon):
    # ShpPolygon -> BoundingBox
    
    if not isinstance(shp_polygon, ShpPolygon):
        return None
    return shp_polygon.oriented_envelope

def shapely_multipoint_boundingbox(shp_multipoint):
    # ShpMultiPoint -> BoundingBox
    
    if not isinstance(shp_multipoint, ShpMultiPoint):
        return None
    return shp_multipoint.oriented_envelope

def shapely_multilinestring_boundingbox(shp_multilinestring):
    # ShpMultiLineString
    
    if not isinstance(shp_multilinestring, ShpMultiLineString):
        return None
    return shp_multilinestring.oriented_envelope

def shapely_multipolygon_boundingbox(shp_multipolygon, return_individual=False):
    # ShpMultiPolygon -> BoundingBox
    
    if not isinstance(shp_multipolygon, ShpMultiPolygon):
        return None
    
    if return_individual:
        return [poly.oriented_envelope for poly in shp_multipolygon.geoms]
    else:
        return shp_multipolygon.oriented_envelope

def get_shapely_boundingbox(shapely_geometry, return_individual=False):
    
    if isinstance(shapely_geometry, list):
        return [get_shapely_boundingbox(item, return_individual) for item in shapely_geometry]
    
    # Point
    if isinstance(shapely_geometry, ShpPoint):
        return shapely_point_boundingbox(shapely_geometry)
    
    # LinearRing
    elif isinstance(shapely_geometry, ShpLinearRing):
        return shapely_linearring_boundingbox(shapely_geometry)
    
    # LineString
    elif isinstance(shapely_geometry, ShpLineString):
        return shapely_linestring_boundingbox(shapely_geometry)
    
    # Polygon
    elif isinstance(shapely_geometry, ShpPolygon):
        return shapely_polygon_boundingbox(shapely_geometry)
    
    # MultiPoint
    elif isinstance(shapely_geometry, ShpMultiPoint):
        return shapely_multipoint_boundingbox(shapely_geometry)
    
    # MultiLineString
    elif isinstance(shapely_geometry, ShpMultiLineString):
        return shapely_multilinestring_boundingbox(shapely_geometry)
    
    # MultiPolygon
    elif isinstance(shapely_geometry, ShpMultiPolygon):
        return shapely_multipolygon_boundingbox(shapely_geometry, return_individual)
    
    # Genel BaseGeometry
    elif isinstance(shapely_geometry, BaseGeometry):
        return shapely_geometry.envelope
    
    else:
        return None

# --- Main Execution ---
if 'IN' in locals():
    shapely_input = IN[0]
    return_individual = IN[1] if len(IN) > 1 else False
    
    bbox_output = get_shapely_boundingbox(shapely_input, return_individual)
    
    OUT = bbox_output
# ----------------------------------------
ShpGeometry_2 = Output(python_script)  # "_ShpGeometry"
