# Dynamo custom node Shp_BoundingCircle.dyf (Dynamo 3.4.1.7055)
# category: Shapely.Geometry.Operation
# author: Durmus Bayryam
# Rotates the smallest circle surrounding a geometry. This circle is calculated to encompass the entire geometry.

ShpGeometry = Input(_ShpGeometry: var[]..[])
python_script = Python(IN[0]=ShpGeometry)  # CPython3
# ---------- python_script.python (47 lines) ----------
# Shapely 2.0.1
# Durmus Bayram
import clr

try:
    from shapely.geometry import Point as ShpPoint
    from shapely.geometry import LineString as ShpLineString
    from shapely.geometry import Polygon as ShpPolygon
    from shapely.geometry import MultiPoint as ShpMultiPoint
    from shapely.geometry import MultiLineString as ShpMultiLineString
    from shapely.geometry import MultiPolygon as ShpMultiPolygon
    from shapely.geometry.base import BaseGeometry
    from shapely import minimum_bounding_circle

except ImportError:
    print("\n Please install Shapely package!")
    pass

def shapely_generic_mincircle(geom):
    if not isinstance(geom, BaseGeometry):
        return None
    
    return minimum_bounding_circle(geom)

def get_shapely_mincircle(shapely_geometry):
    
    if isinstance(shapely_geometry, list):
        return [get_shapely_mincircle(item) for item in shapely_geometry]
    
    if isinstance(shapely_geometry, (ShpMultiPoint, ShpMultiLineString, ShpMultiPolygon)):
        if return_individual:
            return [shapely_generic_mincircle(g) for g in shapely_geometry.geoms]
        else:
            return shapely_generic_mincircle(shapely_geometry,return_individual)
    
    elif isinstance(shapely_geometry, BaseGeometry):
        return shapely_generic_mincircle(shapely_geometry)
    
    else:
        return None

if 'IN' in locals():
    shp_input = IN[0]
    
    mincircle_output = get_shapely_mincircle(shp_input)
    
    OUT = mincircle_output
# ----------------------------------------
ShpGeometry_2 = Output(python_script)  # "_ShpGeometry"
