# Dynamo custom node Shp_Buffer.dyf (Dynamo 3.4.1.7055)
# category: Shapely.Geometry.Creates
# author: Durmus Bayryam
# A shapely buffer creates a new geometry extended by a specified distance around a geometry (point, line or polygon). This operation adds a buffer zone around the geometry based on the given distance.

ShpGeometry = Input(_ShpGeometry: var[]..[])
Offset = Input(_Offset: var[]..[])
style = Input(_style: var[]..[])  # # 1:Round, 2:Mitre, 3:Bevel
python_script = Python(IN[0]=ShpGeometry, IN[1]=Offset, IN[2]=style)  # CPython3
# ---------- python_script.python (68 lines) ----------
# Shapely 2.0.1
# Durmus Bayram
import clr

try:
    from shapely.geometry import Point as ShpPoint
    from shapely.geometry import LineString as ShpLineString
    from shapely.geometry import Polygon as ShpPolygon
    from shapely.geometry import LinearRing as ShpLinearRing
    from shapely.geometry import MultiPoint as ShpMultiPoint
    from shapely.geometry import MultiLineString as ShpMultiLineString
    from shapely.geometry import MultiPolygon as ShpMultiPolygon
    from shapely.geometry.base import BaseGeometry
    from shapely import GeometryCollection as ShpGeometryCollection
    from shapely import BufferJoinStyle

except ImportError:
    print("\n Please install Shapely package!")
    pass

def shapely_generic_buffer(geom, distance, cap_style=1, join_style=1):
    if not isinstance(geom, BaseGeometry):
        return None
    
    return geom.buffer(
        distance, 
        cap_style=cap_style, 
        join_style=join_style
    )

def shapely_multipolygon_buffer(shp_multipolygon, distance, params, return_individual=False):
    # ShpMultiPolygon -> Buffer
    if not isinstance(shp_multipolygon, ShpMultiPolygon):
        return None
    
    if return_individual:
        return [shapely_generic_buffer(poly, distance, **params) for poly in shp_multipolygon.geoms]
    else:
        return shapely_generic_buffer(shp_multipolygon, distance, **params)

def get_shapely_buffer(shapely_geometry, distance, params, return_individual=False):
    
    if isinstance(shapely_geometry, list):
        return [get_shapely_buffer(item, distance, params, return_individual) for item in shapely_geometry]
    
    if isinstance(shapely_geometry, (ShpMultiPoint, ShpMultiLineString, ShpMultiPolygon)):
        if return_individual:
            return [shapely_generic_buffer(g, distance, **params) for g in shapely_geometry.geoms]
        else:
            return shapely_generic_buffer(shapely_geometry, distance, **params)
    
    elif isinstance(shapely_geometry, BaseGeometry):
        return shapely_generic_buffer(shapely_geometry, distance, **params)
    
    else:
        return None

if 'IN' in locals():
    shp_input = IN[0]
    dist = IN[1] if IN[1] is not None else 0.0
    
    params = {
        "cap_style": 2,  # 1:Round, 2:Flat, 3:Square
        "join_style": IN[2] if len(IN) > 2 and IN[2] is not None else 1, # 1:Round, 2:Mitre, 3:Bevel
    }
    
    buffer_output = get_shapely_buffer(shp_input, dist, params)
    OUT = buffer_output
# ----------------------------------------
ShpGeometry_2 = Output(python_script)  # "_ShpGeometry"
