# Dynamo custom node Shp_Centroid.dyf (Dynamo 3.4.1.7055)
# category: Shapely.Geometry.Operation
# author: Durmus Bayryam
# Finds the centre of gravity for a geometry.

ShpGeometry = Input(_ShpGeometry: var[]..[])
python_script = Python(IN[0]=ShpGeometry)  # CPython3
# ---------- python_script.python (127 lines) ----------
# Shapely 2.0.1
# Durmus Bayram
import clr

try:
    from shapely.geometry import Point as ShpPoint
    from shapely.geometry import LineString as ShpLineString
    from shapely.geometry import Polygon as ShpPolygon
    from shapely.geometry import LinearRing as ShpLinearRing
    from shapely.geometry import MultiPoint as ShpMultiPoint
    from shapely.geometry import MultiLineString as ShpMultiLineString
    from shapely.geometry import MultiPolygon as ShpMultiPolygon
    from shapely.geometry.base import BaseGeometry
    from shapely import GeometryCollection as ShpGeometryCollection
except ImportError:
    print("\n Please install Shapely package!")
    pass

def shapely_point_centroid(shp_point):
    # ShpPoint -> Centroid
    
    if not isinstance(shp_point, ShpPoint):
        return None
    return shp_point.centroid

def shapely_linestring_centroid(shp_linestring):
    # ShpLineString -> Centroid
    
    if not isinstance(shp_linestring, ShpLineString):
        return None
    return shp_linestring.centroid

def shapely_linearring_centroid(shp_ring):
    # ShpLinearRing -> Centroid
    
    if not isinstance(shp_ring, ShpLinearRing):
        return None
    return shp_ring.centroid

def shapely_polygon_centroid(shp_polygon):
    # ShpPolygon -> Centroid
    
    if not isinstance(shp_polygon, ShpPolygon):
        return None
    return shp_polygon.centroid

def shapely_multipoint_centroid(shp_multipoint, return_individual=False):
    # ShpMultiPoint -> Centroid
    
    if not isinstance(shp_multipoint, ShpMultiPoint):
        return None
        
    if return_individual:
        return [pt.centroid for pt in shp_multipoint.geoms]
    else:
        return shp_multipoint.centroid

def shapely_multilinestring_centroid(shp_multilinestring, return_individual=False):
    # ShpMultiLineString -> Centroid
    
    if not isinstance(shp_multilinestring, ShpMultiLineString):
        return None
        
    if return_individual:
        return [line.centroid for line in shp_multilinestring.geoms]
    else:
        return shp_multilinestring.centroid

def shapely_multipolygon_centroid(shp_multipolygon, return_individual=False):
    # ShpMultiPolygon -> Centroid
    
    if not isinstance(shp_multipolygon, ShpMultiPolygon):
        return None
    
    if return_individual:
        return [poly.centroid for poly in shp_multipolygon.geoms]
    else:
        return shp_multipolygon.centroid

def get_shapely_centroid(shapely_geometry, return_individual=False):
    
    # List management (Recursive)
    if isinstance(shapely_geometry, list):
        return [get_shapely_centroid(item, return_individual) for item in shapely_geometry]
    
    # Point
    if isinstance(shapely_geometry, ShpPoint):
        return shapely_point_centroid(shapely_geometry)
    
    # LinearRing
    elif isinstance(shapely_geometry, ShpLinearRing):
        return shapely_linearring_centroid(shapely_geometry)
    
    # LineString
    elif isinstance(shapely_geometry, ShpLineString):
        return shapely_linestring_centroid(shapely_geometry)
    
    # Polygon
    elif isinstance(shapely_geometry, ShpPolygon):
        return shapely_polygon_centroid(shapely_geometry)
    
    # MultiPoint
    elif isinstance(shapely_geometry, ShpMultiPoint):
        return shapely_multipoint_centroid(shapely_geometry, return_individual)
    
    # MultiLineString
    elif isinstance(shapely_geometry, ShpMultiLineString):
        return shapely_multilinestring_centroid(shapely_geometry, return_individual)
    
    # MultiPolygon
    elif isinstance(shapely_geometry, ShpMultiPolygon):
        return shapely_multipolygon_centroid(shapely_geometry, return_individual)
    
    # BaseGeometry
    elif isinstance(shapely_geometry, BaseGeometry):
        return shapely_geometry.centroid
    
    else:
        return None

if 'IN' in locals():
    shapely_input = IN[0]
    return_individual = IN[1] if len(IN) > 1 else False
    
    centroid_output = get_shapely_centroid(shapely_input, return_individual)
    
    OUT = centroid_output
# ----------------------------------------
ShpPoints = Output(python_script)  # "_ShpPoints"
