# Dynamo custom node Shp_Distance.dyf (Dynamo 3.4.1.7055)
# category: Shapely.Geometry.Operation
# author: Durmus Bayryam
# Calculates the shortest distance between two geometries.

ShpGeometry = Input(_ShpGeometry: var[]..[])
ShpGeometry_2 = Input(_ShpGeometry: var[]..[])
python_script = Python(IN[0]=ShpGeometry, IN[1]=ShpGeometry_2)  # CPython3
# ---------- python_script.python (35 lines) ----------
# Shapely 2.0.1
# Durmus Bayram
import clr

try:
    from shapely.geometry.base import BaseGeometry
    from shapely import distance
except ImportError:
    print("\n Please install Shapely package!")
    pass

def safe_distance(g1, g2):
    if isinstance(g1, BaseGeometry) and isinstance(g2, BaseGeometry):
        return distance(g1, g2)
    return None

def get_shapely_distance(a, b):
    if isinstance(a, list):
        return [get_shapely_distance(item, b) for item in a]
    
    if isinstance(b, list):
        return [get_shapely_distance(a, item) for item in b]
    
    return safe_distance(a, b)

if 'IN' in locals():
    input_a = IN[0]
    input_b = IN[1] if len(IN) > 1 else None
    
    if input_a is not None and input_b is not None:
        output = get_shapely_distance(input_a, input_b)
    else:
        output = None

    OUT = output
# ----------------------------------------
Distance = Output(python_script)  # "_Distance"
