# Dynamo custom node Shp_EqualsExact.dyf (Dynamo 3.4.1.7055)
# category: Shapely.Geometry.Operation
# author: Durmus Bayryam
# It checks whether two geometries are completely identical. This determines whether all details between the two geometries are equal.

ShpGeometry = Input(_ShpGeometry: var[]..[])
ShpGeometry_2 = Input(_ShpGeometry: var[]..[])
Tolerance = Input(_Tolerance: var[]..[])
python_script = Python(IN[0]=ShpGeometry, IN[1]=ShpGeometry_2, IN[2]=Tolerance)  # CPython3
# ---------- python_script.python (42 lines) ----------
# Shapely 2.0.1
# Durmus Bayram
import clr

try:
    from shapely.geometry.base import BaseGeometry
    from shapely import equals_exact
except ImportError:
    print("\n Please install Shapely package!")
    pass

def safe_equals_exact(g1, g2, tol):
    if isinstance(g1, BaseGeometry) and isinstance(g2, BaseGeometry):
        try:
            return equals_exact(g1, g2, tolerance=tol)
        except:
            return g1
    return g1

def get_shapely_equals_exact(a, b, tol):
    if isinstance(a, list):
        return [get_shapely_equals_exact(item, b, tol) for item in a]
    
    if isinstance(b, list):
        result = a
        for ref in b:
            result = safe_equals_exact(result, ref, tol)
        return result
    
    return safe_equals_exact(a, b, tol)

if 'IN' in locals():
    input_a = IN[0]
    input_b = IN[1]
    tolerance = IN[2] if len(IN) > 2 and isinstance(IN[2], (float, int)) else 0.0
    
    if input_a is not None and input_b is not None:
        output = get_shapely_equals_exact(input_a, input_b, tolerance)
    else:
        output = input_a

    OUT = output
# ----------------------------------------
Boolean = Output(python_script)  # "_Boolean"
