# Dynamo custom node Shp_GetPoint.dyf (Dynamo 3.4.1.7055)
# category: Shapely.Geometry.Operation
# author: Durmus Bayryam
# It is used to find a specific point on the geometry. The user is expected to enter the unit of length.

ShpLine = Input(_ShpLine: var[]..[])  # PolyCurve and Curve
Distance = Input(_Distance: var[]..[])
python_script = Python(IN[0]=ShpLine, IN[1]=Distance)  # CPython3
# ---------- python_script.python (106 lines) ----------
# Shapely 2.0.1
# Durmus Bayram
import clr

try:
    from shapely.geometry import Point as ShpPoint
    from shapely.geometry import LineString as ShpLineString
    from shapely.geometry import Polygon as ShpPolygon
    from shapely.geometry import LinearRing as ShpLinearRing
    from shapely.geometry import MultiPoint as ShpMultiPoint
    from shapely.geometry import MultiLineString as ShpMultiLineString
    from shapely.geometry import MultiPolygon as ShpMultiPolygon
    from shapely.geometry.base import BaseGeometry
    from shapely.geometry import line_interpolate_point
    from shapely import GeometryCollection as ShpGeometryCollection
    
except ImportError:
    print("\n Please install Shapely package!")
    pass

def shapely_linestring_interpolate_point(
        shp_linestring,
        distance,
        normalized=False ):
            
    if not isinstance(shp_linestring, ShpLineString):
        return None
    return shp_linestring.line_interpolate_point(distance, normalized=normalized)

def shapely_linearring_interpolate_point(
        shp_ring,
        distance,
        normalized=False ):
    
    if not isinstance(shp_ring, ShpLinearRing):
        return None
    return shp_ring.line_interpolate_point(distance, normalized=normalized)

def shapely_multilinestring_interpolate_point(
        shp_multilinestring,
        distance,
        normalized=False,
        return_individual=False ):
    
    if not isinstance(shp_multilinestring, ShpMultiLineString):
        return None
        
    if return_individual:
        return [
            line.line_interpolate_point(distance, normalized=normalized)
            for line in shp_multilinestring.geoms ]
    else:
        return shp_multilinestring.line_interpolate_point(distance, normalized=normalized)

def get_shapely_interpolate_point(
        shapely_geometry,
        distance,
        normalized=False,
        return_individual=False ):
    
    if isinstance(shapely_geometry, list):
        return [
            get_shapely_interpolate_point(
                item,
                distance,
                normalized,
                return_individual )
            for item in shapely_geometry ]
    
    # LineString
    if isinstance(shapely_geometry, ShpLineString):
        return shapely_linestring_interpolate_point(
            shapely_geometry,
            distance,
            normalized )
    
    # LinearRing
    elif isinstance(shapely_geometry, ShpLinearRing):
        return shapely_linearring_interpolate_point(
            shapely_geometry,
            distance,
            normalized )
    
    # MultiLineString
    elif isinstance(shapely_geometry, ShpMultiLineString):
        return shapely_multilinestring_interpolate_point(
            shapely_geometry,
            distance,
            normalized,
            return_individual )
            
    else:
        return None


if 'IN' in locals():
    shapely_input   = IN[0]
    distance        = IN[1]
    normalized      = IN[2] if len(IN) > 2 else False
    return_individual = IN[3] if len(IN) > 3 else False
    
    OUT = get_shapely_interpolate_point(
        shapely_input,
        distance,
        normalized,
        return_individual )
# ----------------------------------------
ShpPoint = Output(python_script)  # "_ShpPoint"
