# Dynamo custom node Shp_LabelPoint.dyf (Dynamo 3.4.1.7055)
# category: Shapely.Geometry.Operation
# author: Durmus Bayryam
# It finds the ‘Best Point' that falls inside a polygon, as far away from the edges as possible.

ShpGeometry = Input(_ShpGeometry: var[]..[])
Tolerance = Input(_Tolerance: var[]..[])
python_script = Python(IN[0]=ShpGeometry, IN[1]=Tolerance)  # CPython3
# ---------- python_script.python (62 lines) ----------
# Shapely 2.0.1
# Durmus Bayram
import clr

try:
    from shapely.geometry import Polygon as ShpPolygon
    from shapely.geometry import MultiPolygon as ShpMultiPolygon
    from shapely.geometry import MultiLineString as ShpMultiLineString
    from shapely.geometry import GeometryCollection as ShpGeometryCollection
    from shapely.geometry.base import BaseGeometry
    from shapely.ops import polylabel
except ImportError:
    print("\n Please install Shapely package!")
    pass

def shapely_generic_polylabel(geom, tolerance):
    try:
        if isinstance(geom, ShpPolygon):
            return polylabel(geom, tolerance=tolerance)
        return None
    except:
        return None

def get_shapely_polylabel(shapely_geometry, tolerance, return_individual=True):
    if isinstance(shapely_geometry, list):
        return [get_shapely_polylabel(item, tolerance, return_individual) for item in shapely_geometry]
    
    if hasattr(shapely_geometry, "geoms"):
        
        if isinstance(shapely_geometry, ShpMultiPolygon):
            results = [shapely_generic_polylabel(g, tolerance) for g in shapely_geometry.geoms]
            if return_individual:
                return results
            else:
                try:
                    main_poly = max(shapely_geometry.geoms, key=lambda p: p.area)
                    return shapely_generic_polylabel(main_poly, tolerance)
                except:
                    return results[0] if results else None
        
        else:
            sub_results = []
            for g in shapely_geometry.geoms:
                res = get_shapely_polylabel(g, tolerance, return_individual)
                if res is not None:
                    sub_results.append(res)
            return sub_results if sub_results else None

    elif isinstance(shapely_geometry, ShpPolygon):
        return shapely_generic_polylabel(shapely_geometry, tolerance)
    
    else:
        return None

if 'IN' in locals():
    shp_input = IN[0]
    tolerance_val = IN[1] if len(IN) > 1 else 0.001
    indiv_mode = IN[2] if len(IN) > 2 else True 
    
    polylabel_output = get_shapely_polylabel(shp_input, tolerance_val, indiv_mode)
    
    OUT = polylabel_output
# ----------------------------------------
ShpPoint = Output(python_script)  # "_ShpPoint"
