# Dynamo custom node Shp_Length.dyf (Dynamo 3.4.1.7055)
# category: Shapely.Geometry.Operation
# author: Durmus Bayryam
# Calculates the length of a line. For line geometry, this operation gives the total length.

ShpGeometry = Input(_ShpGeometry: var[]..[])
python_script = Python(IN[0]=ShpGeometry)  # CPython3
# ---------- python_script.python (120 lines) ----------
# Shapely 2.0.1
# Durmus Bayryam
import clr

try:
    from shapely.geometry import Point as ShpPoint
    from shapely.geometry import LineString as ShpLineString
    from shapely.geometry import Polygon as ShpPolygon
    from shapely.geometry import LinearRing as ShpLinearRing
    from shapely.geometry import MultiPoint as ShpMultiPoint
    from shapely.geometry import MultiLineString as ShpMultiLineString
    from shapely.geometry import MultiPolygon as ShpMultiPolygon
    from shapely.geometry.base import BaseGeometry
    from shapely import GeometryCollection as ShpGeometryCollection
    from shapely import get_exterior_ring

except ImportError:
    print("\n Please install Shapely package!")
    pass

def shapely_point_length(shp_point):
    # ShpPoint → Length 
    
    if not isinstance(shp_point, ShpPoint):
        return None
    return shp_point.length

def shapely_linestring_length(shp_linestring):
    # ShpLineString → Length 
    
    if not isinstance(shp_linestring, ShpLineString):
        return None
    return shp_linestring.length

def shapely_linearring_length(shp_ring):
    # ShpLinearRing → Length 
    
    if not isinstance(shp_ring, ShpLinearRing):
        return None
    return shp_ring.length

def shapely_polygon_length(shp_polygon):
    # ShpPolygon → Length
    
    if not isinstance(shp_polygon, ShpPolygon):
        return None
    return shp_polygon.length

def shapely_multipoint_length(shp_multipoint):
    # ShpMultiPoint → Length 
    
    if not isinstance(shp_multipoint, ShpMultiPoint):
        return None
    return shp_multipoint.length

def shapely_multilinestring_length(shp_multilinestring):
    # ShpMultiLineString → Length 
    
    if not isinstance(shp_multilinestring, ShpMultiLineString):
        return None
    return shp_multilinestring.length

def shapely_multipolygon_length(shp_multipolygon, return_individual=False):
    # ShpMultiPolygon → Length
    
    if not isinstance(shp_multipolygon, ShpMultiPolygon):
        return None
    
    if return_individual:
        return [poly.length for poly in shp_multipolygon.geoms]
    else:
        return shp_multipolygon.length

def get_shapely_length(shapely_geometry, return_individual=False):
    
    if isinstance(shapely_geometry, list):
        return [get_shapely_length(item, return_individual) for item in shapely_geometry]
    
    # Point
    if isinstance(shapely_geometry, ShpPoint):
        return shapely_point_length(shapely_geometry)
    
    # LinearRing
    elif isinstance(shapely_geometry, ShpLinearRing):
        return shapely_linearring_length(shapely_geometry)
    
    # LineString
    elif isinstance(shapely_geometry, ShpLineString):
        return shapely_linestring_length(shapely_geometry)
    
    # Polygon
    elif isinstance(shapely_geometry, ShpPolygon):
        return shapely_polygon_length(shapely_geometry)
    
    # MultiPoint
    elif isinstance(shapely_geometry, ShpMultiPoint):
        return shapely_multipoint_length(shapely_geometry)
    
    # MultiLineString
    elif isinstance(shapely_geometry, ShpMultiLineString):
        return shapely_multilinestring_length(shapely_geometry)
    
    # MultiPolygon
    elif isinstance(shapely_geometry, ShpMultiPolygon):
        return shapely_multipolygon_length(shapely_geometry, return_individual)
    
    # Genel BaseGeometry
    elif isinstance(shapely_geometry, BaseGeometry):
        return shapely_geometry.boundary
    
    else:
        return None

if 'IN' in locals():
    shapely_input = IN[0]
    return_individual = IN[1] if len(IN) > 1 else False
    
    boundary_output = get_shapely_length(shapely_input, return_individual)
    
    OUT = boundary_output
# ----------------------------------------
Length = Output(python_script)
