# Dynamo custom node Shp_NearestPoint.dyf (Dynamo 3.4.1.7055)
# category: Shapely.Geometry.Operation
# author: Durmus Bayryam
# Rotates the other geometry closest to a given geometry. This operation is used to find the shortest distance between two geometries.

ShpGeometry = Input(_ShpGeometry: var[]..[])
ShpGeometry_2 = Input(_ShpGeometry: var[]..[])
python_script = Python(IN[0]=ShpGeometry, IN[1]=ShpGeometry_2)  # CPython3
# ---------- python_script.python (39 lines) ----------
# Shapely 2.0.1 - Recursive Nearest Points
# Durmus Bayram
import clr

try:
    from shapely.geometry import Point as ShpPoint
    from shapely.geometry import LineString as ShpLineString
    from shapely.geometry import Polygon as ShpPolygon
    from shapely.geometry.base import BaseGeometry
    from shapely.ops import nearest_points
except ImportError:
    print("\n Please install Shapely package!")
    pass

def safe_nearest_points(g1, g2):
    if not isinstance(g1, BaseGeometry) or not isinstance(g2, BaseGeometry):
        return None
    
    return list(nearest_points(g1, g2))

def get_shapely_nearest_points(geom_a, geom_b):
    if isinstance(geom_a, list):
        return [get_shapely_nearest_points(item, geom_b) for item in geom_a]
    
    if not isinstance(geom_a, list) and isinstance(geom_b, list):
        return [safe_nearest_points(geom_a, b) for b in geom_b]
        
    return safe_nearest_points(geom_a, geom_b)

if 'IN' in locals():
    input_a = IN[0]
    input_b = IN[1] if len(IN) > 1 else None
    
    if input_a is not None and input_b is not None:
        output = get_shapely_nearest_points(input_a, input_b)
    else:
        output = None

    OUT = output
# ----------------------------------------
ShpPoints = Output(python_script)  # "_ShpPoints"
