# Dynamo custom node Shp_Oriented.dyf (Dynamo 3.4.1.7055)
# category: Shapely.Geometry.Operation
# author: Durmus Bayryam
# After various operations, the orientation of geometries may sometimes change. The ‘Oriented’ input reorders all geometries within it as CCW/CW and corrects their orientation as desired by the user. It does not alter the geometry itself, only its orientation.

ShpGeometry = Input(_ShpGeometry: var[]..[])
Orient = Input(_Orient: var[]..[] = tTypedIdent0)  # CW=-1 / CCW=+1
python_script = Python(IN[0]=ShpGeometry, IN[1]=Orient)  # CPython3
# ---------- python_script.python (41 lines) ----------
# Shapely 2.0.1
# Durmus Bayram
import clr

try:
    from shapely.geometry import Polygon as ShpPolygon
    from shapely.geometry import MultiPolygon as ShpMultiPolygon
    from shapely.geometry import GeometryCollection as ShpGeometryCollection 
    from shapely.ops import orient
except ImportError:
    print("\n Please install Shapely package!")
    pass

def safe_orient(geom, sign):
    # Polygon
    if isinstance(geom, ShpPolygon):
        return orient(geom, sign=sign)
        
    # MultiPolygon
    elif isinstance(geom, ShpMultiPolygon):
        return ShpMultiPolygon([orient(p, sign=sign) for p in geom.geoms])

    # GeometryCollection
    elif isinstance(geom, ShpGeometryCollection):
        return ShpGeometryCollection([safe_orient(g, sign) for g in geom.geoms])
        
    return geom

def get_shapely_orient(input_data, sign=1.0):
    if isinstance(input_data, list):
        return [get_shapely_orient(item, sign) for item in input_data]
    
    return safe_orient(input_data, sign)

if 'IN' in locals():
    shp_input = IN[0]
    sign_val = IN[1] if len(IN) > 1 and IN[1] is not None else 1.0
    
    output = get_shapely_orient(shp_input, sign_val)
    
    OUT = output
# ----------------------------------------
ShpGeometry_2 = Output(python_script)  # "_ShpGeometry"
