# Dynamo custom node Shp_Perimeter.dyf (Dynamo 3.4.1.7055)
# category: Shapely.Geometry.Operation
# author: Durmus Bayryam
# Calculates the perimeter length around a polygon. This is the total length of the polygon's sides.

ShpGeometry = Input(_ShpGeometry: var[]..[])
python_script = Python(IN[0]=ShpGeometry)  # CPython3
# ---------- python_script.python (120 lines) ----------
# Shapely 2.0.1
# Durmus Bayryam
import clr

try:
    from shapely.geometry import Point as ShpPoint
    from shapely.geometry import LineString as ShpLineString
    from shapely.geometry import Polygon as ShpPolygon
    from shapely.geometry import LinearRing as ShpLinearRing
    from shapely.geometry import MultiPoint as ShpMultiPoint
    from shapely.geometry import MultiLineString as ShpMultiLineString
    from shapely.geometry import MultiPolygon as ShpMultiPolygon
    from shapely.geometry.base import BaseGeometry
    from shapely import GeometryCollection as ShpGeometryCollection
    from shapely import get_exterior_ring

except ImportError:
    print("\n Please install Shapely package!")
    pass

def shapely_point_ExteriorBoundary(shp_point):
    # ShpPoint → ExteriorBoundary 
    
    if not isinstance(shp_point, ShpPoint):
        return None
    return get_exterior_ring(shp_point)

def shapely_linestring_Exteriorboundary(shp_linestring):
    # ShpLineString → ExteriorBoundary 
    
    if not isinstance(shp_linestring, ShpLineString):
        return None
    return get_exterior_ring(shp_linestring)

def shapely_linearring_Exteriorboundary(shp_ring):
    # ShpLinearRing → ExteriorBoundary 
    
    if not isinstance(shp_ring, ShpLinearRing):
        return None
    return get_exterior_ring(shp_ring)

def shapely_polygon_Exteriorboundary(shp_polygon):
    # ShpPolygon → ExteriorBoundary = LinearRing 
    
    if not isinstance(shp_polygon, ShpPolygon):
        return None
    return get_exterior_ring(shp_polygon)

def shapely_multipoint_Exteriorboundary(shp_multipoint):
    # ShpMultiPoint → ExteriorBoundary 
    
    if not isinstance(shp_multipoint, ShpMultiPoint):
        return None
    return get_exterior_ring(shp_multipoint)

def shapely_multilinestring_Exteriorboundary(shp_multilinestring):
    # ShpMultiLineString → ExteriorBoundary 
    
    if not isinstance(shp_multilinestring, ShpMultiLineString):
        return None
    return get_exterior_ring(shp_multilinestring)

def shapely_multipolygon_Exteriorboundary(shp_multipolygon, return_individual=False):
    # ShpMultiPolygon → ExteriorBoundary
    
    if not isinstance(shp_multipolygon, ShpMultiPolygon):
        return None
    
    if return_individual:
        return [get_exterior_ring(poly) for poly in shp_multipolygon.geoms]
    else:
        return get_exterior_ring(shp_multipolygon)

def get_shapely_Exteriorboundary(shapely_geometry, return_individual=False):
    
    if isinstance(shapely_geometry, list):
        return [get_shapely_Exteriorboundary(item, return_individual) for item in shapely_geometry]
    
    # Point
    if isinstance(shapely_geometry, ShpPoint):
        return shapely_point_ExteriorBoundary(shapely_geometry)
    
    # LinearRing
    elif isinstance(shapely_geometry, ShpLinearRing):
        return shapely_linearring_Exteriorboundary(shapely_geometry)
    
    # LineString
    elif isinstance(shapely_geometry, ShpLineString):
        return shapely_linestring_Exteriorboundary(shapely_geometry)
    
    # Polygon
    elif isinstance(shapely_geometry, ShpPolygon):
        return shapely_polygon_Exteriorboundary(shapely_geometry)
    
    # MultiPoint
    elif isinstance(shapely_geometry, ShpMultiPoint):
        return shapely_multipoint_Exteriorboundary(shapely_geometry)
    
    # MultiLineString
    elif isinstance(shapely_geometry, ShpMultiLineString):
        return shapely_multilinestring_Exteriorboundary(shapely_geometry)
    
    # MultiPolygon
    elif isinstance(shapely_geometry, ShpMultiPolygon):
        return shapely_multipolygon_Exteriorboundary(shapely_geometry, return_individual)
    
    # BaseGeometry
    elif isinstance(shapely_geometry, BaseGeometry):
        return shapely_geometry.boundary
    
    else:
        return None

if 'IN' in locals():
    shapely_input = IN[0]
    return_individual = IN[1] if len(IN) > 1 else False
    
    boundary_output = get_shapely_Exteriorboundary(shapely_input, return_individual)
    
    OUT = boundary_output
# ----------------------------------------
ShpGeometry_2 = Output(python_script)  # "_ShpGeometry"
