# Dynamo custom node Shp_PerimeterInterior.dyf (Dynamo 3.4.1.7055)
# category: Shapely.Geometry.Operation
# author: Durmus Bayryam
# Calculates the inner boundaries (holes) and outer boundaries of a polygon. Inner boundaries are the voids within the polygon.

ShpGeometry = Input(_ShpGeometry: var[]..[])
python_script = Python(IN[0]=ShpGeometry)  # CPython3
# ---------- python_script.python (48 lines) ----------
# Shapely 2.0.1
# Durmus Bayram
import clr

try:
    from shapely.geometry import Point as ShpPoint
    from shapely.geometry import LineString as ShpLineString
    from shapely.geometry import Polygon as ShpPolygon
    from shapely.geometry import MultiPoint as ShpMultiPoint
    from shapely.geometry import MultiLineString as ShpMultiLineString
    from shapely.geometry import MultiPolygon as ShpMultiPolygon
    from shapely.geometry.base import BaseGeometry
    from shapely import get_interior_ring

except ImportError:
    print("\n Please install Shapely package!")
    pass

def shapely_generic_intring(geom,index):
    if not isinstance(geom, BaseGeometry):
        return None
    
    return get_interior_ring(geom,index=index)

def get_shapely_intring(shapely_geometry,index=1.0):
    
    if isinstance(shapely_geometry, list):
        return [get_shapely_intring(item, index) for item in shapely_geometry]
    
    if isinstance(shapely_geometry, (ShpMultiPoint, ShpMultiLineString, ShpMultiPolygon)):
        if return_individual:
            return [shapely_generic_intring(g, index) for g in shapely_geometry.geoms]
        else:
            return v(shapely_geometry, index, return_individual)
    
    elif isinstance(shapely_geometry, BaseGeometry):
        return shapely_generic_intring(shapely_geometry, index)
    
    else:
        return None

if 'IN' in locals():
    shp_input = IN[0]
    index_val = IN[1] if len(IN) > 1 and isinstance(IN[1], (float, int)) else 0.0
    
    intring_output = get_shapely_intring(shp_input, index_val)
    
    OUT = intring_output
# ----------------------------------------
ShpGeometry_2 = Output(python_script)  # "_ShpGeometry"
