# Dynamo custom node Shp_Polygonise.dyf (Dynamo 3.4.1.7055)
# category: Shapely.Geometry.Creates
# author: Durmus Bayryam
# It finds the boundaries of the geometry and divides it into the number of geometries specified by the user. Each divided piece is given as a “closed polygon”.

Shp_Geometry = Input(_Shp_Geometry: var[]..[])
Ncount = Input(_Ncount: var[]..[])
python_script = Python(IN[0]=Shp_Geometry, IN[1]=Ncount)  # CPython3
# ---------- python_script.python (72 lines) ----------
# Shapely 2.0.1
# Durmus Bayram
import clr
import math

try:
    from shapely.geometry import Point as ShpPoint
    from shapely.geometry import LineString as ShpLineString
    from shapely.geometry import Polygon as ShpPolygon
    from shapely.geometry import MultiPolygon as ShpMultiPolygon
    from shapely.geometry.base import BaseGeometry
    from shapely.ops import split
except ImportError:
    print("\n Please install Shapely package!")
    pass

def shapely_generic_split(geom, target_count):
    if not isinstance(geom, BaseGeometry) or target_count <= 1:
        return [geom]

    west, south, east, north = geom.bounds
    width = east - west
    height = north - south
    ratio = width / height

    # cols * rows ~= target_count  _  cols / rows ~= ratio
    cols = max(1, int(math.sqrt(target_count * ratio)))
    rows = max(1, int(math.ceil(target_count / cols)))

    cutters = []
    
    # Verticale
    if cols > 1:
        for i in range(1, cols):
            x = west + (width / cols) * i
            cutters.append(ShpLineString([(x, south), (x, north)]))
            
    # Horrizontale
    if rows > 1:
        for i in range(1, rows):
            y = south + (height / rows) * i
            cutters.append(ShpLineString([(west, y), (east, y)]))

    result_parts = [geom]
    for cutter in cutters:
        new_parts = []
        for part in result_parts:
            if part.intersects(cutter):
                split_result = split(part, cutter)
                new_parts.extend(list(split_result.geoms))
            else:
                new_parts.append(part)
        result_parts = new_parts

    return result_parts

def get_shapely_split(shapely_geometry, target_count):
    if isinstance(shapely_geometry, list):
        return [get_shapely_split(item, target_count) for item in shapely_geometry]
    
    if isinstance(shapely_geometry, BaseGeometry):
        return shapely_generic_split(shapely_geometry, target_count)
    
    return None

if 'IN' in locals():
    shp_input = IN[0]
    target_n = int(IN[1]) if IN[1] is not None else 1
    
    split_output = get_shapely_split(shp_input, target_n)
    
    OUT = split_output
# ----------------------------------------
ShpGeometry = Output(python_script)  # "_ShpGeometry"
