# Dynamo custom node Shp_PruneDuplicated.dyf (Dynamo 3.4.1.7055)
# category: Shapely.Geometry.Operation
# author: Durmus Bayryam
# Removes duplicate points from a geometry. This operation is used for data cleaning and validation.

ShpGeometry = Input(_ShpGeometry: var[]..[])
Tolerance = Input(_Tolerance: var[]..[])
python_script = Python(IN[0]=ShpGeometry, IN[1]=Tolerance)  # CPython3
# ---------- python_script.python (50 lines) ----------
# Shapely 2.0.1
# Durmus Bayram
import clr

try:
    from shapely.geometry import Point as ShpPoint
    from shapely.geometry import LineString as ShpLineString
    from shapely.geometry import Polygon as ShpPolygon
    from shapely.geometry import LinearRing as ShpLinearRing
    from shapely.geometry import MultiPoint as ShpMultiPoint
    from shapely.geometry import MultiLineString as ShpMultiLineString
    from shapely.geometry import MultiPolygon as ShpMultiPolygon
    from shapely.geometry.base import BaseGeometry
    from shapely import remove_repeated_points 

except ImportError:
    print("\n Please install Shapely package!")
    pass

def shapely_generic_remove_repeated(geom, tolerance):
    if not isinstance(geom, BaseGeometry):
        return None
    
    return remove_repeated_points(geom, tolerance=tolerance)

def get_shapely_remove_repeated(shapely_geometry, tolerance, return_individual=False):
    
    if isinstance(shapely_geometry, list):
        return [get_shapely_remove_repeated(item, tolerance, return_individual) for item in shapely_geometry]
    
    if isinstance(shapely_geometry, (ShpMultiPoint, ShpMultiLineString, ShpMultiPolygon)):
        if return_individual:
            return [shapely_generic_remove_repeated(g, tolerance) for g in shapely_geometry.geoms]
        else:
            return shapely_generic_remove_repeated(shapely_geometry, tolerance)
    
    elif isinstance(shapely_geometry, BaseGeometry):
        return shapely_generic_remove_repeated(shapely_geometry, tolerance)
    
    else:
        return None

if 'IN' in locals():
    shp_input = IN[0]
    tol = IN[1] if (IN[1] is not None and IN[1] >= 0) else 0.0
    return_indiv = IN[2] if len(IN) > 2 else False
    
    cleaned_output = get_shapely_remove_repeated(shp_input, tol, return_indiv)
    
    OUT = cleaned_output
# ----------------------------------------
ShpGeometry_2 = Output(python_script)  # "_ShpGeometry"
