# Dynamo custom node Shp_RevDifference.dyf (Dynamo 3.4.1.7055)
# category: Shapely.Geometry.Modifier
# author: Durmus Bayryam
# It performs the inverse of the difference function. It subtracts the second geometry from the first geometry, but here the subtracted geometries are applied in reverse.

ShpGeometry = Input(_ShpGeometry: var[]..[])
ShpGeometry_2 = Input(_ShpGeometry: var[]..[])
python_script = Python(IN[0]=ShpGeometry, IN[1]=ShpGeometry_2)  # CPython3
# ---------- python_script.python (42 lines) ----------
# Shapely 2.0.1
# Durmus Bayram
import clr

try:
    from shapely.geometry.base import BaseGeometry
    from shapely import symmetric_difference 
except ImportError:
    print("\n Please install Shapely package!")
    pass

def safe_sym_diff(g1, g2):
    if isinstance(g1, BaseGeometry) and isinstance(g2, BaseGeometry):
        try:
            return g1.symmetric_difference(g2)
        except:
            return g1
    return g1

def get_shapely_sym_diff(a, b):
    if isinstance(a, list) and isinstance(b, list) and len(a) == len(b):
        return [get_shapely_sym_diff(item_a, item_b) for item_a, item_b in zip(a, b)]
    
    elif isinstance(a, list):
        return [get_shapely_sym_diff(item_a, b) for item_a in a]
    
    elif isinstance(b, list):
        return [get_shapely_sym_diff(a, item_b) for item_b in b]
    
    else:
        return safe_sym_diff(a, b)

if 'IN' in locals():
    input_a = IN[0]
    input_b = IN[1] if len(IN) > 1 else None
    
    if input_a is not None and input_b is not None:
        output = get_shapely_sym_diff(input_a, input_b)
    else:
        output = input_a

    OUT = output
# ----------------------------------------
ShpGeometry_3 = Output(python_script)  # "_ShpGeometry"
