# Dynamo custom node Shp_Rotate.dyf (Dynamo 3.4.1.7055)
# category: Shapely.Geometry.Modifier
# author: Durmus Bayryam
# Rotates a geometry by the specified angle.

ShpGeometry = Input(_ShpGeometry: var[]..[])
Angle = Input(_Angle: int[]..[])
python_script = Python(IN[0]=ShpGeometry, IN[1]=Angle)  # CPython3
# ---------- python_script.python (49 lines) ----------
# Shapely 2.0.1
# Durmus Bayram
import clr

try:
    from shapely.geometry import Point as ShpPoint
    from shapely.geometry import LineString as ShpLineString
    from shapely.geometry import Polygon as ShpPolygon
    from shapely.geometry import MultiPoint as ShpMultiPoint
    from shapely.geometry import MultiLineString as ShpMultiLineString
    from shapely.geometry import MultiPolygon as ShpMultiPolygon
    from shapely.geometry.base import BaseGeometry
    from shapely import affinity 
except ImportError:
    print("\n Please install Shapely package!")
    pass

def shapely_generic_rotate(geom, angle, origin):
    if not isinstance(geom, BaseGeometry):
        return None
    
    return affinity.rotate(geom, angle=angle, origin=origin)

def get_shapely_rotate(shapely_geometry, angle, origin, return_individual=False):
    
    if isinstance(shapely_geometry, list):
        return [get_shapely_rotate(item, angle, origin, return_individual) for item in shapely_geometry]
    
    if isinstance(shapely_geometry, (ShpMultiPoint, ShpMultiLineString, ShpMultiPolygon)):
        if return_individual:
            return [shapely_generic_rotate(g, angle, origin) for g in shapely_geometry.geoms]
        else:
            return shapely_generic_rotate(shapely_geometry, angle, origin)
    
    elif isinstance(shapely_geometry, BaseGeometry):
        return shapely_generic_rotate(shapely_geometry, angle, origin)
    
    else:
        return None

if 'IN' in locals():
    shp_input = IN[0]
    angle_val = IN[1] if IN[1] is not None else 0.0
    origin_val = IN[2] if len(IN) > 2 and IN[2] is not None else 'centroid'
    indiv_mode = IN[3] if len(IN) > 3 else False
    
    rotate_output = get_shapely_rotate(shp_input, angle_val, origin_val, indiv_mode)
    
    OUT = rotate_output
# ----------------------------------------
ShpGeometry_2 = Output(python_script)  # "_ShpGeometry"
