# Dynamo custom node Shp_RotateSkew.dyf (Dynamo 3.4.1.7055)
# category: Shapely.Geometry.Modifier
# author: Durmus Bayryam
# rotates a geometry and simultaneously applies skew to it. This operation changes the position of the geometry while also providing a more complex transformation.

ShpGeometry = Input(_ShpGeometry: var[]..[])
X = Input(_X: int[]..[])
Y = Input(_Y: int[]..[])
python_script = Python(IN[0]=ShpGeometry, IN[1]=X, IN[2]=Y)  # CPython3
# ---------- python_script.python (51 lines) ----------
# Shapely 2.0.1
# Durmus Bayram
import clr

try:
    from shapely.geometry import Point as ShpPoint
    from shapely.geometry import LineString as ShpLineString
    from shapely.geometry import Polygon as ShpPolygon
    from shapely.geometry import LinearRing as ShpLinearRing
    from shapely.geometry import MultiPoint as ShpMultiPoint
    from shapely.geometry import MultiLineString as ShpMultiLineString
    from shapely.geometry import MultiPolygon as ShpMultiPolygon
    from shapely.geometry.base import BaseGeometry
    from shapely import affinity
except ImportError:
    print("\n Please install Shapely package!")
    pass

def shapely_generic_skew(geom, xs, ys, origin):
    if not isinstance(geom, BaseGeometry):
        return None
    
    return affinity.skew(geom, xs=xs, ys=ys, origin=origin)

def get_shapely_skew(shapely_geometry, xs, ys, origin='centroid', return_individual=False):
    
    if isinstance(shapely_geometry, list):
        return [get_shapely_skew(item, xs, ys, origin, return_individual) for item in shapely_geometry]
    
    if isinstance(shapely_geometry, (ShpMultiPoint, ShpMultiLineString, ShpMultiPolygon)):
        if return_individual:
            return [shapely_generic_skew(g, xs, ys, origin) for g in shapely_geometry.geoms]
        else:
            return shapely_generic_skew(shapely_geometry, xs, ys, origin)
    
    elif isinstance(shapely_geometry, BaseGeometry):
        return shapely_generic_skew(shapely_geometry, xs, ys, origin)
    
    else:
        return None

if 'IN' in locals():
    shp_input = IN[0]
    angle_x = IN[1] if IN[1] is not None else 0.0
    angle_y = IN[2] if IN[2] is not None else 0.0
    origin_point = IN[3] if len(IN) > 3 and IN[3] is not None else 'centroid'
    return_indiv = IN[4] if len(IN) > 4 else False
    
    skew_output = get_shapely_skew(shp_input, angle_x, angle_y, origin_point, return_indiv)
    
    OUT = skew_output
# ----------------------------------------
ShpGeometry_2 = Output(python_script)  # "_ShpGeometry"
