# Dynamo custom node Shp_Scale.dyf (Dynamo 3.4.1.7055)
# category: Shapely.Geometry.Modifier
# author: Durmus Bayryam
# Scales a geometry by a specific factor. It expands or contracts the geometry along both the horizontal and vertical axes.

ShpGeometry = Input(_ShpGeometry: var[]..[])
X = Input(_X: int[]..[])
Y = Input(_Y: int[]..[])
python_script = Python(IN[0]=ShpGeometry, IN[1]=X, IN[2]=Y)  # CPython3
# ---------- python_script.python (51 lines) ----------
# Shapely 2.0.1
# Durmus Bayram
import clr

try:
    from shapely.geometry import Point as ShpPoint
    from shapely.geometry import LineString as ShpLineString
    from shapely.geometry import Polygon as ShpPolygon
    from shapely.geometry import MultiPoint as ShpMultiPoint
    from shapely.geometry import MultiLineString as ShpMultiLineString
    from shapely.geometry import MultiPolygon as ShpMultiPolygon
    from shapely.geometry.base import BaseGeometry
    from shapely import affinity 

except ImportError:
    print("\n Please install Shapely package!")
    pass

def shapely_generic_scale(geom, xfact, yfact, origin):
    if not isinstance(geom, BaseGeometry):
        return None
    
    return affinity.scale(geom, xfact=xfact,yfact=yfact, origin=origin)

def get_shapely_scale(shapely_geometry, xfact, yfact, origin, return_individual=False):
    
    if isinstance(shapely_geometry, list):
        return [get_shapely_scale(item, xfact, yfact, origin, return_individual) for item in shapely_geometry]
    
    if isinstance(shapely_geometry, (ShpMultiPoint, ShpMultiLineString, ShpMultiPolygon)):
        if return_individual:
            return [shapely_generic_scale(g, xfact, yfact, origin) for g in shapely_geometry.geoms]
        else:
            return shapely_generic_scale(shapely_geometry, xfact, yfact, origin)
    
    elif isinstance(shapely_geometry, BaseGeometry):
        return shapely_generic_scale(shapely_geometry, xfact, yfact, origin)
    
    else:
        return None

if 'IN' in locals():
    shp_input = IN[0]
    xfact_val = IN[1] if IN[1] is not None else 1.0
    yfact_val = IN[2] if IN[2] is not None else 1.0
    origin_val = IN[3] if len(IN) > 4 and IN[3] is not None else 'center'
    indiv_mode = IN[4] if len(IN) > 5 else False
    
    scale_output = get_shapely_scale(shp_input, xfact_val, yfact_val, origin_val, indiv_mode)
    
    OUT = scale_output
# ----------------------------------------
ShpGeometry_2 = Output(python_script)  # "_ShpGeometry"
