# Dynamo custom node Shp_Segmentize.dyf (Dynamo 3.4.1.7055)
# category: Shapely.Geometry.Operation
# author: Durmus Bayryam
# It divides a geometry into smaller segments. This process breaks down the geometry into smaller pieces for more precise analysis and calculations.

ShpGeometry = Input(_ShpGeometry: var[]..[])
Segment = Input(_Segment: var[]..[])
python_script = Python(IN[0]=ShpGeometry, IN[1]=Segment)  # CPython3
# ---------- python_script.python (51 lines) ----------
# Shapely 2.0.1 
# Durmus Bayram
import clr

try:
    from shapely.geometry import Point as ShpPoint
    from shapely.geometry import LineString as ShpLineString
    from shapely.geometry import Polygon as ShpPolygon
    from shapely.geometry import LinearRing as ShpLinearRing
    from shapely.geometry import MultiLineString as ShpMultiLineString
    from shapely.geometry import MultiPolygon as ShpMultiPolygon
    from shapely.geometry.base import BaseGeometry
    from shapely import segmentize
except ImportError:
    print("\n Please install Shapely package!")
    pass

def shapely_generic_segmentize(geom, max_dist):
    if isinstance(geom, ShpPoint):
        return geom
        
    if not isinstance(geom, BaseGeometry) or max_dist <= 0:
        return geom
    
    return segmentize(geom, max_segment_length=max_dist)

def get_shapely_segmentize(shapely_geometry, max_dist, return_individual=False):
    
    if isinstance(shapely_geometry, list):
        return [get_shapely_segmentize(item, max_dist, return_individual) for item in shapely_geometry]
    
    if isinstance(shapely_geometry, (ShpMultiLineString, ShpMultiPolygon)):
        if return_individual:
            return [shapely_generic_segmentize(g, max_dist) for g in shapely_geometry.geoms]
        else:
            return shapely_generic_segmentize(shapely_geometry, max_dist)
    
    elif isinstance(shapely_geometry, BaseGeometry):
        return shapely_generic_segmentize(shapely_geometry, max_dist)
    
    return None

if 'IN' in locals():
    shp_input = IN[0]
    max_len = IN[1] if (IN[1] is not None and IN[1] > 0) else 0.0
    indiv_mode = IN[2] if len(IN) > 2 else False
    
    segmentized_geoms = get_shapely_segmentize(shp_input, max_len, indiv_mode)
    
    
    OUT = segmentized_geoms
# ----------------------------------------
ShpGeometry_2 = Output(python_script)  # "_ShpGeometry"
