# Dynamo custom node Shp_SharedPaths.dyf (Dynamo 3.4.1.7055)
# category: Shapely.Geometry.Operation
# author: Durmus Bayryam
# Determines the common paths (or intersections of paths) between two geometries. This operation is used to find common edges or connections.

ShpGeometry = Input(_ShpGeometry: var[]..[])
ShpGeometry_2 = Input(_ShpGeometry: var[]..[])
python_script = Python(IN[0]=ShpGeometry, IN[1]=ShpGeometry_2)  # CPython3
# ---------- python_script.python (74 lines) ----------
# Shapely 2.0.1
# Durmus Bayram
import clr

try:
    from shapely.geometry.base import BaseGeometry
    from shapely.ops import shared_paths
    from shapely.geometry import (
        GeometryCollection, LineString, MultiLineString, 
        Polygon, MultiPolygon, Point, MultiPoint
    )
except ImportError:
    pass

def prepare_geometry(g):
    if not isinstance(g, BaseGeometry):
        return None
    
    if g.geom_type in ['LineString', 'MultiLineString']:
        return g
    
    if g.geom_type in ['Polygon', 'MultiPolygon']:
        return g.boundary
    
    if g.geom_type == 'GeometryCollection':
        lines = [prepare_geometry(sub) for sub in g.geoms if prepare_geometry(sub) is not None]
        if lines:
            return MultiLineString(lines)
            
    return None

def safe_shared_paths(g1, g2):
    try:
        geom1 = prepare_geometry(g1)
        geom2 = prepare_geometry(g2)

        if geom1 is not None and geom2 is not None:
            try:
                return shared_paths(geom1, geom2)
            except:
                return GeometryCollection() 
        return GeometryCollection() 
    except:
        return GeometryCollection()

def process_lacing(a, b):
    if not isinstance(a, list) and not isinstance(b, list):
        return safe_shared_paths(a, b)
    
    list_a = a if isinstance(a, list) else [a]
    list_b = b if isinstance(b, list) else [b]
    
    max_len = max(len(list_a), len(list_b))
    results = []
    
    for i in range(max_len):
        item_a = list_a[i] if i < len(list_a) else list_a[-1]
        item_b = list_b[i] if i < len(list_b) else list_b[-1]
        
        if isinstance(item_a, list) or isinstance(item_b, list):
            results.append(process_lacing(item_a, item_b))
        else:
            results.append(safe_shared_paths(item_a, item_b))
            
    return results

if 'IN' in locals():
    input_a = IN[0]
    input_b = IN[1] if len(IN) > 1 else None
    
    if input_a is not None and input_b is not None:
        OUT = process_lacing(input_a, input_b)
    else:
        OUT = None
# ----------------------------------------
ShpGeometry_3 = Output(python_script)  # "_ShpGeometry"
