# Dynamo custom node Shp_ShortLine.dyf (Dynamo 3.4.1.7055)
# category: Shapely.Geometry.Operation
# author: Durmus Bayryam
# The shortest path between two points is represented by a straight line.

ShpGeometry = Input(_ShpGeometry: var[]..[])
ShpGeometry_2 = Input(_ShpGeometry: var[]..[])
python_script = Python(IN[0]=ShpGeometry, IN[1]=ShpGeometry_2)  # CPython3
# ---------- python_script.python (42 lines) ----------
# Shapely 2.0.1
# Durmus Bayram
import clr

try:
    from shapely.geometry import Point as ShpPoint
    from shapely.geometry import LineString as ShpLineString
    from shapely.geometry import Polygon as ShpPolygon
    from shapely.geometry import MultiPolygon as ShpMultiPolygon
    from shapely.geometry.base import BaseGeometry
    from shapely import shortest_line
    
    
except ImportError:
    print("\n Please install Shapely package!")
    pass

def get_shortest_line(geometry_a, geometry_b):
    if isinstance(geometry_a, list) and not isinstance(geometry_b, list):
        return [get_shortest_line(a, geometry_b) for a in geometry_a]
    
    elif not isinstance(geometry_a, list) and isinstance(geometry_b, list):
        return [get_shortest_line(geometry_a, b) for b in geometry_b]
        
    elif isinstance(geometry_a, list) and isinstance(geometry_b, list):
        return [get_shortest_line(a, b) for a, b in zip(geometry_a, geometry_b)]
    else:
        if isinstance(geometry_a, BaseGeometry) and isinstance(geometry_b, BaseGeometry):
            return shortest_line(geometry_a, geometry_b)
        else:
            return None

if 'IN' in locals():
    geom_a = IN[0]
    geom_b = IN[1] if len(IN) > 1 else None
    
    if geom_a is not None and geom_b is not None:
        shortest_line_output = get_shortest_line(geom_a, geom_b)
    else:
        shortest_line_output = None
    
    OUT = shortest_line_output
# ----------------------------------------
ShpLine = Output(python_script)  # "_ShpLine"
