# Dynamo custom node Shp_Simplify.dyf (Dynamo 3.4.1.7055)
# category: Shapely.Geometry.Operation
# author: Durmus Bayryam
# Simplifies a geometry, that is, it removes unnecessary details. This process enables more efficient calculations when working with large data sets.

ShpGeometry = Input(_ShpGeometry: var[]..[])
Tolerance = Input(_Tolerance: var[]..[])
python_script = Python(IN[0]=ShpGeometry, IN[1]=Tolerance)  # CPython3
# ---------- python_script.python (49 lines) ----------
# Shapely 2.0.1 - Recursive Simplify (Nested List Fix)
# Durmus Bayram
import clr

try:
    from shapely.geometry import Point as ShpPoint
    from shapely.geometry import LineString as ShpLineString
    from shapely.geometry import Polygon as ShpPolygon
    from shapely.geometry import LinearRing as ShpLinearRing
    from shapely.geometry import MultiPoint as ShpMultiPoint
    from shapely.geometry import MultiLineString as ShpMultiLineString
    from shapely.geometry import MultiPolygon as ShpMultiPolygon
    from shapely.geometry.base import BaseGeometry
    from shapely import simplify 

except ImportError:
    print("\n Please install Shapely package!")
    pass

def shapely_generic_simplify(geom, tolerance):
    if not isinstance(geom, BaseGeometry):
        return None
    return simplify(geom, tolerance=tolerance)

def get_shapely_simplify(shapely_geometry, tolerance, return_individual=False):
    
    if isinstance(shapely_geometry, list):
        return [get_shapely_simplify(item, tolerance, return_individual) for item in shapely_geometry]
    
    if isinstance(shapely_geometry, (ShpMultiPoint, ShpMultiLineString, ShpMultiPolygon)):
        if return_individual:
            return [shapely_generic_simplify(g, tolerance) for g in shapely_geometry.geoms]
        else:
            return shapely_generic_simplify(shapely_geometry, tolerance)
    
    elif isinstance(shapely_geometry, BaseGeometry):
        return shapely_generic_simplify(shapely_geometry, tolerance)
    
    else:
        return None

if 'IN' in locals():
    shp_input = IN[0]
    tol = IN[1] if (IN[1] is not None and IN[1] >= 0) else 0.0
    indiv_mode = IN[2] if len(IN) > 2 else False
    
    simplify_output = get_shapely_simplify(shp_input, tol, indiv_mode)
    
    OUT = simplify_output
# ----------------------------------------
ShpGeometry_2 = Output(python_script)  # "_ShpGeometry"
