# Dynamo custom node Shp_SkeletonPruning.dyf (Dynamo 3.4.1.7055)
# category: Shapely.Geometry.Operation
# author: Durmus Bayryam
# It uses the Topological Analysis method to clean the skeleton (centreline) of a polygon. It cleans the dead-end streets, known as ‘spurs’, which arise from Voronoi diagrams and are not connected to the main line.

ShpLine = Input(_ShpLine: var[]..[])
MinLength = Input(_MinLength: var[]..[])
MaxIteration = Input(_MaxIteration: var[]..[])
python_script = Python(IN[0]=ShpLine, IN[1]=MinLength, IN[2]=MaxIteration)  # CPython3
# ---------- python_script.python (95 lines) ----------
# Shapely 2.0.1
# Durmus Bayram
import clr

try:
    from shapely.geometry import Point as ShpPoint
    from shapely.geometry import LineString as ShpLineString
    from shapely.geometry import MultiLineString as ShpMultiLineString
    from shapely.geometry.base import BaseGeometry
    from shapely.ops import linemerge, unary_union
except ImportError:
    print("\n Please install Shapely package!")

def extract_lines(geom):
    lines = []
    if isinstance(geom, ShpLineString):
        lines.append(geom)
    elif hasattr(geom, 'geoms'): 
        for g in geom.geoms:
            lines.extend(extract_lines(g))
    return lines

def prune_skeleton(geometry, min_length=1.0, max_iterations=5):

    if not isinstance(geometry, BaseGeometry) or geometry.is_empty:
        return geometry

    current_geom = geometry
    iter_limit = int(max_iterations) 

    for i in range(iter_limit):
        
        input_lines = extract_lines(current_geom)
        
        if not input_lines:
            break
            
        if len(input_lines) > 1:
            try:
                merged = linemerge(input_lines)
            except ValueError:
                merged = unary_union(input_lines)
        else:
            merged = input_lines[0]

        lines_to_process = extract_lines(merged)
        
        node_counts = {}
        for line in lines_to_process:
            if not hasattr(line, 'coords') or len(line.coords) < 2: continue
            
            for pt in [line.coords[0], line.coords[-1]]:
                node_counts[pt] = node_counts.get(pt, 0) + 1
        
        cleaned_lines = []
        any_removed = False
        
        for line in lines_to_process:
            if not hasattr(line, 'coords'): continue
            
            start_pt = line.coords[0]
            end_pt = line.coords[-1]
            
            is_dead_end = (node_counts.get(start_pt, 0) == 1 or 
                           node_counts.get(end_pt, 0) == 1)
            
            if is_dead_end and line.length < min_length:
                any_removed = True
                continue 
            else:
                cleaned_lines.append(line)
        
        current_geom = unary_union(cleaned_lines)
        
        if not any_removed:
            break
            
    return current_geom

def get_skeleton_purge(input_data, min_length, max_iterations):
    if isinstance(input_data, list):
        return [get_skeleton_purge(item, min_length, max_iterations) for item in input_data]
    
    elif isinstance(input_data, BaseGeometry):
        return prune_skeleton(input_data, min_length, max_iterations)
        
    return None

if 'IN' in locals():
    centerline_input = IN[0] 
    
    threshold = IN[1] if (len(IN) > 1 and IN[1] is not None) else 1.0 
    max_iter = IN[2] if (len(IN) > 2 and IN[2] is not None) else 10 
    
    OUT = get_skeleton_purge(centerline_input, threshold, max_iter)
# ----------------------------------------
ShpLine_2 = Output(python_script)  # "_ShpLine"
