# Dynamo custom node Shp_Snap.dyf (Dynamo 3.4.1.7055)
# category: Shapely.Geometry.Creates
# author: Durmus Bayryam
# Aligns the corner points of one geometry with the corners of another geometry within a specified tolerance distance. This process is used to eliminate small gaps or misalignments between geometries.

ShpGeometry = Input(_ShpGeometry: var[]..[])
ShpGeometry_2 = Input(_ShpGeometry: var[]..[])
Tolerance = Input(_Tolerance: var[]..[])
python_script = Python(IN[0]=ShpGeometry, IN[1]=ShpGeometry_2, IN[2]=Tolerance)  # CPython3
# ---------- python_script.python (42 lines) ----------
# Shapely 2.0.1
# Durmus Bayram
import clr

try:
    from shapely.geometry.base import BaseGeometry
    from shapely import snap
except ImportError:
    print("\n Please install Shapely package!")
    pass

def safe_snap(g1, g2, tol):
    if isinstance(g1, BaseGeometry) and isinstance(g2, BaseGeometry):
        try:
            return snap(g1, g2, tolerance=tol)
        except:
            return g1
    return g1

def get_shapely_snap(a, b, tol):
    if isinstance(a, list):
        return [get_shapely_snap(item, b, tol) for item in a]
    
    if isinstance(b, list):
        result = a
        for ref in b:
            result = safe_snap(result, ref, tol)
        return result
    
    return safe_snap(a, b, tol)

if 'IN' in locals():
    input_a = IN[0]
    input_b = IN[1]
    tolerance = IN[2] if len(IN) > 2 and isinstance(IN[2], (float, int)) else 0.0
    
    if input_a is not None and input_b is not None:
        output = get_shapely_snap(input_a, input_b, tolerance)
    else:
        output = input_a

    OUT = output
# ----------------------------------------
ShpGeometry_3 = Output(python_script)  # "_ShpGeometry"
