# Dynamo custom node Shp_Split.dyf (Dynamo 3.4.1.7055)
# category: Shapely.Geometry.Modifier
# author: Durmus Bayryam
# divides a geometry with a specified line. This operation divides a polygon or line into two separate parts relative to the given line.

ShpGeometry = Input(_ShpGeometry: var[]..[])
ShpLineString = Input(_ShpLineString: var[]..[])  # Inputs must be either "LINESTRING"
python_script = Python(IN[0]=ShpGeometry, IN[1]=ShpLineString)  # CPython3
# ---------- python_script.python (47 lines) ----------
# Shapely 2.0.1
# Durmus Bayram
import clr

try:
    from shapely.geometry.base import BaseGeometry
    from shapely.ops import split
    from shapely.geometry import GeometryCollection
except ImportError:
    print("\n Please install Shapely package!")
    pass

def safe_split(g1, g2):
    if isinstance(g1, BaseGeometry) and isinstance(g2, BaseGeometry):
        try:
            result = split(g1, g2)
            return list(result.geoms) 
        except:
            return [g1]
    return [g1]

def get_shapely_split(a, b):
    if isinstance(a, list):
        return [get_shapely_split(item, b) for item in a]
    
    if isinstance(b, list):
        current_parts = [a]
        for cutter in b:
            new_parts = []
            for part in current_parts:
                split_res = safe_split(part, cutter)
                new_parts.extend(split_res)
            current_parts = new_parts
        return current_parts
    
    return safe_split(a, b)

if 'IN' in locals():
    input_a = IN[0]
    input_b = IN[1] if len(IN) > 1 else None
    
    if input_a is not None and input_b is not None:
        output = get_shapely_split(input_a, input_b)
    else:
        output = input_a

    OUT = output
# ----------------------------------------
ShpGeomtry = Output(python_script)  # "_ShpGeomtry"
