# Dynamo custom node Shp_Touches.dyf (Dynamo 3.4.1.7055)
# category: Shapely.Geometry.Operation
# author: Durmus Bayryam
# It checks whether there is any boundary contact between two geometries. This determines whether the edges of the geometries touch each other.

ShpGeometry = Input(_ShpGeometry: var[]..[])
ShpGeometry_2 = Input(_ShpGeometry: var[]..[])
python_script = Python(IN[0]=ShpGeometry, IN[1]=ShpGeometry_2)  # CPython3
# ---------- python_script.python (67 lines) ----------
# Shapely 2.0.1
# Durmus Bayram
import clr

try:
    from shapely.geometry import Point as ShpPoint
    from shapely.geometry import LineString as ShpLineString
    from shapely.geometry import Polygon as ShpPolygon
    from shapely.geometry import MultiPolygon as ShpMultiPolygon
    from shapely.geometry.base import BaseGeometry
    
    from shapely.prepared import prep 
    
except ImportError:
    print("\n Please install Shapely package!")
    pass

def prepare_geometry(geometry):
    if isinstance(geometry, BaseGeometry):
        return prep(geometry)
    return geometry

def check_touches_prepared(prepared_container, other_geometry):
    if not hasattr(prepared_container, 'touches'):
        if isinstance(prepared_container, BaseGeometry):
            return prepared_container.touches(other_geometry)
        return False

    if not isinstance(other_geometry, BaseGeometry):
        return False
        
    return prepared_container.touches(other_geometry)

def get_shapely_touches_performance(container_input, other_input):
    if isinstance(container_input, BaseGeometry):
        prepared_container = prepare_geometry(container_input)
        
        if isinstance(other_input, list):
            return [check_touches_prepared(prepared_container, other) for other in other_input]
        else:
            return check_touches_prepared(prepared_container, other_input)
            
    elif isinstance(container_input, list):
        
        prepared_containers = [prepare_geometry(item) for item in container_input if isinstance(item, BaseGeometry)]
        
        if not isinstance(other_input, list):
            return [check_touches_prepared(prep_c, other_input) for prep_c in prepared_containers]
        elif isinstance(other_input, list):
            return [check_touches_prepared(prep_c, other) 
                    for prep_c, other in zip(prepared_containers, other_input)]
        
    return None

if 'IN' in locals():
    # IN[0] Temas eden
    # IN[1] Temas edilen
    
    container_input = IN[0]
    other_input = IN[1] if len(IN) > 1 else None
    
    if container_input is not None and other_input is not None:
        touches_output = get_shapely_touches_performance(container_input, other_input)
    else:
        touches_output = False
    
    OUT = touches_output
# ----------------------------------------
Boolean = Output(python_script)  # "_Boolean"
