# Dynamo custom node Shp_TouchesByDistance.dyf (Dynamo 3.4.1.7055)
# category: Shapely.Geometry.Operation
# author: Durmus Bayryam
# It checks the contact status based on the distance between two geometries. This examines whether the geometries are in contact with each other, but only up to a certain distance.

ShpGeometry = Input(_ShpGeometry: var[]..[])
ShpGeometry_2 = Input(_ShpGeometry: var[]..[])
Distance = Input(_Distance: var[]..[])
python_script = Python(IN[0]=ShpGeometry, IN[1]=ShpGeometry_2, IN[2]=Distance)  # CPython3
# ---------- python_script.python (39 lines) ----------
# Shapely 2.0.1
# Durmus Bayram
import clr

try:
    from shapely.geometry.base import BaseGeometry
    from shapely import dwithin
except ImportError:
    print("\n Please install Shapely package!")
    pass

def safe_dwithin(g1, g2, d):
    if isinstance(g1, BaseGeometry) and isinstance(g2, BaseGeometry):
        try:
            return dwithin(g1, g2, distance=d)
        except:
            return False
    return False

def get_shapely_dwithin(a, b, d):
    if isinstance(a, list):
        return [get_shapely_dwithin(item, b, d) for item in a]
    
    if isinstance(b, list):
        return [get_shapely_dwithin(a, item, d) for item in b]
    
    return safe_dwithin(a, b, d)

if 'IN' in locals():
    input_a = IN[0]
    input_b = IN[1] if len(IN) > 1 else None
    dist_val = IN[2] if len(IN) > 2 and isinstance(IN[2], (float, int)) else 0.0
    
    if input_a is not None and input_b is not None:
        output = get_shapely_dwithin(input_a, input_b, dist_val)
    else:
        output = False

    OUT = output
# ----------------------------------------
code_block = CodeBlock(x=python_script) { String.FromObject(x)=="False" ? false : true; }
Boolean = Output(code_block)  # "_Boolean"
