# Dynamo custom node Shp_Triangulate.dyf (Dynamo 3.4.1.7055)
# category: Shapely.Geometry.Creates
# author: Durmus Bayryam
# It divides a polygon or a set of points into non-overlapping triangles. This process allows geometry to be broken down into smaller and simpler parts and is widely used in computational geometry.

ShpGeometry = Input(_ShpGeometry: var[]..[])
ShpClipGeometry = Input(_ShpClipGeometry: var[]..[])
python_script = Python(IN[0]=ShpGeometry, IN[1]=ShpClipGeometry)  # CPython3
# ---------- python_script.python (108 lines) ----------
# Shapely 2.0.1
# Durmus Bayram 
import clr

try:
    from shapely.geometry import Point as ShpPoint
    from shapely.geometry import LineString as ShpLineString
    from shapely.geometry import Polygon as ShpPolygon
    from shapely.geometry import MultiPoint as ShpMultiPoint
    from shapely.geometry import MultiLineString as ShpMultiLineString
    from shapely.geometry import MultiPolygon as ShpMultiPolygon
    from shapely.geometry.base import BaseGeometry
    from shapely.ops import triangulate
    from shapely import prepare
except ImportError:
    pass

def shapely_triangulate_with_intersection(geom, clip_geometry=None):
    if not isinstance(geom, BaseGeometry):
        return None
    
    triangles = triangulate(geom)
    
    if clip_geometry is None:
        return triangles
    
    if not isinstance(clip_geometry, (ShpPolygon, ShpMultiPolygon)):
        return triangles
    
    if clip_geometry.is_empty or clip_geometry.area < 1e-10:
        return triangles
    
    prepare(clip_geometry)
    clipped_triangles = []
    
    for triangle in triangles:
        if clip_geometry.contains(triangle):
            clipped_triangles.append(triangle)
        elif clip_geometry.intersects(triangle):
            intersection_result = clip_geometry.intersection(triangle)
            
            if not intersection_result.is_empty:
                if isinstance(intersection_result, ShpPolygon) and intersection_result.area > 1e-10:
                    clipped_triangles.append(intersection_result)
                elif isinstance(intersection_result, ShpMultiPolygon):
                    for poly in intersection_result.geoms:
                        if poly.area > 1e-10:
                            clipped_triangles.append(poly)
                elif hasattr(intersection_result, "geoms"):
                     for geom in intersection_result.geoms:
                         if isinstance(geom, ShpPolygon) and geom.area > 1e-10:
                             clipped_triangles.append(geom)

    return clipped_triangles

def handle_single_geometry(geom, clip, indiv_mode):
    if isinstance(geom, (ShpMultiPoint, ShpMultiLineString, ShpMultiPolygon)):
        if indiv_mode:
            results = []
            for sub_g in geom.geoms:
                actual_clip = sub_g if clip is None and isinstance(sub_g, ShpPolygon) else clip
                results.append(shapely_triangulate_with_intersection(sub_g, actual_clip))
            return results
        else:
            actual_clip = geom if clip is None and isinstance(geom, ShpMultiPolygon) else clip
            return shapely_triangulate_with_intersection(geom, actual_clip)

    elif isinstance(geom, ShpPolygon):
        actual_clip = geom if clip is None else clip
        return shapely_triangulate_with_intersection(geom, actual_clip)
    
    else:
        return shapely_triangulate_with_intersection(geom, clip)

def process_lacing(geom_input, clip_input, indiv_mode):
    current_geom = geom_input
    if isinstance(geom_input, list) and len(geom_input) > 0 and all(isinstance(x, ShpPoint) for x in geom_input):
        current_geom = ShpMultiPoint(geom_input)

    if isinstance(current_geom, list) or isinstance(clip_input, list):
        
        list_g = current_geom if isinstance(current_geom, list) else [current_geom]
        list_c = clip_input if isinstance(clip_input, list) else [clip_input]
        
        max_len = max(len(list_g), len(list_c))
        results = []
        
        for i in range(max_len):
            item_g = list_g[i] if i < len(list_g) else list_g[-1]
            
            if clip_input is None:
                item_c = None
            else:
                item_c = list_c[i] if i < len(list_c) else list_c[-1]
            
            results.append(process_lacing(item_g, item_c, indiv_mode))
            
        return results

    else:
        return handle_single_geometry(current_geom, clip_input, indiv_mode)

if 'IN' in locals():
    shp_input = IN[0]
    clip_geom = IN[1] if len(IN) > 1 else None
    indiv_mode = IN[2] if len(IN) > 2 else False

    OUT = process_lacing(shp_input, clip_geom, indiv_mode)
# ----------------------------------------
ShpGeometry_2 = Output(python_script)  # "_ShpGeometry"
