# Dynamo custom node Shp_Union.dyf (Dynamo 3.4.1.7055)
# category: Shapely.Geometry.Modifier
# author: Durmus Bayryam
# It divides a polygon or a set of points into non-overlapping triangles. This process allows geometry to be broken down into smaller and simpler parts and is widely used in computational geometry.

ShpGeometry = Input(_ShpGeometry: var[]..[])
python_script = Python(IN[0]=ShpGeometry)  # CPython3
# ---------- python_script.python (44 lines) ----------
# Shapely 2.0.1
# Durmus Bayram
import clr

try:
    from shapely.geometry.base import BaseGeometry
    from shapely import unary_union, make_valid
except ImportError:
    print("\n Please install Shapely package!")
    pass

def safe_union_operation(geom_list):
    valid_geoms = [g for g in geom_list if isinstance(g, BaseGeometry)]
    
    if not valid_geoms:
        return None
        
    try:
        result = unary_union(valid_geoms)
        
        if not result.is_valid:
            result = make_valid(result)
            
        return result
    except:
        return None

def get_shapely_union(input_data):
    if not isinstance(input_data, list):
        return input_data if isinstance(input_data, BaseGeometry) else None

    if len(input_data) == 0:
        return []

    if isinstance(input_data[0], list):
        return [get_shapely_union(sub) for sub in input_data]
    
    return safe_union_operation(input_data)

if 'IN' in locals():
    shp_input = IN[0]
    
    output = get_shapely_union(shp_input)
    OUT = output
# ----------------------------------------
ShpGeometry_2 = Output(python_script)  # "_ShpGeometry"
