# Dynamo custom node Shp_Voronoi.dyf (Dynamo 3.4.1.7055)
# category: Shapely.Geometry.Creates
# author: Durmus Bayryam
# It generates a Voronoi diagram based on the given set of points. Each Voronoi cell represents the area belonging to the nearest point.

ShpPoint = Input(_ShpPoint: var[]..[])
Density = Input(_Density: var[]..[])
python_script = Python(IN[0]=ShpPoint, IN[1]=Density)  # CPython3
# ---------- python_script.python (68 lines) ----------
# Shapely 2.0.1
# Durmus Bayram
import clr

try:
    from shapely.geometry import Point as ShpPoint
    from shapely.geometry import MultiPoint as ShpMultiPoint
    from shapely.geometry import Polygon as ShpPolygon
    from shapely.geometry.base import BaseGeometry
    from shapely import voronoi_polygons
except ImportError:
    print("\n Please install Shapely package!")

def get_vertices_as_multipoint(geom):

    if isinstance(geom, ShpMultiPoint):
        return geom
        
    points = []
    if isinstance(geom, ShpPolygon):
        points.extend([ShpPoint(c) for c in geom.exterior.coords])
        for hole in geom.interiors:
            points.extend([ShpPoint(c) for c in hole.coords])
            
    elif hasattr(geom, 'coords'): # LineString, Point
        points.extend([ShpPoint(c) for c in geom.coords])
        
    elif hasattr(geom, 'geoms'): # MultiLineString vb.
        for g in geom.geoms:
             if hasattr(g, 'coords'):
                points.extend([ShpPoint(c) for c in g.coords])

    if not points:
        return None
        
    return ShpMultiPoint(points)

def core_voronoi_calc(geom, tolerance, only_edges):

    try:
        mp = get_vertices_as_multipoint(geom)
        if mp is None: return None
        return voronoi_polygons(mp, tolerance=tolerance, only_edges=only_edges)
    except:
        return None

def process_voronoi_recursive(data, tolerance, only_edges):
    if isinstance(data, list):
        if not data: return None
        
        if isinstance(data[0], ShpPoint):
            mp = ShpMultiPoint(data)
            return voronoi_polygons(mp, tolerance=tolerance, only_edges=only_edges)
            
        else:
            return [process_voronoi_recursive(item, tolerance, only_edges) for item in data]

    elif isinstance(data, BaseGeometry):
        return core_voronoi_calc(data, tolerance, only_edges)
        
    return None

if 'IN' in locals():
    shp_input = IN[0] 
    tolerance_val = IN[1] if len(IN) > 1 and IN[1] is not None else 0.0
    only_edges_val = IN[2] if len(IN) > 2 and IN[2] is not None else True
    
    OUT = process_voronoi_recursive(shp_input, tolerance_val, only_edges_val)
# ----------------------------------------
ShpGeometry = Output(python_script)  # "_ShpGeometry"
