# Dynamo custom node ClusterQuality.dyf "Cluster Quality" (Dynamo 3.6.1.9895)
# category: Shapely.MachineLearning.Analysis
# author: Durmus Bayryam

Data = Input(_Data: var[]..[])
Labels = Input(_Labels: var[]..[])
python_script = Python(IN[0]=Data, IN[1]=Labels)  # CPython3
# ---------- python_script.python (61 lines) ----------
# Copyright(c) 2026
# Durmus Bayryam

import sys
import numpy as np

try:
    from sklearn.metrics import silhouette_score
except ImportError:
    pass

def ensure_structure(data_matrix, label_list):
    try:
        X = np.array(data_matrix, dtype=np.float64)
        if X.ndim == 1:
            X = X.reshape(1, -1)
            
        y = np.array(label_list)
        y = y.flatten() 
        
        return X, y, None
    except Exception as e:
        return None, None, str(e)

# INPUTS
data = IN[0]
labels = IN[1]

result = 0.0
msg = ""

if data and labels:
    X, y, error = ensure_structure(data, labels)
    
    if error:
        msg = f"Data Structure Error: {error}"
    else:
        try:
            unique_labels = np.unique(y)
            
            if len(unique_labels) < 2:
                result = 0.0
                msg = "Score: 0.0 (Needs at least 2 clusters)"
            elif len(X) != len(y):
                 msg = f"Mismatch: Data has {len(X)} items, Labels has {len(y)} items."
            else:
                score = silhouette_score(X, y, metric='euclidean')
                result = round(score, 4)
                
                if result > 0.7: msg = "Excellent"
                elif result > 0.5: msg = "Good"
                elif result > 0.25: msg = "Weak (Overlapping)."
                else: msg = "Bad clustering."
                
        except Exception as e:
            msg = f"Score Error: {str(e)}"
else:
    msg = "No Input Data"

# OUTPUT
OUT = [result, msg]
# ----------------------------------------
code_block = CodeBlock(x=python_script) { x[0]; x[1]; }
Score = Output(code_block.out0)  # "_Score"
Msg = Output(code_block.out1)  # "_Msg"
