# Dynamo custom node DBSCAN.dyf (Dynamo 3.6.1.9895)
# category: Shapely.MachineLearning.Model.Density
# author: Durmus Bayryam

Data = Input(_Data: var[]..[])
NeighborhoodDistance = Input(_NeighborhoodDistance: var[]..[])
MinNeighbors = Input(_MinNeighbors: var = "Auto")
# note: DBScan
python_script = Python(IN[0]=Data, IN[1]=NeighborhoodDistance, IN[2]=MinNeighbors)  # CPython3
# ---------- python_script.python (67 lines) ----------
# Copyright(c) 2026 
# Durmus Bayryam

import sys
import random
import numpy as np

try:
    from sklearn.cluster import DBSCAN
    from sklearn.neighbors import NearestNeighbors
except ImportError:
    raise Exception("Scikit-learn not found.")

def find_optimal_eps(data, min_samples):
    X = np.array(data)
    nbrs = NearestNeighbors(n_neighbors=min_samples).fit(X)
    distances, indices = nbrs.kneighbors(X)
    k_dist = np.sort(distances[:, min_samples-1])
    
    y = k_dist
    x = np.arange(len(y))
    
    x_norm = (x - x.min()) / (x.max() - x.min())
    denom = (y.max() - y.min())
    if denom == 0: return 0.5
    y_norm = (y - y.min()) / denom
    
    p1 = np.array([x_norm[0], y_norm[0]])
    p2 = np.array([x_norm[-1], y_norm[-1]])
    
    dist_list = []
    for i in range(len(x_norm)):
        p = np.array([x_norm[i], y_norm[i]])
        d = np.abs(np.cross(p2 - p1, p1 - p)) / np.linalg.norm(p2 - p1)
        dist_list.append(d)
        
    best_index = np.argmax(dist_list)
    return max(k_dist[best_index], 0.1)


# INPUTS
data = IN[0]
user_eps = IN[1]
user_min_samples = IN[2]

X = np.array(data)

if user_min_samples == "Auto" or user_min_samples is None:
    n_features = X.shape[1]
    min_samples = n_features + 1
else:
    min_samples = int(user_min_samples)
        
final_eps = float(user_eps) if user_eps is not None else find_optimal_eps(X, min_samples)
        
try:
    model = DBSCAN(eps=final_eps, min_samples=min_samples)
    labels = model.fit_predict(X)
        
    unique_labels = set(labels)
    n_clusters = len(unique_labels)
        
        
    OUT = [labels.tolist(), model, n_clusters]
        
except Exception as e:
    OUT = f"Error: {str(e)}"
# ----------------------------------------
code_block = CodeBlock(x=python_script) { x[0]; x[1]; x[2]; }
Labels = Output(code_block.out0)  # "_Labels"
Model = Output(code_block.out1)  # "_Model"
Ncluster = Output(code_block.out2)  # "_Ncluster"
