# Dynamo custom node Decoder.dyf (Dynamo 3.6.1.9895)
# category: Shapely.MachineLearning.PreProcessing
# author: Durmus Bayryam

Data = Input(_Data: var[]..[])
Encoder = Input(_Encoder: var[]..[])
# note: Decoder
python_script = Python(IN[0]=Data, IN[1]=Encoder)  # CPython3
# ---------- python_script.python (28 lines) ----------
# Copyright(c) 2026
# Durmus Bayryam

import sys
import numpy as np
    
def decode_onehot(encoded_data, encoder):
    try:
        X = np.array(encoded_data)
    except Exception as e:
        return [f"Data Error: {str(e)}"]

    if X.ndim == 1:
        X = X.reshape(-1, 1)
        
    # Inverse Transform 
    try:
        original_matrix = encoder.inverse_transform(X)
        return original_matrix.flatten().tolist()
        
    except Exception as e:
        return [f"Decoder Error: {str(e)}"]

# OUTPUT
if 'IN' in locals():
    data_to_decode = IN[0]
    encoder_object = IN[1]
    OUT = decode_onehot(data_to_decode, encoder_object)
# ----------------------------------------
FeaturesName = Output(python_script)  # "_FeaturesName"
