# Dynamo custom node Encoder.dyf (Dynamo 3.6.1.9895)
# category: Shapely.MachineLearning.PreProcessing
# author: Durmus Bayryam

String = Input(_String: var[]..[])
Type = Input(_Type: bool = true)  # Label Encoder : True OneHot Encoder : False
# note: Encoder
python_script = Python(IN[0]=String, IN[1]=Type)  # CPython3
# ---------- python_script.python (69 lines) ----------
# Copyright(c) 2026
# Durmus Bayryam
# One-Hot & Label Encoder

import sys
import numpy as np

try:
    from sklearn.preprocessing import OneHotEncoder, LabelEncoder
except ImportError as e:
    raise Exception(f"Failed: {e}")

def flatten_data_generator(input_data):
    if isinstance(input_data, list):
        for item in input_data:
            yield from flatten_data_generator(item)
    else:
        yield input_data

def reconstruct_structure(original_structure, value_iterator):
    if isinstance(original_structure, list):
        return [reconstruct_structure(sub_item, value_iterator) for sub_item in original_structure]
    else:
        val = next(value_iterator)
        if isinstance(val, (np.integer, np.int32, np.int64)):
            return int(val)
        elif isinstance(val, np.ndarray):
            return val.tolist()
        return val

def process_encoding(raw_data, use_label_mode=True):
    flat_data_list = list(flatten_data_generator(raw_data))
    
    clean_data = [str(x) if x is not None else "Unknown" for x in flat_data_list]
    
    X = np.array(clean_data)
    
    encoded_values = []
    classes_list = []
    encoder_obj = None

    if use_label_mode:
        # LabelEncoder
        encoder = LabelEncoder()
        encoded_values = encoder.fit_transform(X)
        classes_list = encoder.classes_.tolist()
        encoder_obj = encoder
    else:
        # OheHotEncoder
        X_reshaped = X.reshape(-1, 1)
        encoder = OneHotEncoder(sparse_output=False, handle_unknown='ignore')
        encoded_matrix = encoder.fit_transform(X_reshaped)
        
        encoded_values = encoded_matrix
        classes_list = encoder.get_feature_names_out(['Category']).tolist()
        encoder_obj = encoder

    data_iterator = iter(encoded_values)
    
    final_output = reconstruct_structure(raw_data, data_iterator)
    
    return final_output, encoder_obj, classes_list

# Output
if 'IN' in locals():
    raw_data_input = IN[0]
    use_label = IN[1] if len(IN) > 1 and isinstance(IN[1], bool) else False
    result_data, encoder, categories = process_encoding(raw_data_input, use_label)
    OUT = [result_data, encoder, categories]
# ----------------------------------------
code_block = CodeBlock(x=python_script) { x[0]; x[1]; x[2]; }
Data = Output(code_block.out0)  # "_Data"
Encoder = Output(code_block.out1)  # "_Encoder"
FeatureName = Output(code_block.out2)  # "_FeatureName"
