# Dynamo custom node FeatureExtractor.dyf "Feature Extractor" (Dynamo 3.6.1.9895)
# category: Shapely.MachineLearning.PreProcessing
# author: Durmus Bayryam

ShpGeometry = Input(_ShpGeometry: var[]..[])
# note: Feature Extraction
python_script = Python(IN[0]=ShpGeometry)  # CPython3
# ---------- python_script.python (124 lines) ----------
# Copyright(c) 2026
# Durmus Bayryam

import sys
import numpy as np
import math

try:
    from sklearn.preprocessing import StandardScaler
    from shapely.geometry import Point, MultiPoint
    from shapely.geometry import LineString, MultiLineString
    from shapely.geometry import Polygon, MultiPolygon
    from shapely.geometry import GeometryCollection
    from shapely.geometry.base import BaseGeometry
except ImportError as e:
    raise Exception(f"Failed: {e}")

class MathUtils: 
    @staticmethod   
    def calculate_compactness(area, perimeter):
        # Polsby-Popper (4 * pi * Area) / Perimeter^2
        if perimeter <= 0: return 0.0
        val = (4 * np.pi * area) / (perimeter ** 2)
        return min(max(val, 0.0), 1.0)

    @staticmethod
    def calculate_aspect_ratio(bounds):
        minx, miny, maxx, maxy = bounds
        width = maxx - minx
        height = maxy - miny
        if width <= 0.000001 or height <= 0.000001: return 0.0
        return max(width, height) / min(width, height)

    @staticmethod
    def calculate_solidity(geom, area):
        # Convex Hull
        if area <= 0: return 0.0
        convex_area = geom.convex_hull.area
        if convex_area <= 0: return 0.0
        return area / convex_area

    @staticmethod
    def calculate_rectangularity(area, bounds):
        # Bounding Box
        minx, miny, maxx, maxy = bounds
        bbox_area = (maxx - minx) * (maxy - miny)
        if bbox_area <= 0: return 0.0
        return area / bbox_area

def flatten_data(input_data):
    if isinstance(input_data, list):
        for item in input_data:
            yield from flatten_data(item)
    else:
        yield input_data

def extract_features(geom):
    # [Area, Compactness, AspectRatio, Solidity, Rectangularity, CentroidX, CentroidY]
    if geom is None or not isinstance(geom, BaseGeometry) or geom.is_empty:
        return [0.0] * 7
        
    area = 0.0
    perimeter = 0.0
    aspect_ratio = 0.0
    compactness = 0.0
    solidity = 0.0
    rectangularity = 0.0
    c_x = 0.0
    c_y = 0.0
    
    try:
        bounds = geom.bounds
        aspect_ratio = MathUtils.calculate_aspect_ratio(bounds)
        
        if geom.centroid:
            c_x = geom.centroid.x
            c_y = geom.centroid.y

        if isinstance(geom, (Polygon, MultiPolygon)):
            area = geom.area
            perimeter = geom.length
            compactness = MathUtils.calculate_compactness(area, perimeter)
            solidity = MathUtils.calculate_solidity(geom, area)
            rectangularity = MathUtils.calculate_rectangularity(area, bounds)
            
        elif isinstance(geom, (LineString, MultiLineString)):
            perimeter = geom.length
            
        elif isinstance(geom, (Point, MultiPoint)):
            compactness = 1.0 
            aspect_ratio = 1.0
            solidity = 1.0
            rectangularity = 1.0
            
        elif isinstance(geom, GeometryCollection):
            area = geom.area
            perimeter = geom.length
            compactness = MathUtils.calculate_compactness(area, perimeter)

    except Exception:
        return [0.0] * 7

    return [area, compactness, aspect_ratio, solidity, rectangularity, c_x, c_y]

def process_pipeline(raw_input):
    flat_geometry_list = list(flatten_data(raw_input))
    
    feature_matrix = []
    for geom in flat_geometry_list:
        features = extract_features(geom)
        feature_matrix.append(features)
    
    if not feature_matrix:
        return []

    X = np.array(feature_matrix, dtype=np.float64)

    return X 

# OUTPUT
if 'IN' in locals():
    shapely_input = IN[0]
    result_matrix = process_pipeline(shapely_input)
    OUT = result_matrix
# ----------------------------------------
Data = Output(python_script)  # "_Data"
