# Dynamo custom node FeatureJoiner.dyf "Feature Joiner" (Dynamo 3.6.1.9895)
# category: Shapely.MachineLearning.PreProcessing
# author: Durmus Bayryam

Data = Input(_Data: var[]..[])
Data_2 = Input(_Data: var[]..[])
# note: Feature Joiner
python_script = Python(IN[0]=Data, IN[1]=Data_2)  # CPython3
# ---------- python_script.python (54 lines) ----------
# Copyright(c) 2026
# Durmus Bayryam

import sys
import numpy as np

def ensure_2d_array(data, name="Input"):
    try:
        # Gelen veriyi dogrudan numpy float dizisine ceviriyoruz
        arr = np.array(data, dtype=np.float64)
        
        # Eger tek boyutluysa (Orn: [3, 3, 3...] gibi etiket listesi)
        if arr.ndim == 1:
            # 1 Satir N Sutun DEGIL (1, -1)
            # N Satir 1 Sutun yapmaliyiz (-1, 1) -> Butun sorun buradaydi!
            arr = arr.reshape(-1, 1)
            
        return arr

    except Exception as e:
        return f"Error in {name}: {str(e)}"

# INPUTS
raw_a = IN[0] # Features
raw_b = IN[1] # OneHot veya Label

# PROCESS
mat_a = ensure_2d_array(raw_a, "Matrix A (Geometry)")
mat_b = ensure_2d_array(raw_b, "Matrix B (OneHot)")

result = []

# Eger matris olustururken hata mesajina donustuyse (String ise)
if isinstance(mat_a, str) or isinstance(mat_b, str):
    OUT = [mat_a, mat_b]
else:
    try:
        rows_a = mat_a.shape[0]
        rows_b = mat_b.shape[0]
        
        if rows_a != rows_b:
            result = f"Mismatch Error: Matrix A has {rows_a} rows, Matrix B has {rows_b} rows."
        else:
            # Matrisleri yan yana yapistir (axis=1)
            joined_matrix = np.concatenate((mat_a, mat_b), axis=1)
            
            # Dynamo'nun rahat okumasi icin tekrar Python listesine cevir
            result = joined_matrix
            
    except Exception as e:
        result = f"Join Error: {str(e)}"

# OUTPUT
OUT = result
# ----------------------------------------
Data_3 = Output(python_script)  # "_Data"
