# Dynamo custom node FeatureOverlayAnalysis.dyf "Feature Overlay Analysis" (Dynamo 3.6.1.9895)
# category: Shapely.MachineLearning.Analysis
# author: Durmus Bayryam

TrainData = Input(_TrainData: var[]..[])
TrainLabels = Input(_TrainLabels: var[]..[])
python_script = Python(IN[0]=TrainData, IN[1]=TrainLabels)  # CPython3
# ---------- python_script.python (189 lines) ----------
# Copyright(c) 2026
# Durmus Bayryam
# Superposed Visualization

import sys
import numpy as np
import tempfile
import os
import clr
import math

clr.AddReference('System.Drawing')
from System.Drawing import Bitmap, Graphics, Color, Pen, SolidBrush, Font, FontFamily, StringFormat, StringAlignment
from System.Drawing.Drawing2D import SmoothingMode
from System.Drawing.Imaging import ImageFormat

try:
    from sklearn.preprocessing import MinMaxScaler, PolynomialFeatures
    from sklearn.linear_model import LinearRegression
    from sklearn.pipeline import make_pipeline
except ImportError:
    raise Exception("Sklearn not found.")

# Ploter
class NativeSuperPlotter:
    def __init__(self, width=1000, height=600):
        self.width = width
        self.height = height
        self.padding_left = 60
        self.padding_bottom = 60
        self.padding_top = 40
        self.padding_right = 100
        
        self.bmp = Bitmap(width, height)
        self.g = Graphics.FromImage(self.bmp)
        self.g.Clear(Color.White)
        self.g.SmoothingMode = SmoothingMode.AntiAlias
        
        # Panel
        self.font_title = Font(FontFamily.GenericSansSerif, 12, 1) 
        self.font_label = Font(FontFamily.GenericSansSerif, 10)
        self.pen_axis = Pen(Color.Black, 3)
        self.pen_grid = Pen(Color.LightGray, 0)
        self.pen_grid.DashStyle = 2
        self.brush_text = SolidBrush(Color.Black)
        
        # Legend
        self.legend_y_pos = self.padding_top + 0

    def _get_rainbow_color(self, i, total):
        if total == 0: return Color.Blue
        hue = (float(i) / total) * 360.0
        s = 1.0; v = 0.8
        c = v * s
        x = c * (1 - abs((hue / 60.0) % 2 - 1))
        m = v - c
        
        if 0 <= hue < 60: r, g, b = c, x, 0
        elif 60 <= hue < 120: r, g, b = x, c, 0
        elif 120 <= hue < 180: r, g, b = 0, c, x
        elif 180 <= hue < 240: r, g, b = 0, x, c
        elif 240 <= hue < 300: r, g, b = x, 0, c
        else: r, g, b = c, 0, x
        
        return Color.FromArgb(255, int((r+m)*255), int((g+m)*255), int((b+m)*255))

    def _map(self, val, src_min, src_max, dst_min, dst_max):
        if src_max == src_min: return dst_min
        return (val - src_min) * (dst_max - dst_min) / (src_max - src_min) + dst_min

    def draw_axes(self, y_min, y_max, title):
        plot_w = self.width - self.padding_left - self.padding_right
        plot_h = self.height - self.padding_top - self.padding_bottom
        x0 = self.padding_left
        y0 = self.padding_top
        
        self.g.DrawRectangle(self.pen_axis, x0, y0, plot_w, plot_h)
        
        # Title
        fmt = StringFormat()
        fmt.Alignment = StringAlignment.Center
        self.g.DrawString(title, self.font_title, self.brush_text, self.width/2, 10, fmt)

    def draw_series(self, x_scatter, y_scatter, x_line, y_line, idx, total_features, y_global_min, y_global_max):
        plot_w = self.width - self.padding_left - self.padding_right
        plot_h = self.height - self.padding_top - self.padding_bottom
        x0 = self.padding_left
        y0 = self.padding_top
        
        col = self._get_rainbow_color(idx, total_features)
        pen_curve = Pen(col, 2)
        pen_curve.DashStyle = 2
        brush_pt = SolidBrush(Color.FromArgb(200, col.R, col.G, col.B))
        
        # Point
        pt_size = 8
        for x, y in zip(x_scatter, y_scatter):
            px = x0 + (x * plot_w)
            py = self._map(y, y_global_min, y_global_max, y0 + plot_h, y0)
            
            self.g.FillEllipse(brush_pt, px - pt_size/2, py - pt_size/2, pt_size, pt_size)

        # Curve
        for i in range(len(x_line) - 1):
            px1 = x0 + (x_line[i] * plot_w)
            py1 = self._map(y_line[i], y_global_min, y_global_max, y0 + plot_h, y0)
            px2 = x0 + (x_line[i+1] * plot_w)
            py2 = self._map(y_line[i+1], y_global_min, y_global_max, y0 + plot_h, y0)
            
            if y0 <= py1 <= y0 + plot_h and y0 <= py2 <= y0 + plot_h:
                self.g.DrawLine(pen_curve, px1, py1, px2, py2)
                
        # Legend
        leg_x = self.width - self.padding_right + 10
        self.g.FillRectangle(SolidBrush(col), leg_x, self.legend_y_pos, 20, 10)
        self.g.DrawString(f"Feature {idx}", self.font_label, self.brush_text, leg_x + 25, self.legend_y_pos - 2)
        self.legend_y_pos += 20

    def save(self, path):
        self.bmp.Save(path, ImageFormat.Png)
        self.g.Dispose()
        self.bmp.Dispose()
        return path

# INPUTS
X_in = IN[0]
y_in = IN[1]

if X_in and y_in:
    try:
        X = np.array(X_in)
        y_temp = np.array(y_in)
        
        if y_temp.ndim > 1 and y_temp.shape[1] > 1:
            y = np.argmax(y_temp, axis=1)
        else:
            y = y_temp.flatten()
        
        num_features = X.shape[1]
        
        # Normalize (MinMax)
        scaler = MinMaxScaler()
        X_scaled = scaler.fit_transform(X)
        
        y_min, y_max = y.min(), y.max()
        margin = (y_max - y_min) * 0.1 if y_max != y_min else 1.0
        y_min -= margin
        y_max += margin
        
        plotter = NativeSuperPlotter(1000, 600)
        plotter.draw_axes(y_min, y_max, "Superposed Feature Analysis")
        
        x_pred_range = np.linspace(0, 1, 100).reshape(-1, 1)
        
        for i in range(num_features):
            x_col = X_scaled[:, i].reshape(-1, 1)
            
            # Model
            model = make_pipeline(PolynomialFeatures(degree=2), LinearRegression())
            model.fit(x_col, y)
            y_pred_line = model.predict(x_pred_range)
            
            # Plotter
            plotter.draw_series(
                x_scatter=x_col.flatten(), 
                y_scatter=y, 
                x_line=x_pred_range.flatten(), 
                y_line=y_pred_line, 
                idx=i, 
                total_features=num_features,
                y_global_min=y_min, 
                y_global_max=y_max
            )
            
        # Save
        temp_dir = tempfile.gettempdir()
        file_name = "Superposed_Analysis.png"
        path_out = os.path.join(temp_dir, file_name)
        
        if os.path.exists(path_out):
            try: os.remove(path_out)
            except: pass
        
        OUT = plotter.save(path_out)

    except Exception as e:
        OUT = f"Error: {str(e)}"
else:
    OUT = "No Data"
# ----------------------------------------
file_from_path = FileObject(path=python_script)
readFromFile = Image.ReadFromFile(file=file_from_path)
Image = Output(readFromFile)  # "_Image"
