# Dynamo custom node FeatureScaler.dyf "Feature Scaler" (Dynamo 3.6.1.9895)
# category: Shapely.MachineLearning.PreProcessing
# author: Durmus Bayryam

Data = Input(_Data: var[]..[])
Type = Input(_Type: bool = true)  # MinMaxScaler : True StandardScaler : False
# note: Scaler
python_script = Python(IN[0]=Data, IN[1]=Type)  # CPython3
# ---------- python_script.python (27 lines) ----------
# Copyright(c) 2026
# Durmus Bayryam

import sys
import numpy as np

try:
    from sklearn.preprocessing import StandardScaler, MinMaxScaler
except ImportError as e:
    raise Exception(f"Failed: {e}")

# INPUT
if 'IN' in locals():
    input_data = IN[0]
    method = IN[1]

    data = np.array(input_data, dtype=np.float64)

    # Scaler
    if method == True:
        scaler = MinMaxScaler()
    else:
        scaler = StandardScaler()
    
    # Fit & Transform
    scaled_data = scaler.fit_transform(data)
    OUT = scaled_data, scaler
# ----------------------------------------
code_block = CodeBlock(x=python_script) { x[0]; x[1]; }
Data_2 = Output(code_block.out0)  # "_Data"
Scaler = Output(code_block.out1)  # "_Scaler"
