# Dynamo custom node GaussianMixture.dyf "Gaussian Mixture" (Dynamo 3.6.1.9895)
# category: Shapely.MachineLearning.Model.Clustering
# author: Durmus Bayryam

Data = Input(_Data: var[]..[])
NCluster = Input(_NCluster: int = 3)
python_script = Python(IN[0]=Data, IN[1]=NCluster)  # CPython3
# ---------- python_script.python (32 lines) ----------
# Copyright(c) 2026 
# Durmus Bayryam
# Gaussian Mixture

import sys
import numpy as np

try:
    from sklearn.mixture import GaussianMixture
except ImportError as e:
    raise Exception("Scikit-learn not found.")

# INPUTS
data = IN[0]
n_clusters = IN[1]

if data and len(data) > 0:
    try:
        X = np.array(data)
        
        model = GaussianMixture(n_components=n_clusters, covariance_type='full', random_state=42)
        model.fit(X)
        
        labels = model.predict(X).tolist()
        probs = model.predict_proba(X).tolist()
                
        OUT = [labels, model]
        
    except Exception as e:
        OUT = f"Gaussian Mixture Error: {str(e)}"
else:
    OUT = "No Data"
# ----------------------------------------
code_block = CodeBlock(x=python_script) { x[0]; x[1]; }
Labels = Output(code_block.out0)  # "_Labels"
Model = Output(code_block.out1)  # "_Model"
