# Dynamo custom node IsolationForest.dyf "Isolation Forest" (Dynamo 3.6.1.9895)
# category: Shapely.MachineLearning.Model.Density
# author: Durmus Bayryam

Data = Input(_Data: var[]..[])
python_script = Python(IN[0]=Data)  # CPython3
# ---------- python_script.python (34 lines) ----------
# Copyright(c) 2026
# Durmus Bayryam
# IsolationForest

import sys
import numpy as np

try:
    from sklearn.ensemble import IsolationForest
except ImportError:
    pass

# INPUTS
data = IN[0]
contamination = IN[1] if (len(IN) > 1 and IN[1] is not None) else 'auto'

if data and len(data) > 0:
    try:
        X = np.array(data)
        
        clf = IsolationForest(contamination=contamination, random_state=42)
        clf.fit(X)
        
        # -1: Anomaly
        # 1: Normal
        labels = clf.predict(X).tolist()
        scores = clf.decision_function(X).tolist()
        
        OUT = labels
        
    except Exception as e:
        OUT = f"Error: {str(e)}"
else:
    OUT = "No Data"
# ----------------------------------------
Labels = Output(python_script)  # "_Labels"
