# Dynamo custom node K-Finder.dyf (Dynamo 3.6.1.9895)
# category: Shapely.MachineLearning.Analysis
# author: Durmus Bayryam

Data = Input(_Data: var[]..[])
# note: K-Finder
python_script = Python(IN[0]=Data)  # CPython3
# ---------- python_script.python (52 lines) ----------
# Copyright(c) 2026
# Durmus Bayryam
# K-Finder

import sys
import numpy as np

try:
    from sklearn.cluster import KMeans
except ImportError as e:
    raise Exception(f"Failed: {e}")

def find_optimal_k(data, max_k=10):
    X = np.array(data)
    inertias = []
    k_values = list(range(1, max_k + 1))
    
    for k in k_values:
        model = KMeans(n_clusters=k, random_state=42, n_init='auto')
        model.fit(X)
        inertias.append(model.inertia_)

    x = np.array(k_values)
    y = np.array(inertias)

    x_norm = (x - x.min()) / (x.max() - x.min())
    denom = (y.max() - y.min())
    if denom == 0:
        return 1, k_values, inertias
    y_norm = (y - y.min()) / denom

    p1 = np.array([x_norm[0], y_norm[0]])
    p2 = np.array([x_norm[-1], y_norm[-1]])

    distances = []
    for i in range(len(x_norm)):
        p = np.array([x_norm[i], y_norm[i]])
        distance = np.abs(np.cross(p2 - p1, p1 - p)) / np.linalg.norm(p2 - p1)
        distances.append(distance)

    best_index = np.argmax(distances)
    optimal_k = k_values[best_index]

    return optimal_k


# OUTPUT
if 'IN' in locals():
    data = IN[0]
    max_k = IN[1] if (len(IN) > 1 and IN[1] is not None) else 20
    suggested_k = find_optimal_k(data, max_k)
    OUT = suggested_k
# ----------------------------------------
NCluster = Output(python_script)  # "_NCluster"
