# Dynamo custom node K-Means.dyf "K-means" (Dynamo 3.6.1.9895)
# category: Shapely.MachineLearning.Clustering
# author: Durmus Bayryam

Data = Input(_Data: var[]..[])
NCluster = Input(_NCluster: int = 3)
# note: KMeans
python_script = Python(IN[0]=Data, IN[1]=NCluster)  # CPython3
# ---------- python_script.python (25 lines) ----------
# Copyright(c) 2026 
# Durmus Bayryam

import sys
import clr

import numpy as np
from sklearn.cluster import KMeans

data = IN[0] 
n_clusters = IN[1]

# Processing
X_train = np.array(data)


# Model Fit
model = KMeans(n_clusters=n_clusters, random_state=42, n_init='auto')
model.fit(X_train)
score = model.inertia_

# Predict
labels = model.predict(X_train)

OUT = labels.tolist(), model
# ----------------------------------------
code_block = CodeBlock(x=python_script) { x[0]; x[1]; }
Labels = Output(code_block.out0)  # "_Labels"
Model = Output(code_block.out1)  # "_Model"
