# Dynamo custom node Lasso.dyf "Lasso Regressor" (Dynamo 3.6.1.9895)
# category: Shapely.MachineLearning.Model.Regression
# author: Durmus Bayryam

TrainData = Input(_TrainData: var[]..[])
TrainLabels = Input(_TrainLabels: var[]..[])
TestData = Input(_TestData: var[]..[])
alpha = Input(_alpha: double = 1)  # If alpha is too large → underfitting. If alpha is too small → behaves like ordinary linear regression
python_script = Python(IN[0]=TrainData, IN[1]=TrainLabels, IN[2]=TestData, IN[3]=alpha)  # CPython3
# ---------- python_script.python (61 lines) ----------
# Copyright(c) 2026
# Durmus Bayryam
# Lasso (Linear Model with Feature Selection)

import sys
import numpy as np

try:
    from sklearn.linear_model import Lasso
    from sklearn.preprocessing import StandardScaler
    from sklearn.pipeline import make_pipeline
    from sklearn.model_selection import train_test_split    
except ImportError:
    raise Exception("Scikit-learn not found.")

class ModelContainer:
    def __init__(self, model): self.model = model
    def __repr__(self): return "Lasso Model Object"

# INPUTS
train_x = IN[0]
train_y = IN[1]
test_x = IN[2]
alpha = IN[3]

if train_x and train_y and test_x:
    try:
        x_train = np.array(train_x)
        y_train = np.array(train_y).flatten()
        x_test = np.array(test_x)
        alpha = alpha
        
        if x_test.ndim == 1:
            x_test = x_test.reshape(1, -1)
            
        # Test Split
        X_train, X_val, Y_train, Y_val = train_test_split(
            x_train, y_train, 
            test_size=0.2, 
            shuffle=True, 
            random_state=42
        )
        
        # Model
        model = make_pipeline(StandardScaler(), Lasso(alpha=alpha, random_state=42))
        
        # Fit
        model.fit(X_train, Y_train)
        
        # Prediction
        predictions = model.predict(x_test).tolist()
        
        # Score
        score = model.score(X_val, Y_val)

        OUT = [predictions, ModelContainer(model),score]
        
    except Exception as e:
        OUT = [None, None, f"Error: {str(e)}"]
else:
    OUT = [None, None, "Waiting..."]
# ----------------------------------------
code_block = CodeBlock(x=python_script) { x[0]; x[1]; x[2]; }
Predictions = Output(code_block.out0)  # "_Predictions"
Model = Output(code_block.out1)  # "_Model"
Score = Output(code_block.out2)  # "_Score"
