# Dynamo custom node MAE.dyf "Mean Absolute Error" (Dynamo 3.6.1.9895)
# category: Shapely.MachineLearning.Analysis
# author: Durmus Bayryam

TrueValeur = Input(_TrueValeur: var[]..[])
Prediction = Input(_Prediction: var[]..[])
python_script = Python(IN[0]=TrueValeur, IN[1]=Prediction)  # CPython3
# ---------- python_script.python (29 lines) ----------
# Copyright(c) 2026
# Durmus Bayryam
# Mean Absolute Error

import sys
import numpy as np

try:
    from sklearn.metrics import mean_absolute_error
except ImportError:
    pass

# INPUTS
y_true = IN[0]
y_pred = IN[1]

if y_true and y_pred:
    try:
        true_arr = np.array(y_true).flatten()
        pred_arr = np.array(y_pred).flatten()
                
        mae = round(mean_absolute_error(true_arr, pred_arr), 2)
        
        OUT = mae
        
    except Exception as e:
        OUT = [0, 0, 0, f"Error: {str(e)}"]
else:
    OUT = [0, 0, 0, "No Data"]
# ----------------------------------------
PredictionError = Output(python_script)  # "_PredictionError"
