# Dynamo custom node Model → Loader.dyf "Model → Load" (Dynamo 3.6.1.9895)
# category: Shapely.MachineLearning.Serialization
# author: Durmus Bayryam

FilePath = Input(_FilePath: var[]..[])
# note: Model Loader
python_script = Python(IN[0]=FilePath)  # CPython3
# ---------- python_script.python (39 lines) ----------
# Copyright(c) 2026
# Durmus Bayryam

import sys
import os

try:
    import joblib
except ImportError as e:
    raise Exception(f"Failed: {e}")

# INPUT
file_path = IN[0]

loaded_model = None
loaded_scaler = None
loaded_encoder = None
result = ""

if file_path is None or not os.path.exists(file_path):
    result = "Error: File not found."
else:
    try:
        bundle = joblib.load(file_path)
        
        if isinstance(bundle, dict):
            loaded_model = bundle.get("model_object")
            loaded_scaler = bundle.get("scaler_object")
            loaded_encoder = bundle.get("encoder_object")
            result = "Model Loaded successfully."
        else:
            loaded_model = bundle
            result = "Warning: Only Model loaded (No Scaler/Encoder found)."

    except Exception as e:
        result = f"Load Error: {str(e)}"

# OUTPUT
OUT = [loaded_model, loaded_scaler, loaded_encoder, result]
# ----------------------------------------
code_block = CodeBlock(x=python_script) { x[0]; x[1]; x[2]; x[3]; }
Model = Output(code_block.out0)  # "_Model"
Scaler = Output(code_block.out1)  # "_Scaler"
Encoder = Output(code_block.out2)  # "_Encoder"
Msg = Output(code_block.out3)  # "_Msg"
