# Dynamo custom node Model → Predict.dyf (Dynamo 3.6.1.9895)
# category: Shapely.MachineLearning.Serialization
# author: Durmus Bayryam

Model = Input(_Model: var[]..[])
TestData = Input(_TestData: var[]..[])
python_script = Python(IN[0]=Model, IN[1]=TestData)  # CPython3
# ---------- python_script.python (70 lines) ----------
# Copyright(c) 2026
# Durmus Bayryam

import sys
import numpy as np

# INPUT
input_object = IN[0]
raw_data = IN[1]

predictions = []
decoded_labels = []
msg = ""

if input_object and raw_data:
    try:
        model = None
        scaler = None
        encoder = None

        if isinstance(input_object, dict):
            model = input_object.get("model_object")
            scaler = input_object.get("scaler_object")
            encoder = input_object.get("encoder_object")
        
        else:
            model = input_object
            scaler = None
            encoder = None

        # ModelContainer
        if hasattr(model, 'model'):
            model = model.model

        X = np.array(raw_data)
        if X.ndim == 1:
            X = X.reshape(1, -1)
            
        # Scaler
        if scaler:
            try:
                X = scaler.transform(X)
            except Exception as e:
                msg += f"Scaler Warning: {str(e)}. Using raw data. "

        # Predict
        if hasattr(model, 'predict'):
            predictions = model.predict(X).tolist()

            # Decoding
            decoded_labels = predictions
            
            if encoder:
                try:
                    if hasattr(encoder, 'inverse_transform'):
                        decoded_labels = encoder.inverse_transform(predictions).tolist()
                except:
                    pass
            
            msg += "Prediction Successful."
        else:
             msg = "Error: Input is not a valid Scikit-learn model."
        
        # OUTPUT
        OUT = [decoded_labels, msg]

    except Exception as e:
        OUT = [None, None, None, f"Critical Error: {str(e)}"]
else:
    OUT = [None, None, None, "Waiting for Input..."]
# ----------------------------------------
code_block = CodeBlock(x=python_script) { x[0]; x[1]; }
Predictions = Output(code_block.out0)  # "_Predictions"
Msg = Output(code_block.out1)  # "_Msg"
