# Dynamo custom node Model → Saver.dyf "Model → Save" (Dynamo 3.6.1.9895)
# category: Shapely.MachineLearning.Serialization
# author: Durmus Bayryam

Model = Input(_Model: var[]..[])
Scaler = Input(_Scaler: var = "Auto")
Encoder = Input(_Encoder: var = "Auto")
DirectoryPath = Input(_DirectoryPath: var[]..[])
# note: Model Saver
python_script = Python(IN[0]=Model, IN[1]=Scaler, IN[2]=Encoder, IN[3]=DirectoryPath)  # CPython3
# ---------- python_script.python (63 lines) ----------
# Copyright(c) 2026
# Durmus Bayryam
# Model Saver

import sys
import os

try:
    import joblib
except ImportError:
    import pickle as joblib

# Input
model_input = IN[0]
scaler_input = IN[1]
encoder_input = IN[2]
raw_path = IN[3]

result = ""
model_to_save = None

if hasattr(model_input, 'model'):
    model_to_save = model_input.model
else:
    model_to_save = model_input

if model_to_save is None:
    result = "Error: Model input is Null."
elif raw_path is None or raw_path == "":
    result = "Error: Invalid File Path."
else:
    try:
        file_path = os.path.normpath(raw_path)
        
        if os.path.isdir(file_path):
            file_path = os.path.join(file_path, "trained_model.pkl")
        elif not os.path.splitext(file_path)[1]:
             file_path += ".pkl"
             
        folder = os.path.dirname(file_path)
        if folder and not os.path.exists(folder):
            os.makedirs(folder)

        bundle = {
            "model_object": model_to_save,   
            "scaler_object": scaler_input,   
            "encoder_object": encoder_input, 
            "meta_data": "Created with ML Package v1.0"
        }

        joblib.dump(bundle, file_path)
        
        saved_components = ["Model"]
        if scaler_input: saved_components.append("Scaler")
        if encoder_input: saved_components.append("Encoder")
        
        result = f"Success! Saved ({', '.join(saved_components)}) to: {file_path}"

    except Exception as e:
        result = f"Save Error: {str(e)}"

# OUTPUT
OUT = result
# ----------------------------------------
Msg = Output(python_script)  # "_Msg"
