# Dynamo custom node PrincipalComponentAnalysis.dyf "PCA" (Dynamo 3.6.1.9895)
# category: Shapely.MachineLearning.Analysis
# author: Durmus Bayryam

Data = Input(_Data: var[]..[])
Type = Input(_Type: bool = true)  # MinMaxScaler : True StandardScaler : False
# note: PCA
python_script = Python(IN[0]=Data, IN[1]=Type)  # CPython3
# ---------- python_script.python (197 lines) ----------
# Copyright(c) 2026
# Durmus Bayryam
# PCA Analysis

import sys
import numpy as np
import tempfile
import os
import clr

clr.AddReference('System.Drawing')
from System.Drawing import Bitmap, Graphics, Color, Pen, SolidBrush, Font, FontFamily, StringFormat, StringAlignment
from System.Drawing.Imaging import ImageFormat

try:
    from sklearn.decomposition import PCA
    from sklearn.preprocessing import StandardScaler, MinMaxScaler
except ImportError:
    raise Exception("Sklearn libraries not found.")

# Plotter
class NativeDashboard:
    def __init__(self, width=1200, height=600):
        self.width = width
        self.height = height
        self.bmp = Bitmap(width, height)
        self.g = Graphics.FromImage(self.bmp)
        self.g.Clear(Color.White)
        self.g.SmoothingMode = 2 
        
        self.font_title = Font(FontFamily.GenericSansSerif, 12, 1) 
        self.font_label = Font(FontFamily.GenericSansSerif, 9)
        self.pen_axis = Pen(Color.Black, 2)
        self.pen_grid = Pen(Color.LightGray, 1)
        self.pen_grid.DashStyle = 2 # Dash Line
        self.brush_text = SolidBrush(Color.Black)
        
        self.fmt_center = StringFormat()
        self.fmt_center.Alignment = StringAlignment.Center
        self.fmt_center.LineAlignment = StringAlignment.Center

    def _map(self, val, src_min, src_max, dst_min, dst_max):
        if src_max == src_min: return dst_min
        return (val - src_min) * (dst_max - dst_min) / (src_max - src_min) + dst_min

    def draw_scatter_panel(self, x_data, y_data, title, xlabel, ylabel, rect):
        # Scatter Plot
        rx, ry, rw, rh = rect
        pad = 60
        
        # Cizim Alani
        plot_x = rx + pad
        plot_y = ry + pad
        plot_w = rw - (2 * pad)
        plot_h = rh - (2 * pad)
        
        # Data
        x_min, x_max = min(x_data), max(x_data)
        y_min, y_max = min(y_data), max(y_data)
        
        # Margin
        x_span = x_max - x_min if x_max != x_min else 1.0
        y_span = y_max - y_min if y_max != y_min else 1.0
        x_min -= x_span * 0.1; x_max += x_span * 0.1
        y_min -= y_span * 0.1; y_max += y_span * 0.1
        
        # Chart
        self.g.DrawRectangle(self.pen_axis, plot_x, plot_y, plot_w, plot_h)

        # Point
        brush_pt = SolidBrush(Color.FromArgb(100, 0, 0, 255)) 
        pt_size = 10
        
        for x, y in zip(x_data, y_data):
            px = self._map(x, x_min, x_max, plot_x, plot_x + plot_w)
            py = self._map(y, y_min, y_max, plot_y + plot_h, plot_y)
            self.g.FillEllipse(brush_pt, px - pt_size/2, py - pt_size/2, pt_size, pt_size)
            self.g.DrawEllipse(Pen(Color.Black, 1), px - pt_size/2, py - pt_size/2, pt_size, pt_size)

        # Legend
        self.g.DrawString(title, self.font_title, self.brush_text, rx + rw/2, ry + 40, self.fmt_center)

    def draw_bar_panel(self, values, title, xlabel, ylabel, rect):
        # Bar Chart
        rx, ry, rw, rh = rect
        pad = 60
        
        plot_x = rx + pad 
        plot_y = ry + pad
        plot_w = rw - (1.2 * pad)
        plot_h = rh - (2 * pad)
        
        count = len(values)
        max_val = max(values) * 1.1
        
        # Chart
        bar_width = (plot_w / count) * 0.5
        gap = (plot_w / count) * 1
        
        brush_bar = SolidBrush(Color.FromArgb(150, 0, 0, 255))
        
        for i, val in enumerate(values):
            # X
            px = plot_x + (i * (plot_w / count)) + (gap / 2)
            
            # Y
            bar_h = self._map(val, 0, max_val, 0, plot_h)
            py = (plot_y + plot_h) - bar_h
            
            # Bar
            self.g.FillRectangle(brush_bar, px, py, bar_width, bar_h)
            self.g.DrawRectangle(Pen(Color.Black, 2), px, py, bar_width, bar_h)
            
            # %label
            txt = f"{val:.1f}%"
            self.g.DrawString(txt, self.font_label, self.brush_text, px + bar_width/2, py - 20, self.fmt_center)
            
            # (PC1, PC2...)
            self.g.DrawString(str(i+1), self.font_label, self.brush_text, px + bar_width/2, plot_y + plot_h + 20, self.fmt_center)

        # Legend
        self.g.DrawString(title, self.font_title, self.brush_text, rx + rw/1.5, ry + 40, self.fmt_center)


    def save(self, path):
        self.bmp.Save(path, ImageFormat.Png)
        self.g.Dispose()
        self.bmp.Dispose()
        return path

# Base
def visualize_pca_dashboard(data, n_components=2, use_minmax=True):
    X = np.array(data)
    
    # 1. Scaler
    if use_minmax:
        scaler = MinMaxScaler()
    else:
        scaler = StandardScaler()
        
    X_scaled = scaler.fit_transform(X)
    
    # 2. PCA
    pca = PCA(n_components=n_components)
    principal_components = pca.fit_transform(X_scaled)
    
    explained_variance_ratio = pca.explained_variance_ratio_
    total_variance = np.sum(explained_variance_ratio) * 100
    
    # Visualization
    dash = NativeDashboard(1200, 600)
    
    # Panel
    dash.draw_scatter_panel(
        x_data=principal_components[:, 0],
        y_data=principal_components[:, 1],
        title=f"PCA Projection (Total: {total_variance:.1f}%)",
        xlabel=f"PC 1 ({explained_variance_ratio[0]*100:.1f}%)",
        ylabel=f"PC 2 ({explained_variance_ratio[1]*100:.1f}%)",
        rect=(0, 0, 950, 600)
    )
    
    # Bar
    dash.draw_bar_panel(
        values=explained_variance_ratio * 100,
        title="Explained Variance",
        xlabel="Principal Components",
        ylabel="Variance (%)",
        rect=(800, 0, 400, 600)
    )
    
    # 4. Save
    temp_dir = tempfile.gettempdir()
    file_name = "PCA_Analysis.png"
    path_out = os.path.join(temp_dir, file_name)
    
    if os.path.exists(path_out):
        try: os.remove(path_out)
        except: pass
            
    dash.save(path_out)
    
    return path_out, total_variance, principal_components

# OUTPUT
if 'IN' in locals():
    raw_data = IN[0]
    valiable_scaler = IN[1]
    
    if raw_data:
        try:
            image_path, variance_score, pca_data = visualize_pca_dashboard(raw_data, n_components=3, use_minmax=valiable_scaler)
            OUT = [image_path, pca_data, variance_score]
        except Exception as e:
            OUT = [f"Error: {str(e)}", None, None]
    else:
        OUT = ["No Data", None, None]
# ----------------------------------------
code_block = CodeBlock(x=python_script) { x[0]; x[1]; x[2]; }
file_from_path = FileObject(path=code_block.out0)
readFromFile = Image.ReadFromFile(file=file_from_path)
Image = Output(readFromFile)  # "_Image"
Analysis = Output(code_block.out1)  # "_Analysis"
Score = Output(code_block.out2)  # "_Score"
