# Dynamo custom node RandomForestClassifier.dyf "Random Forest Classifier" (Dynamo 3.6.1.9895)
# category: Shapely.MachineLearning.Model.Classifier
# author: Durmus Bayryam

TrainData = Input(_TrainData: var[]..[])
TrainLabels = Input(_TrainLabels: var[]..[])
TestData = Input(_TestData: var[]..[])
python_script = Python(IN[0]=TrainData, IN[1]=TrainLabels, IN[2]=TestData)  # CPython3
# ---------- python_script.python (65 lines) ----------
# Copyright(c) 2026
# Durmus Bayryam
# Random Forest Classifier

import sys
import numpy as np

try:
    from sklearn.ensemble import RandomForestClassifier
    from sklearn.model_selection import train_test_split        
except ImportError:
    raise Exception("Scikit-learn not found.")

class ModelContainer:
    def __init__(self, model):
        self.model = model
    
    def __repr__(self):
        return "RandomForestClassifier Object"

# INPUTS
train_x = IN[0]
train_y = IN[1]
test_x = IN[2]

if train_x and train_y and test_x:
    try:
        x_train = np.array(train_x)
        y_train = np.array(train_y).flatten()
        x_test = np.array(test_x)
        n_trees = 100
        
        if x_test.ndim == 1:
            x_test = x_test.reshape(1, -1)
            
        # Test Split
        X_train, X_val, Y_train, Y_val = train_test_split(
            x_train, y_train, 
            test_size=0.2, 
            shuffle=True, 
            random_state=42
        )        
        
        # Model
        model = RandomForestClassifier(n_estimators=n_trees, random_state=42)
        
        # Fit
        model.fit(X_train, Y_train)
        
        # Prediction
        predictions = model.predict(x_test).tolist()
        
        # Score
        probs = model.predict_proba(x_test)
        score = [max(p) for p in probs]
                
        # OUTPUT
        wrapped_model = ModelContainer(model)
        
        OUT = [predictions, wrapped_model, score]

    except Exception as e:
        OUT = [None, None, None, f"Error: {str(e)}"]
else:
    OUT = [None, None, None, "Waiting for Data..."]
# ----------------------------------------
code_block = CodeBlock(x=python_script) { x[0]; x[1]; x[2]; }
Predictions = Output(code_block.out0)  # "_Predictions"
Model = Output(code_block.out1)  # "_Model"
Score = Output(code_block.out2)  # "_Score"
