# Dynamo custom node SVR.dyf "Support Vector Regression" (Dynamo 3.6.1.9895)
# category: Shapely.MachineLearning.Model.Regression
# author: Durmus Bayryam

TrainData = Input(_TrainData: var[]..[])
TrainLabels = Input(_TrainLabels: var[]..[])
TestData = Input(_TestData: var[]..[])
kernel = Input(_kernel: var = "rbf")  # linear = Behaves like linear regression rbf = Captures non-linear patterns poly = Curved relationships
python_script = Python(IN[0]=TrainData, IN[1]=TrainLabels, IN[2]=TestData, IN[3]=kernel)  # CPython3
# ---------- python_script.python (61 lines) ----------
# Copyright(c) 2026
# Durmus Bayryam
# SVR (Support Vector Regression)

import sys
import numpy as np

try:
    from sklearn.model_selection import train_test_split
    from sklearn.preprocessing import StandardScaler
    from sklearn.pipeline import make_pipeline
    from sklearn.svm import SVR
except ImportError:
    raise Exception("Scikit-learn not found.")

class ModelContainer:
    def __init__(self, model): self.model = model
    def __repr__(self): return "SVR Model Object"

# INPUTS
train_x = IN[0]
train_y = IN[1]
test_x = IN[2]
kernel = IN[3]

if train_x and train_y and test_x:
    try:
        x_train = np.array(train_x)
        y_train = np.array(train_y).flatten()
        x_test = np.array(test_x)
        kernel = kernel
        
        if x_test.ndim == 1:
            x_test = x_test.reshape(1, -1)
        
        # Test Split
        X_train, X_val, Y_train, Y_val = train_test_split(
            x_train, y_train, 
            test_size=0.2, 
            shuffle=True, 
            random_state=42
        )
        
        # Model
        model = make_pipeline(StandardScaler(),SVR(kernel=kernel, C=1.0, epsilon=0.1))
        
        # Fit
        model.fit(X_train, Y_train)
        
        # Prediction
        predictions = model.predict(x_test).tolist()
        
        # Score
        score = model.score(X_val, Y_val)

        OUT = [predictions, ModelContainer(model),score]
        
    except Exception as e:
        OUT = [None, None, f"Error: {str(e)}"]
else:
    OUT = [None, None, "Waiting..."]
# ----------------------------------------
code_block = CodeBlock(x=python_script) { x[0]; x[1]; x[2]; }
Predictions = Output(code_block.out0)  # "_Predictions"
Model = Output(code_block.out1)  # "_Model"
Score = Output(code_block.out2)  # "_Score"
