# Dynamo custom node Shapely → Numpy.dyf (Dynamo 3.4.1.7055)
# category: Shapely.Geometry.Conversion
# author: Durmus Bayryam
# Converts Shapely geometry to Numpy standards.

ShpGeometry = Input(_ShpGeometry: var[]..[])
python_script = Python(IN[0]=ShpGeometry)  # CPython3
# ---------- python_script.python (108 lines) ----------
# Shapely 2.0.1
# Durmus Bayryam
import numpy as np

try:
    from shapely.geometry import Point as ShpPoint
    from shapely.geometry import LineString as ShpLineString
    from shapely.geometry import Polygon as ShpPolygon
    from shapely.geometry import LinearRing as ShpLinearRing
    from shapely.geometry import MultiPoint as ShpMultiPoint
    from shapely.geometry import MultiLineString as ShpMultiLineString
    from shapely.geometry import MultiPolygon as ShpMultiPolygon
    from shapely.geometry.base import BaseGeometry
except ImportError:
    print("\n Please install Shapely and Numpy package!")
    pass

def ensure_3d_coords(coords_tuple):
    if len(coords_tuple) == 2:
        return [coords_tuple[0], coords_tuple[1], 0.0]
    elif len(coords_tuple) >= 3:
        return [coords_tuple[0], coords_tuple[1], coords_tuple[2]]
    return [0.0, 0.0, 0.0] 


def shapely_point_to_numpy(shp_point):
    # ShpPoint -> np.array([x, y, z])
    if not isinstance(shp_point, ShpPoint): return None
    if shp_point.is_empty: return np.array([])
    
    return np.array(ensure_3d_coords(shp_point.coords[0]))

def shapely_linestring_to_numpy(shp_linestring):
    if not isinstance(shp_linestring, ShpLineString): return None
    if shp_linestring.is_empty: return np.array([])
    
    coords_3d = [ensure_3d_coords(c) for c in shp_linestring.coords]
    return np.array(coords_3d)

def shapely_linearring_to_numpy(shp_ring):
    if not isinstance(shp_ring, ShpLinearRing): return None
    coords_3d = [ensure_3d_coords(c) for c in shp_ring.coords]
    return np.array(coords_3d)

def shapely_multipoint_to_numpy(shp_multipoint):
    # ShpMultiPoint -> np.array([[x1,y1,z1], ...])
    if not isinstance(shp_multipoint, ShpMultiPoint): return None
    if shp_multipoint.is_empty: return np.array([])

    coords_list = []
    for pt in shp_multipoint.geoms:
        coords_list.append(ensure_3d_coords(pt.coords[0]))
    
    return np.array(coords_list)

def shapely_multilinestring_to_numpy(shp_multilinestring):
    if not isinstance(shp_multilinestring, ShpMultiLineString): return None
    return [shapely_linestring_to_numpy(ls) for ls in shp_multilinestring.geoms]

def shapely_polygon_to_numpy(shp_polygon, include_holes=True):
    if not isinstance(shp_polygon, ShpPolygon): return None
    
    # Exterior
    ext_list = [ensure_3d_coords(c) for c in shp_polygon.exterior.coords]
    exterior_coords = np.array(ext_list)
    
    if not include_holes or len(shp_polygon.interiors) == 0:
        return exterior_coords
    
    interior_arrays = []
    for interior in shp_polygon.interiors:
        int_list = [ensure_3d_coords(c) for c in interior.coords]
        interior_arrays.append(np.array(int_list))
    
    return {
        'exterior': exterior_coords,
        'interiors': interior_arrays
    }

def shapely_multipolygon_to_numpy(shp_multipolygon, include_holes=True):
    if not isinstance(shp_multipolygon, ShpMultiPolygon): return None
    return [shapely_polygon_to_numpy(poly, include_holes) for poly in shp_multipolygon.geoms]

def convert_shapely_to_numpy(shapely_geometry, include_holes=True):
    if isinstance(shapely_geometry, list):
        return [convert_shapely_to_numpy(item, include_holes) for item in shapely_geometry]
    
    if isinstance(shapely_geometry, ShpPoint):
        return shapely_point_to_numpy(shapely_geometry)
    elif isinstance(shapely_geometry, ShpLinearRing):
        return shapely_linearring_to_numpy(shapely_geometry)
    elif isinstance(shapely_geometry, ShpLineString):
        return shapely_linestring_to_numpy(shapely_geometry)
    elif isinstance(shapely_geometry, ShpPolygon):
        return shapely_polygon_to_numpy(shapely_geometry, include_holes)
    elif isinstance(shapely_geometry, ShpMultiPoint):
        return shapely_multipoint_to_numpy(shapely_geometry)
    elif isinstance(shapely_geometry, ShpMultiLineString):
        return shapely_multilinestring_to_numpy(shapely_geometry)
    elif isinstance(shapely_geometry, ShpMultiPolygon):
        return shapely_multipolygon_to_numpy(shapely_geometry, include_holes)
    else:
        return None

if 'IN' in locals():
    dynamo_input = IN[0] 
    shapely_output = convert_shapely_to_numpy(dynamo_input)
    OUT = shapely_output
# ----------------------------------------
Numpy = Output(python_script)  # "_Numpy"
