# Dynamo custom node Shp_Area.dyf (Dynamo 3.4.1.7055)
# category: Shapely.Geometry.Operation
# author: Durmus Bayryam
# Calculates the area of a polygon. This operation is used to perform area analyses.

ShpGeometry = Input(_ShpGeometry: var[]..[])
python_script = Python(IN[0]=ShpGeometry)  # CPython3
# ---------- python_script.python (123 lines) ----------
# Shapely 2.0.1
# Durmus Bayryam
import clr

try:
    from shapely.geometry import Point as ShpPoint
    from shapely.geometry import LineString as ShpLineString
    from shapely.geometry import Polygon as ShpPolygon
    from shapely.geometry import LinearRing as ShpLinearRing
    from shapely.geometry import MultiPoint as ShpMultiPoint
    from shapely.geometry import MultiLineString as ShpMultiLineString
    from shapely.geometry import MultiPolygon as ShpMultiPolygon
    from shapely.geometry.base import BaseGeometry
except ImportError:
    print("\n Please install Shapely package!")
    pass

def shapely_point_area(shp_point):
    # ShpPoint → Area 
    
    if not isinstance(shp_point, ShpPoint):
        return None
    return 0.0

def shapely_linestring_area(shp_linestring):
    # ShpLineString → Area = 0
    
    if not isinstance(shp_linestring, ShpLineString):
        return None
    return 0.0

def shapely_linearring_area(shp_ring):
    # ShpLinearRing → Area 
    
    if not isinstance(shp_ring, ShpLinearRing):
        return None
    
    try:
        temp_polygon = ShpPolygon(shp_ring)
        return abs(temp_polygon.area)
    except:
        return None

def shapely_polygon_area(shp_polygon):
    # ShpPolygon → Area 
    
    if not isinstance(shp_polygon, ShpPolygon):
        return None
    
    return abs(shp_polygon.area)

def shapely_multipoint_area(shp_multipoint):
    # ShpMultiPoint → Area 
    
    if not isinstance(shp_multipoint, ShpMultiPoint):
        return None
    return 0.0

def shapely_multilinestring_area(shp_multilinestring):
    # ShpMultiLineString → Area
    
    if not isinstance(shp_multilinestring, ShpMultiLineString):
        return None
    return 0.0

def shapely_multipolygon_area(shp_multipolygon, return_total=True):
    # ShpMultiPolygon → Area
    
    if not isinstance(shp_multipolygon, ShpMultiPolygon):
        return None
    
    if return_total:
        return abs(shp_multipolygon.area)
    else:
        return [abs(poly.area) for poly in shp_multipolygon.geoms]

def get_shapely_area(shapely_geometry, return_individual=False):
    
    if isinstance(shapely_geometry, list):
        return [get_shapely_area(item, return_individual) for item in shapely_geometry]
    
    # Point
    if isinstance(shapely_geometry, ShpPoint):
        return shapely_point_area(shapely_geometry)
    
    # LinearRing
    elif isinstance(shapely_geometry, ShpLinearRing):
        return shapely_linearring_area(shapely_geometry)
    
    # LineString
    elif isinstance(shapely_geometry, ShpLineString):
        return shapely_linestring_area(shapely_geometry)
    
    # Polygon
    elif isinstance(shapely_geometry, ShpPolygon):
        return shapely_polygon_area(shapely_geometry)
    
    # MultiPoint
    elif isinstance(shapely_geometry, ShpMultiPoint):
        return shapely_multipoint_area(shapely_geometry)
    
    # MultiLineString
    elif isinstance(shapely_geometry, ShpMultiLineString):
        return shapely_multilinestring_area(shapely_geometry)
    
    # MultiPolygon
    elif isinstance(shapely_geometry, ShpMultiPolygon):
        return shapely_multipolygon_area(shapely_geometry, not return_individual)
    
    # BaseGeometry
    elif isinstance(shapely_geometry, BaseGeometry):
        return abs(shapely_geometry.area)
    
    else:
        return None

if 'IN' in locals():
    shapely_input = IN[0]
    return_individual = IN[1] if len(IN) > 1 else False
    
    area_output = get_shapely_area(shapely_input, return_individual)
    
    OUT = area_output
# ----------------------------------------
Area = Output(python_script)  # "_Area"
