# Dynamo custom node Shp_Boundary.dyf (Dynamo 3.4.1.7055)
# category: Shapely.Geometry.Operation
# author: Durmus Bayryam
# It provides the edges that define a geometry. For polygons, this function returns a line representing the boundaries of the geometry.

ShpGeometry = Input(_ShpGeometry: var[]..[])
python_script = Python(IN[0]=ShpGeometry)  # CPython3
# ---------- python_script.python (133 lines) ----------
# Shapely 2.0.1
# Durmus Bayryam
import clr

try:
    from shapely.geometry import Point as ShpPoint
    from shapely.geometry import LineString as ShpLineString
    from shapely.geometry import Polygon as ShpPolygon
    from shapely.geometry import LinearRing as ShpLinearRing
    from shapely.geometry import MultiPoint as ShpMultiPoint
    from shapely.geometry import MultiLineString as ShpMultiLineString
    from shapely.geometry import MultiPolygon as ShpMultiPolygon
    from shapely.geometry.base import BaseGeometry
    from shapely import GeometryCollection as ShpGeometryCollection
except ImportError:
    print("\n Please install Shapely package!")
    pass

def shapely_point_boundary(shp_point):
    # ShpPoint → Boundary 
    
    if not isinstance(shp_point, ShpPoint):
        return None
    return shp_point.boundary

def shapely_linestring_boundary(shp_linestring):
    # ShpLineString → Boundary 
    
    if not isinstance(shp_linestring, ShpLineString):
        return None
    return shp_linestring.boundary

def shapely_linearring_boundary(shp_ring):
    # ShpLinearRing → Boundary 
    
    if not isinstance(shp_ring, ShpLinearRing):
        return None
    return shp_ring.boundary

def shapely_polygon_boundary(shp_polygon):
    # ShpPolygon → Boundary = LinearRing 
    
    if not isinstance(shp_polygon, ShpPolygon):
        return None
    return shp_polygon.boundary

def shapely_multipoint_boundary(shp_multipoint):
    # ShpMultiPoint → Boundary 
    
    if not isinstance(shp_multipoint, ShpMultiPoint):
        return None
    return shp_multipoint.boundary

def shapely_multilinestring_boundary(shp_multilinestring):
    # ShpMultiLineString → Boundary 
    
    if not isinstance(shp_multilinestring, ShpMultiLineString):
        return None
    return shp_multilinestring.boundary

def shapely_multipolygon_boundary(shp_multipolygon, return_individual=False):
    # ShpMultiPolygon → Boundary
    
    if not isinstance(shp_multipolygon, ShpMultiPolygon):
        return None
    
    if return_individual:
        return [poly.boundary for poly in shp_multipolygon.geoms]
    else:
        return shp_multipolygon.boundary

def shapely_geometrycollection_boundary(shp_gc, return_individual=False):
    # ShpGeometryCollection -> Boundary
    
    if not isinstance(shp_gc, ShpGeometryCollection):
        return None
        
    if return_individual:
        return [get_shapely_boundary(geom, return_individual) for geom in shp_gc.geoms]
    else:
        return shp_gc.boundary

def get_shapely_boundary(shapely_geometry, return_individual=False):
    
    if isinstance(shapely_geometry, list):
        return [get_shapely_boundary(item, return_individual) for item in shapely_geometry]
    
    # Point
    if isinstance(shapely_geometry, ShpPoint):
        return shapely_point_boundary(shapely_geometry)
    
    # LinearRing
    elif isinstance(shapely_geometry, ShpLinearRing):
        return shapely_linearring_boundary(shapely_geometry)
    
    # LineString
    elif isinstance(shapely_geometry, ShpLineString):
        return shapely_linestring_boundary(shapely_geometry)
    
    # Polygon
    elif isinstance(shapely_geometry, ShpPolygon):
        return shapely_polygon_boundary(shapely_geometry)
    
    # MultiPoint
    elif isinstance(shapely_geometry, ShpMultiPoint):
        return shapely_multipoint_boundary(shapely_geometry)
    
    # MultiLineString
    elif isinstance(shapely_geometry, ShpMultiLineString):
        return shapely_multilinestring_boundary(shapely_geometry)
    
    # MultiPolygon
    elif isinstance(shapely_geometry, ShpMultiPolygon):
        return shapely_multipolygon_boundary(shapely_geometry, return_individual)
        
    # GeometryCollection
    elif isinstance(shapely_geometry, ShpGeometryCollection):
        return shapely_geometrycollection_boundary(shapely_geometry, return_individual)
    
    # Genel BaseGeometry
    elif isinstance(shapely_geometry, BaseGeometry):
        return shapely_geometry.boundary
    
    else:
        return None

if 'IN' in locals():
    shapely_input = IN[0]
    return_individual = IN[1] if len(IN) > 1 else False
    
    boundary_output = get_shapely_boundary(shapely_input, return_individual)
    
    OUT = boundary_output
# ----------------------------------------
ShpGeometry_2 = Output(python_script)  # "_ShpGeometry"
