# Dynamo custom node Shp_BuildBoundary.dyf (Dynamo 3.4.1.7055)
# category: Shapely.Geometry.Operation
# author: Durmus Bayryam
# Creates a geometry that defines the area surrounding it. This process is used to define the area covered by the geometry.

ShpGeometry = Input(_ShpGeometry: var[]..[])
python_script = Python(IN[0]=ShpGeometry)  # CPython3
# ---------- python_script.python (56 lines) ----------
# Shapely 2.0.1
# Durmus Bayram
import clr

try:
    from shapely.geometry import GeometryCollection, Polygon, LineString, LinearRing, MultiPolygon, MultiLineString, MultiPoint
    from shapely.geometry.base import BaseGeometry
    from shapely import build_area, make_valid
except ImportError:
    print("\n Please install Shapely package!")
    pass

def safe_build_area(geoms):
    try:
        if not isinstance(geoms, list):
            geoms = [geoms]
        
        processed_geoms = []
        for g in geoms:
            if not isinstance(g, BaseGeometry): continue
            
            if not g.is_valid:
                g = make_valid(g)
            
            if isinstance(g, (Polygon, MultiPolygon)):
                processed_geoms.append(g.boundary)
            else:
                processed_geoms.append(g)
            
        if not processed_geoms:
            return None
            
        collection = GeometryCollection(processed_geoms)
        result = build_area(collection)
        
        if (result is None or result.is_empty) and len(geoms) == 1:
            return geoms[0]
            
        return result if not result.is_empty else None
    except:
        return None

def get_shapely_buildarea(input_data):
    if not isinstance(input_data, list):
        return safe_build_area(input_data)

    if len(input_data) > 0 and isinstance(input_data[0], list):
        return [get_shapely_buildarea(item) for item in input_data]
    
    return safe_build_area(input_data)

if 'IN' in locals():
    shp_input = IN[0]
    
    output = get_shapely_buildarea(shp_input)
    OUT = output
# ----------------------------------------
ShpGeometry_2 = Output(python_script)  # "_ShpGeometry"
