# Dynamo custom node Shp_Difference.dyf (Dynamo 3.4.1.7055)
# category: Shapely.Geometry.Modifier
# author: Durmus Bayryam
# It calculates the difference between two geometries. It subtracts the area where the second geometry intersects from the first geometry. This operation is used to see the difference between one geometry and other geometries.

ShpGeometry = Input(_ShpGeometry: var[]..[])
ShpGeometry_2 = Input(_ShpGeometry: var[]..[])
python_script = Python(IN[0]=ShpGeometry, IN[1]=ShpGeometry_2)  # CPython3
# ---------- python_script.python (45 lines) ----------
# Shapely 2.0.1
# Durmus Bayram
import clr

try:
    from shapely.geometry import Point as ShpPoint
    from shapely.geometry import LineString as ShpLineString
    from shapely.geometry import Polygon as ShpPolygon
    from shapely.geometry import MultiPolygon as ShpMultiPolygon
    from shapely.geometry.base import BaseGeometry
    from shapely import difference, unary_union
except ImportError:
    print("\n Please install Shapely package!")
    pass

def safe_difference(geom_a, geom_b):
    if not isinstance(geom_a, BaseGeometry) or not isinstance(geom_b, BaseGeometry):
        return geom_a
    
    return difference(geom_a, geom_b)

def prepare_cutter(geom_b):
    if isinstance(geom_b, list):
        valid_b = [b for b in geom_b if isinstance(b, BaseGeometry)]
        return unary_union(valid_b) if valid_b else None
    return geom_b if isinstance(geom_b, BaseGeometry) else None

def get_shapely_difference(geom_a, cutter):
    
    if isinstance(geom_a, list):
        return [get_shapely_difference(item, cutter) for item in geom_a]
    
    return safe_difference(geom_a, cutter)

if 'IN' in locals():
    input_a = IN[0]
    input_b = IN[1] if len(IN) > 1 else None
    
    prepared_b = prepare_cutter(input_b)
    
    if input_a is not None and prepared_b is not None:
        output = get_shapely_difference(input_a, prepared_b)
    else:
        output = input_a 
    OUT = output
# ----------------------------------------
ShpGeometry_3 = Output(python_script)  # "_ShpGeometry"
