# Dynamo custom node Shp_Intersection.dyf (Dynamo 3.4.1.7055)
# category: Shapely.Geometry.Modifier
# author: Durmus Bayryam
# Rotates the common area between two geometries. The intersecting areas are taken and a new geometry is created. This process is used to determine the intersection areas.

ShpGeometry = Input(_ShpGeometry: var[]..[])
ShpGeometry_2 = Input(_ShpGeometry: var[]..[])
python_script = Python(IN[0]=ShpGeometry, IN[1]=ShpGeometry_2)  # CPython3
# ---------- python_script.python (36 lines) ----------
# Shapely 2.0.1
# Durmus Bayram
import clr

try:
    from shapely.geometry.base import BaseGeometry
    from shapely import intersection

except ImportError:
    print("\n Please install Shapely package!")
    pass

def safe_intersection(g1, g2):
    if isinstance(g1, BaseGeometry) and isinstance(g2, BaseGeometry):
        return intersection(g1, g2)
    return None

def get_shapely_intersection(a, b):
    if isinstance(a, list):
        return [get_shapely_intersection(item, b) for item in a]
    
    if isinstance(b, list):
        return [get_shapely_intersection(a, item) for item in b]
    
    return safe_intersection(a, b)

if 'IN' in locals():
    input_a = IN[0]
    input_b = IN[1] if len(IN) > 1 else None
    
    if input_a is not None and input_b is not None:
        output = get_shapely_intersection(input_a, input_b)
    else:
        output = None

    OUT = output
# ----------------------------------------
ShpGeometry_3 = Output(python_script)  # "_ShpGeometry"
