# Dynamo custom node Shp_Offset.dyf (Dynamo 3.4.1.7055)
# category: Shapely.Geometry.Modifier
# author: Durmus Bayryam
# Creates a new geometry by shifting the boundaries of a geometry by the specified distance. This operation is used to shift the boundaries of polygons inwards or outwards.

ShpGeometry = Input(_ShpGeometry: var[]..[])
Offset = Input(_Offset: var[]..[])
python_script = Python(IN[0]=ShpGeometry, IN[1]=Offset)  # CPython3
# ---------- python_script.python (82 lines) ----------
# Shapely 2.0.1
# Durmus Bayram
import clr

try:
    from shapely.geometry import Point as ShpPoint
    from shapely.geometry import LineString as ShpLineString
    from shapely.geometry import Polygon as ShpPolygon
    from shapely.geometry import LinearRing as ShpLinearRing
    from shapely.geometry import MultiLineString as ShpMultiLineString
    from shapely.geometry import MultiPolygon as ShpMultiPolygon
    from shapely.geometry.base import BaseGeometry
    from shapely.ops import orient
except ImportError:
    print("\n Please install Shapely package!")
    pass

def shapely_logic_offset(geom, distance, resolution=8, join_style=2, mitre_limit=5.0):
    if not isinstance(geom, BaseGeometry):
        return None

    if isinstance(geom, (ShpPolygon, ShpMultiPolygon)):
        return geom.buffer(
            distance,
            quad_segs=resolution,
            join_style=join_style,
            mitre_limit=mitre_limit
        )

    elif isinstance(geom, (ShpLineString, ShpLinearRing, ShpMultiLineString)):
        
        if isinstance(geom, ShpLinearRing):
             geom = orient(geom, sign=1.0)

        
        try:
            
            if distance < 0 or isinstance(geom, ShpLineString): 
                return geom.offset_curve(
                    distance,
                    quad_segs=resolution,
                    join_style=join_style,
                    mitre_limit=mitre_limit
                )
            else:
                return geom.buffer(
                    distance,
                    quad_segs=resolution,
                    join_style=join_style,
                    mitre_limit=mitre_limit
                )

        except Exception as e:
            print("Offset Error: " + str(e))
            return None

    return None

def get_shapely_offset(shapely_geometry, distance, params):
    if isinstance(shapely_geometry, list):
        return [get_shapely_offset(item, distance, params) for item in shapely_geometry]
    
    if isinstance(shapely_geometry, (ShpMultiLineString, ShpMultiPolygon)):
        return [shapely_logic_offset(g, distance, **params) for g in shapely_geometry.geoms]
    
    elif isinstance(shapely_geometry, BaseGeometry):
        return shapely_logic_offset(shapely_geometry, distance, **params)
    
    return None

if 'IN' in locals():
    shp_input = IN[0]
    dist = IN[1] if IN[1] is not None else 0.0
    
    params = {
        "resolution": 8,
        "join_style": 2,
        "mitre_limit": 5.0
    }
    
    offset_output = get_shapely_offset(shp_input, dist, params)
    OUT = offset_output
# ----------------------------------------
ShpGeometry_2 = Output(python_script)  # "_ShpGeometry"
