# Dynamo custom node Shp_Reverse.dyf (Dynamo 3.4.1.7055)
# category: Shapely.Geometry.Operation
# author: Durmus Bayryam
# It reverses the geometry.

ShpGeometry = Input(_ShpGeometry: var[]..[])
python_script = Python(IN[0]=ShpGeometry)  # CPython3
# ---------- python_script.python (52 lines) ----------
# Shapely 2.0.1
# Durmus Bayram
import clr

try:
    from shapely.geometry import Point as ShpPoint
    from shapely.geometry import LineString as ShpLineString
    from shapely.geometry import Polygon as ShpPolygon
    from shapely.geometry import MultiPoint as ShpMultiPoint
    from shapely.geometry import MultiLineString as ShpMultiLineString
    from shapely.geometry import MultiPolygon as ShpMultiPolygon
    from shapely.geometry.base import BaseGeometry
    from shapely.ops import reverse


except ImportError:
    print("\n Please install Shapely package!")
    pass

def shapely_generic_reverse(geom):
    if not isinstance(geom, BaseGeometry):
        return None
    try:
        return geom.reverse()
    except Exception as e:
        return None
    

def get_shapely_reverse(shapely_geometry, return_individual=False):
    
    if isinstance(shapely_geometry, list):
        return [get_shapely_reverse(item, return_individual) for item in shapely_geometry]
    
    if isinstance(shapely_geometry, (ShpMultiPoint, ShpMultiLineString, ShpMultiPolygon)):
        if return_individual:
            return [shapely_generic_reverse(g) for g in shapely_geometry.geoms]
        else:
            return shapely_generic_reverse(shapely_geometry)
    
    elif isinstance(shapely_geometry, BaseGeometry):
        return shapely_generic_reverse(shapely_geometry)
    
    else:
        return None

if 'IN' in locals():
    shp_input = IN[0]
    indiv_mode = IN[1] if len(IN) > 1 else False
    
    rotate_output = get_shapely_reverse(shp_input, indiv_mode)
    
    OUT = rotate_output
# ----------------------------------------
ShpGeometry_2 = Output(python_script)  # "_ShpGeometry"
