# Dynamo custom node Shp_Segmentize.dyf (Dynamo 3.4.1.7055)
# category: Shapely.Geometry.Operation
# author: Durmus Bayryam
# It divides a geometry into smaller segments. This process breaks down the geometry into smaller pieces for more precise analysis and calculations.

ShpGeometry = Input(_ShpGeometry: var[]..[])
NSegment = Input(_NSegment: var[]..[])  # The smaller it is, the more points there are.
python_script = Python(IN[0]=ShpGeometry, IN[1]=NSegment)  # CPython3
# ---------- python_script.python (113 lines) ----------
# Shapely 2.0.1
# Durmus Bayram 

import clr

try:
    from shapely.geometry import Point as ShpPoint
    from shapely.geometry import LineString as ShpLineString
    from shapely.geometry import Polygon as ShpPolygon
    from shapely.geometry import MultiPoint as ShpMultiPoint
    from shapely.geometry import MultiLineString as ShpMultiLineString
    from shapely.geometry import MultiPolygon as ShpMultiPolygon
    from shapely.geometry import GeometryCollection as ShpGeometryCollection
    from shapely.geometry.base import BaseGeometry
    from shapely import segmentize
    from shapely.geometry import LinearRing
except ImportError:
    print("\n Please install Shapely package!")


def segmentize_ring(ring_coords, max_dist):
    if len(ring_coords) < 2:
        return [ShpPoint(c) for c in ring_coords]

    line = ShpLineString(ring_coords)

    segmented_line = segmentize(line, max_segment_length=max_dist)

    points = [ShpPoint(c) for c in segmented_line.coords[:-1]]

    return points


def extract_all_points_fixed(geom, max_dist):
    result = {
        'exterior': [],
        'interiors': [],
        'all': []
    }

    if hasattr(geom, 'geoms'):
        for g in geom.geoms:
            sub_result = extract_all_points_fixed(g, max_dist)
            result['exterior'].extend(sub_result['exterior'])
            result['interiors'].extend(sub_result['interiors'])
            result['all'].extend(sub_result['all'])

    elif isinstance(geom, ShpPolygon):
        exterior_points = segmentize_ring(list(geom.exterior.coords), max_dist)
        result['exterior'] = exterior_points
        result['all'].extend(exterior_points)

        for hole in geom.interiors:
            hole_points = segmentize_ring(list(hole.coords), max_dist)
            result['interiors'].append(hole_points)
            result['all'].extend(hole_points)

    elif isinstance(geom, ShpLineString):
        segmented = segmentize(geom, max_segment_length=max_dist)
        points = [ShpPoint(c) for c in segmented.coords]
        result['all'] = points

    elif hasattr(geom, 'coords'):
        points = [ShpPoint(c) for c in geom.coords]
        result['all'] = points

    return result


def get_shapely_segmentize_points_fixed(shp_input, max_dist, return_separate=True):
    if isinstance(shp_input, list):
        results = []
        for item in shp_input:
            results.append(
                get_shapely_segmentize_points_fixed(item, max_dist, return_separate)
            )
        return results

    if (
        isinstance(shp_input, ShpPoint)
        or not isinstance(shp_input, BaseGeometry)
        or max_dist <= 0
    ):
        if return_separate:
            return [
                ShpMultiPoint([shp_input] if isinstance(shp_input, ShpPoint) else []),
                []
            ]
        return ShpMultiPoint([shp_input] if isinstance(shp_input, ShpPoint) else [])

    result = extract_all_points_fixed(shp_input, max_dist)

    if return_separate:
        exterior_mp = (
            ShpMultiPoint(result['exterior'])
            if result['exterior']
            else ShpMultiPoint([])
        )
        interior_mps = [ShpMultiPoint(hole) for hole in result['interiors']]
        return [exterior_mp, interior_mps]
    else:
        return ShpMultiPoint(result['all'])


if 'IN' in locals():
    shp_input = IN[0]
    max_len = IN[1] if (IN[1] is not None and IN[1] > 0) else 1.0

    return_separate = IN[2] if len(IN) > 2 and IN[2] is not None else False

    result = get_shapely_segmentize_points_fixed(shp_input, max_len, return_separate)

    OUT = result
# ----------------------------------------
ShpPoint = Output(python_script)  # "_ShpPoint"
