# Dynamo custom node SpectralClustering.dyf "Spectral Clustering" (Dynamo 3.6.1.9895)
# category: Shapely.MachineLearning.Model.Clustering
# author: Durmus Bayryam

Data = Input(_Data: var[]..[])
NCluster = Input(_NCluster: int = 3)
python_script = Python(IN[0]=Data, IN[1]=NCluster)  # CPython3
# ---------- python_script.python (50 lines) ----------
# Copyright(c) 2026 
# Durmus Bayryam
# Spectral Clustering

import sys
import numpy as np
import math

try:
    from sklearn.cluster import SpectralClustering
except ImportError as e:
    raise Exception("Scikit-learn not found.")

# INPUTS
data = IN[0]
n_clusters = IN[1]

labels = []
model_info = ""

if data and len(data) > 0:
    try:
        X = np.array(data)
        n_samples = len(X)
        
        # Magic
        calculated_k = int(np.log(n_samples)) + 2 
        
        if n_samples < 2:
            n_neighbors_dynamic = 1
        else:
            n_neighbors_dynamic = max(2, min(calculated_k, n_samples - 1))
            
        # Fit
        model = SpectralClustering(
            n_clusters=n_clusters, 
            affinity='nearest_neighbors',
            n_neighbors=n_neighbors_dynamic, 
            random_state=42,
            n_jobs=-1
        )
        
        labels = model.fit_predict(X).tolist()
        
        OUT = [labels, model]
        
    except Exception as e:
        OUT = f"Spectral Error: {str(e)}"
else:
    OUT = "No Data"
# ----------------------------------------
code_block = CodeBlock(x=python_script) { x[0]; x[1]; }
Labels = Output(code_block.out0)  # "_Labels"
Model = Output(code_block.out1)  # "_Model"
