# Dynamo custom node DynamotoShapely.dyf (Dynamo 2.10.1.3976)
# category: Shapely.Conversion

shpolygon = Input(_shpolygon: var[]..[])
python_script = Python(IN[0]=shpolygon)  # CPython3
# ---------- python_script.python (51 lines) ----------
import sys
import os
import clr

localapp = os.getenv(r'LOCALAPPDATA')
sys.path.append(os.path.join(localapp, r'python-3.8.3-embed-amd64\Lib\site-packages'))
import shapely.geometry as sg
import Autodesk.DesignScript.Geometry as adg
from shapely.testing import assert_geometries_equal
from shapely import normalize, Polygon , BufferCapStyle, BufferJoinStyle


import shapely.geometry as sg
import Autodesk.DesignScript.Geometry as adg

def shapely_to_dynamo(shapely_geometry):
    dynamo_geometry = None
    if isinstance(shapely_geometry, sg.Point):
        points = shapely_geometry.coords
        dynamo_geometry = points
        
    elif isinstance(shapely_geometry, sg.LineString):
        points = list(shapely_geometry.coords)
        dynamo_geometry = points
        
    elif isinstance(shapely_geometry, sg.Polygon):
        exterior_points = list(shapely_geometry.exterior.coords)
        dynamo_geometry = exterior_points
        
    elif isinstance(shapely_geometry, sg.MultiPoint):
        points = shapely_geometry.coords
        dynamo_geometry = points
        
    return dynamo_geometry

if isinstance(IN[0], list):
    shapely_geometries = IN[0]
else:
    shapely_geometries = [IN[0]]

dynamo_geometries = [shapely_to_dynamo(geometry) for geometry in shapely_geometries]

x_cord = []
y_cord = []

for pon in dynamo_geometries[0]:
	
	x_cord.append(pon[0])
	y_cord.append(pon[1])

OUT = x_cord,y_cord
# ----------------------------------------
code_block = CodeBlock(x=python_script) { x[0]; x[1]; }
byCoordinates = Point.ByCoordinates(x=code_block.out0, y=code_block.out1)
byPoints = Polygon.ByPoints(points=byCoordinates)
Polygon = Output(byPoints)  # "_Polygon"
Point = Output(byCoordinates)  # "_Point"
pruneDuplicates = Point.PruneDuplicates(points=byCoordinates)
byPoints_2 = PolyCurve.ByPoints(points=pruneDuplicates)
PolyCurve = Output(byPoints_2)  # "_PolyCurve"
