# Dynamo custom node ShapelyBoundary.dyf (Dynamo 2.10.1.3976)
# category: Shapely.Geometry

shpolygon = Input(_shpolygon: var[]..[])
python_script = Python(IN[0]=shpolygon)  # CPython3
# ---------- python_script.python (20 lines) ----------
import sys
import os
import clr

localapp = os.getenv(r'LOCALAPPDATA')
sys.path.append(os.path.join(localapp, r'python-3.8.3-embed-amd64\Lib\site-packages'))
import shapely.geometry as sg
import Autodesk.DesignScript.Geometry as adg
from shapely import normalize, Polygon , BufferJoinStyle

dynamo_geometry1 = IN[0]
    
if isinstance(IN[0], list):
    dynamo_geometry1 = IN[0]
else:
    dynamo_geometry1 = [IN[0]]
    
center = [geo.boundary for geo in dynamo_geometry1]

OUT = center
# ----------------------------------------
OUT = Output(python_script)
