# Dynamo custom node ShapelyBoundingBox.dyf (Dynamo 2.10.1.3976)
# category: Shapely.Analyse

shgeometry = Input(_shgeometry: var[]..[])
python_script = Python(IN[0]=shgeometry)  # CPython3
# ---------- python_script.python (24 lines) ----------
import sys
import os
import clr

localapp = os.getenv(r'LOCALAPPDATA')
sys.path.append(os.path.join(localapp, r'python-3.8.3-embed-amd64\Lib\site-packages'))

import shapely.geometry as sg
from shapely import normalize, Polygon , oriented_envelope

def spolygon(sp1):

    orien = oriented_envelope(sp1)
    return orien


if isinstance(IN[0], list):
    shapely_polygons1 = IN[0]
else:
    shapely_polygons1 = [IN[0]]

oriented = [spolygon(shp1) for shp1 in shapely_polygons1]

OUT = oriented
# ----------------------------------------
OUT = Output(python_script)
