# Dynamo custom node ShapelyCentroid.dyf (Dynamo 2.10.1.3976)
# category: Shapely.Geometry

shpolygon = Input(_shpolygon: var[]..[])
python_script = Python(IN[0]=shpolygon)  # CPython3
# ---------- python_script.python (23 lines) ----------
import sys
import os
import clr

localapp = os.getenv(r'LOCALAPPDATA')
sys.path.append(os.path.join(localapp, r'python-3.8.3-embed-amd64\Lib\site-packages'))
import shapely.geometry as sg
import Autodesk.DesignScript.Geometry as adg
from shapely import normalize, Polygon , BufferJoinStyle, MultiLineString, LinearRing 
from shapely.ops import polylabel


dynamo_geometry1 = IN[0]
shp = []
def sh1(dynamo_polygon):
    
    shapely_poly = [polylabel(dp,tolerance=1) for dp in dynamo_polygon ]
    return shapely_poly
    

sp1 = sh1(dynamo_geometry1)

OUT = sp1
# ----------------------------------------
OUT = Output(python_script)
