# Dynamo custom node ShapelyConcaveHull.dyf "ShapelyGeometrySettings" (Dynamo 2.10.1.3976)
# category: Shapely.Geometry

shgeometry = Input(_shgeometry: var[]..[])
ratio = Input(_ratio: var[]..[])  # 0..1
python_script = Python(IN[0]=shgeometry, IN[1]=ratio)  # CPython3
# ---------- python_script.python (30 lines) ----------
import sys
import os
import clr

localapp = os.getenv(r'LOCALAPPDATA')
sys.path.append(os.path.join(localapp, r'python-3.8.3-embed-amd64\Lib\site-packages'))

import shapely.geometry as sg
from shapely import normalize, Polygon , concave_hull ,MultiPoint ,Point , get_type_id

shapely_geo = IN[0]
tolerance = IN[1]

def spolygon(sp1,xm,ym):

    conva = concave_hull(sp1,xm,ym)
    return conva
shp = []

a = get_type_id(shapely_geo)
if a.all() == 0 :

    shapely_polygons1 = spolygon([MultiPoint(shapely_geo)],tolerance,False)
    concave = shapely_polygons1
else:
    concave = [spolygon(shp1,tolerance,False) for shp1 in shapely_geo]



OUT = concave
# ----------------------------------------
OUT = Output(python_script)
