# Dynamo custom node ShapelyExteriorBoundary.dyf (Dynamo 2.10.1.3976)
# category: Shapely.Analyse

shpolygon = Input(_shpolygon: var[]..[])
python_script = Python(IN[0]=shpolygon)  # CPython3
# ---------- python_script.python (23 lines) ----------
import sys
import os
import clr

localapp = os.getenv(r'LOCALAPPDATA')
sys.path.append(os.path.join(localapp, r'python-3.8.3-embed-amd64\Lib\site-packages'))
import shapely.geometry as sg
from shapely import normalize, Polygon, get_exterior_ring
from shapely.geometry import Polygon, MultiPolygon ,MultiLineString ,Point


shapely_poly = IN[0]

def get_shell (geometry ) :
    
    shell = [get_exterior_ring(geo) for geo in geometry]
    
    return shell

sh = get_shell(shapely_poly)


OUT = sh
# ----------------------------------------
OUT = Output(python_script)
