# Dynamo custom node ShapelyGetPoint.dyf (Dynamo 2.10.1.3976)
# category: Shapely.Geometry.Line

shlinestring = Input(_shlinestring: var[]..[])
distance = Input(_distance: var[]..[])
python_script = Python(IN[0]=shlinestring, IN[1]=distance)  # CPython3
# ---------- python_script.python (25 lines) ----------
import sys
import os
import clr

localapp = os.getenv(r'LOCALAPPDATA')
sys.path.append(os.path.join(localapp, r'python-3.8.3-embed-amd64\Lib\site-packages'))

import shapely.geometry as sg
from shapely import normalize, Polygon , line_interpolate_point

def spolygon(sp1,dst):

    interpol = line_interpolate_point(sp1,dst)
    return interpol


if isinstance(IN[0], list):
    shapely_polygons1 = IN[0]
else:
    shapely_polygons1 = [IN[0]]

distance = IN[1]
interpolate = [spolygon(shp1,distance) for shp1 in shapely_polygons1]

OUT = interpolate
# ----------------------------------------
OUT = Output(python_script)
