# Dynamo custom node ShapelyLineMerge.dyf (Dynamo 2.10.1.3976)
# category: Shapely.Geometry.Line

shlinestring = Input(_shlinestring: var[]..[])
python_script = Python(IN[0]=shlinestring)  # CPython3
# ---------- python_script.python (25 lines) ----------
import sys
import os
import clr

localapp = os.getenv(r'LOCALAPPDATA')
sys.path.append(os.path.join(localapp, r'python-3.8.3-embed-amd64\Lib\site-packages'))

import shapely.geometry as sg
from shapely import normalize, MultiLineString , line_merge , get_parts

def spolygon(sp1):

    interpol = line_merge(MultiLineString([sp for sp in sp1]))
    return interpol


if isinstance(IN[0], list):
    shapely_polygons1 = IN[0]
else:
    shapely_polygons1 = [IN[0]]


interpolate = spolygon(shapely_polygons1).geoms

OUT = interpolate
# ----------------------------------------
OUT = Output(python_script)
