# Dynamo custom node ShapelyMinRotateRectangle.dyf (Dynamo 2.10.1.3976)
# category: Shapely.Geometry

dynpoints = Input(_dynpoints: var[]..[])
python_script = Python(IN[0]=dynpoints)  # CPython3
# ---------- python_script.python (30 lines) ----------
import sys
import os
import clr

localapp = os.getenv(r'LOCALAPPDATA')
sys.path.append(os.path.join(localapp, r'python-3.8.3-embed-amd64\Lib\site-packages'))
import shapely.geometry as sg
import Autodesk.DesignScript.Geometry as adg
from shapely import normalize, Polygon , BufferJoinStyle, convex_hull

shapely_polygons = []

def spolygon (dynamo_polygons ):
    polygon_parts = []
    
    shapely_geometry1 = sg.Point(dynamo_polygons.X, dynamo_polygons.Y)
    shapely_poly = shapely_geometry1
    return shapely_poly


if isinstance(IN[0], list):
    dynamo_polygons = IN[0]
else:
    dynamo_polygons = [IN[0]]

dynamo_geometries = [spolygon(geometry) for geometry in dynamo_polygons]

shapely_polygons = sg.MultiPoint(dynamo_geometries)

OUT = shapely_polygons.minimum_rotated_rectangle
# ----------------------------------------
OUT = Output(python_script)
