# Dynamo custom node ShapelyNearestPoint.dyf (Dynamo 2.10.1.3976)
# category: Shapely.Geometry

shpolygon = Input(_shpolygon: var[]..[])
shpolygon_2 = Input(_shpolygon: var[]..[])
python_script = Python(IN[0]=shpolygon, IN[1]=shpolygon_2)  # CPython3
# ---------- python_script.python (18 lines) ----------
import sys
import os
import clr

localapp = os.getenv(r'LOCALAPPDATA')
sys.path.append(os.path.join(localapp, r'python-3.8.3-embed-amd64\Lib\site-packages'))
import shapely.geometry as sg
import Autodesk.DesignScript.Geometry as adg
from shapely import normalize, Polygon , BufferJoinStyle
from shapely.ops import nearest_points


dynamo_geometry1 = IN[0]
dynamo_geometry2 = IN[1]

minpo = nearest_points(dynamo_geometry1, dynamo_geometry2)

OUT = minpo[0]
# ----------------------------------------
OUT = Output(python_script)
