# Dynamo custom node ShapelyOffsetParalel.dyf (Dynamo 2.10.1.3976)
# category: Shapely.Geometry

shpolygon = Input(_shpolygon: var[]..[])
distance = Input(_distance: var[]..[])
side = Input(_side: var[]..[])  # True : right False : left
type = Input(_type: var[]..[])  # True : Round False : Mitre
python_script = Python(IN[0]=shpolygon, IN[1]=distance, IN[2]=side, IN[3]=type)  # CPython3
# ---------- python_script.python (44 lines) ----------
import sys
import os
import clr

localapp = os.getenv(r'LOCALAPPDATA')
sys.path.append(os.path.join(localapp, r'python-3.8.3-embed-amd64\Lib\site-packages'))
import shapely.geometry as sg
import Autodesk.DesignScript.Geometry as adg
from shapely import normalize, Polygon , BufferJoinStyle, MultiLineString, LinearRing 

dynamo_polygons = IN[0]
distance = IN[1]
side = IN[2]
type = IN[3]

def spolygon(dynamo_polygon):
    shapely_poly = dynamo_polygon
    exterior_ring = LinearRing(list(shapely_poly.exterior.coords))
    multilinestring = MultiLineString([exterior_ring])
    
    return multilinestring

dynamo_geometries = spolygon(dynamo_polygons)

if side == True :
    s = 'right'
else :
    s = 'left'
    
    
if type == True :
    ty = 1
    
elif type == False :
     ty = 2
     
else :
    ty = 3

a = list(dynamo_geometries.geoms)
b = [geom.parallel_offset(distance, s,200, ty,10) for geom in a]
multilinestring = MultiLineString(b).geoms

OUT = multilinestring
# ----------------------------------------
OUT = Output(python_script)
