# Dynamo custom node ShapelyPointoDynamo.dyf (Dynamo 2.10.1.3976)
# category: Shapely.Conversion

dynpoints = Input(_dynpoints: var[]..[])
code_block = CodeBlock(p=dynpoints) { p.X; p.Y; }
list_create = List.Create(item0=code_block.out0, item1=code_block.out1)
transpose = List.Transpose(lists=list_create)
python_script = Python(IN[0]=transpose)  # CPython3
# ---------- python_script.python (30 lines) ----------
import sys
import os
import clr

localapp = os.getenv(r'LOCALAPPDATA')
sys.path.append(os.path.join(localapp, r'python-3.8.3-embed-amd64\Lib\site-packages'))
import shapely.geometry as sg
import Autodesk.DesignScript.Geometry as adg
from shapely import normalize, Polygon , BufferJoinStyle
from shapely.geometry import Polygon, Point


dynamo_point = IN[0]
shapely_poly = []

def spolygon (dynamo_polygons ):
    
    exterior_points = [coord for coord in dynamo_polygons]
    shapely_poly = Point(exterior_points)
    return shapely_poly


if isinstance(IN[0], list):
    dynamo_point = IN[0]
else:
    dynamo_point = [IN[0]]

dynamo_geometries = [spolygon(geometry) for geometry in dynamo_point]

OUT = dynamo_geometries
# ----------------------------------------
shpoints = Output(python_script)  # "_shpoints"
