# Dynamo custom node ShapelyPruneDuplicated.dyf (Dynamo 2.10.1.3976)
# category: Shapely.Geometry

shgeometry = Input(_shgeometry: var[]..[])
tolerance = Input(_tolerance: var[]..[])
python_script = Python(IN[0]=shgeometry, IN[1]=tolerance)  # CPython3
# ---------- python_script.python (24 lines) ----------
import sys
import os
import clr

localapp = os.getenv(r'LOCALAPPDATA')
sys.path.append(os.path.join(localapp, r'python-3.8.3-embed-amd64\Lib\site-packages'))

import shapely.geometry as sg
from shapely import normalize, Polygon , remove_repeated_points

def spolygon(sp1,tlr):

    rmp = remove_repeated_points(sp1,tlr)
    return rmp


if isinstance(IN[0], list):
    shapely_polygons1 = IN[0]
else:
    shapely_polygons1 = [IN[0]]
tolerance = IN[1]
duplicated = [spolygon(shp1,tolerance) for shp1 in shapely_polygons1]

OUT = duplicated
# ----------------------------------------
OUT = Output(python_script)
