# Dynamo custom node ShapelySegmentize.dyf (Dynamo 2.10.1.3976)
# category: Shapely.Geometry

shgeometry = Input(_shgeometry: var[]..[])
segment = Input(_segment: var[]..[])  # 0..~1000
python_script = Python(IN[0]=shgeometry, IN[1]=segment)  # CPython3
# ---------- python_script.python (22 lines) ----------
import sys
import os
import clr

localapp = os.getenv(r'LOCALAPPDATA')
sys.path.append(os.path.join(localapp, r'python-3.8.3-embed-amd64\Lib\site-packages'))

import shapely.geometry as sg
from shapely import normalize, Polygon , segmentize 

shapely_geo = IN[0]
tolerance = IN[1]

def spolygon(sp1,xm):

    seg = segmentize(sp1,xm)
    return seg


segmentize = [spolygon(shp1,tolerance) for shp1 in shapely_geo]

OUT = segmentize
# ----------------------------------------
OUT = Output(python_script)
