# Dynamo custom node ShapelySetPrecision.dyf (Dynamo 2.10.1.3976)
# category: Shapely.Geometry

shpolygon = Input(_shpolygon: var[]..[])
gridsize = Input(_gridsize: var[]..[])  # 0..200
mode = Input(_mode: bool = true)  # True : valid_output False : pointwise
python_script = Python(IN[0]=shpolygon, IN[1]=gridsize, IN[2]=mode)  # CPython3
# ---------- python_script.python (33 lines) ----------
import sys
import os
import clr

localapp = os.getenv(r'LOCALAPPDATA')
sys.path.append(os.path.join(localapp, r'python-3.8.3-embed-amd64\Lib\site-packages'))
import shapely.geometry as sg
from shapely import normalize, Polygon, set_precision
from shapely.geometry import Polygon, MultiPolygon ,MultiLineString ,Point


shapely_poly = IN[0]
grids = IN[1]
modes = IN[2]


def precision (geo,gr,mode) :
    
    if modes == True :
        md = "valid_output"
        
    else :
        md = "pointwise"
        
    sy = [g for g in geo]
    
    sg = set_precision(sy,gr,md)
    return sg
    
      
sh = precision(shapely_poly,grids,modes)

OUT = sh
# ----------------------------------------
OUT = Output(python_script)
