# Dynamo custom node ShapelySimplyGeo.dyf (Dynamo 2.10.1.3976)
# category: Shapely.Geometry

shpolygon = Input(_shpolygon: var[]..[])
python_script = Python(IN[0]=shpolygon)  # CPython3
# ---------- python_script.python (23 lines) ----------
import sys
import os
import clr

localapp = os.getenv(r'LOCALAPPDATA')
sys.path.append(os.path.join(localapp, r'python-3.8.3-embed-amd64\Lib\site-packages'))
import shapely.geometry as sg
import Autodesk.DesignScript.Geometry as adg
from shapely import normalize, Polygon , BufferJoinStyle , wkt


def simpleply(shapely_geometry1):
    sp = [] 
    tt = [sp.append(shp) or shp for shp in shapely_geometry1]
    sm = [tm.convex_hull for tm in tt]
    return list(sm)


# Shapely geometrilerine dönüştürme

dynamo_geometry1 = simpleply(IN[0])

OUT = dynamo_geometry1
# ----------------------------------------
OUT = Output(python_script)
