# Dynamo custom node ShapelyTouchesByDistance.dyf (Dynamo 2.10.1.3976)
# category: Shapely.Analyse

shgeometry1 = Input(_shgeometry1: var[]..[])
shgeometry2 = Input(_shgeometry2: var[]..[])
distance = Input(_distance: var[]..[])
python_script = Python(IN[0]=shgeometry1, IN[1]=shgeometry2, IN[2]=distance)  # CPython3
# ---------- python_script.python (30 lines) ----------
import sys
import os
import clr

localapp = os.getenv(r'LOCALAPPDATA')
sys.path.append(os.path.join(localapp, r'python-3.8.3-embed-amd64\Lib\site-packages'))

import shapely.geometry as sg
from shapely import normalize, Polygon , dwithin

def spolygon(sp1, sp2,ds):

    dwtih = dwithin(sp1, sp2,ds)
    return dwtih


if isinstance(IN[0], list):
    shapely_polygons1 = IN[0]
else:
    shapely_polygons1 = [IN[0]]

if isinstance(IN[1], list):
    shapely_polygons2 = IN[1]
else:
    shapely_polygons2 = [IN[1]]
    
distance = IN[2]
dwithin = [spolygon(shp1,shp2,distance) for (shp1,shp2) in zip(shapely_polygons1,shapely_polygons2)]

OUT = dwithin
# ----------------------------------------
OUT = Output(python_script)
