# Dynamo custom node ShapelyTriangulate.dyf (Dynamo 2.10.1.3976)
# category: Shapely.Geometry

dynpoints = Input(_dynpoints: var[]..[])
code_block = CodeBlock(p=dynpoints) { p.X; p.Y; }
list_create = List.Create(item0=code_block.out0, item1=code_block.out1)
transpose = List.Transpose(lists=list_create)
count = List.Count(list=list_create@L2)
chop = List.Chop(list=transpose, lengths=count)
python_script = Python(IN[0]=chop)  # CPython3
# ---------- python_script.python (30 lines) ----------
import sys
import os
import clr

localapp = os.getenv(r'LOCALAPPDATA')
sys.path.append(os.path.join(localapp, r'python-3.8.3-embed-amd64\Lib\site-packages'))
import shapely.geometry as sg
import Autodesk.DesignScript.Geometry as adg
from shapely import normalize, Polygon , BufferJoinStyle , MultiPoint
from shapely.ops import triangulate


def spolygon (dynamo_polygons ):
    
   
    multipoint = sg.MultiPoint([coord for coord in dynamo_polygons])
    shapely_poly = multipoint
    return shapely_poly


if isinstance(IN[0], list):
    dynamo_polygons = IN[0]
else:
    dynamo_polygons = [IN[0]]

dynamo_geometries = [spolygon(geometry) for geometry in dynamo_polygons]

tri = [triangulate(dyn) for dyn in dynamo_geometries]

OUT = tri
# ----------------------------------------
OUT = Output(python_script)
