# Dynamo custom node ShapelyUnion.dyf (Dynamo 2.10.1.3976)
# category: Shapely.Geometry

listshpolygon = Input(_listshpolygon: var[]..[])  # Polygon Shapely
python_script = Python(IN[0]=listshpolygon)  # CPython3
# ---------- python_script.python (34 lines) ----------
import sys
import os
import clr

localapp = os.getenv(r'LOCALAPPDATA')
sys.path.append(os.path.join(localapp, r'python-3.8.3-embed-amd64\Lib\site-packages'))
import shapely.geometry as sg
import Autodesk.DesignScript.Geometry as adg
from shapely import normalize, Polygon , BufferJoinStyle , get_type_id
from shapely.ops import unary_union 


def spolygon(shapely_polygons):

    sp = [] 
    tt = [sp.append(shp) or shp for shp in shapely_polygons]
    return list(tt)

shapely_polygons = spolygon(IN[0])
merged_polygon = unary_union(shapely_polygons)

type = get_type_id(merged_polygon)

if type == [5] :
    
    gm = merged_polygon.geoms
    
elif type == [6] :
    
    gm = merged_polygon.geoms

else :  
    gm = merged_polygon
OUT = gm
# ----------------------------------------
OUT = Output(python_script)
