# Dynamo custom node Shapelyintersection.dyf (Dynamo 2.10.1.3976)
# category: Shapely.Geometry

shgeometry1 = Input(_shgeometry1: var[]..[])
shgeometry2 = Input(_shgeometry2: var[]..[])
python_script = Python(IN[0]=shgeometry1, IN[1]=shgeometry2)  # CPython3
# ---------- python_script.python (30 lines) ----------
import sys
import os
import clr

localapp = os.getenv(r'LOCALAPPDATA')
sys.path.append(os.path.join(localapp, r'python-3.8.3-embed-amd64\Lib\site-packages'))

import shapely.geometry as sg
from shapely import normalize, Polygon , intersection

def spolygon(sp1, sp2):

    intersec = intersection(sp1, sp2)
    return intersec


if isinstance(IN[0], list):
    shapely_polygons1 = IN[0]
else:
    shapely_polygons1 = [IN[0]]

if isinstance(IN[1], list):
    shapely_polygons2 = IN[1]
else:
    shapely_polygons2 = [IN[1]]
    

intersection = [spolygon(shp1,shp2) for (shp1,shp2) in zip(shapely_polygons1,shapely_polygons2)]

OUT = intersection
# ----------------------------------------
OUT = Output(python_script)
